# Dynamo graph 000-Points and Vectors.dyn (Dynamo 2.5.2.7915)

# group: NOTES - D4C3D
# note: DESIGN GRAPH STANDARDS
# Author:		Stephan Gumpert
# Date Created:	7 Jan 2021
# Date Updated:	7 Jan 2021
# Version:		001
# DESIGN GRAPH GUIDELINES
# 1. Color code your blocks according to this guide.
# 2. Add grouping with name and description.
# 3. Add notes to explain each critical node process.
# 4. Rename Input / Output / Code Blocks nodes and add suffix to data they carry.
# 5. Align nodes to make it neat.
# 6. Save the graph as Manual instead of Automatic.

# group: GRAPH INFO
# note: ________________________________________________________
# Advance Steel Core Ver: 	2.4.1.6394
# Package Used: 		Advance Steel
# Custom Nodes Used: 	None
# Graph Function:
# 1. How to Select a Point
# 2. Create a Point via Code Block or Node
# 3. Derive a point from another point
# 4. Create a Vector from Code Block or Node
# Created By: 		Stephan Gumpert
# Date Created: 		January 2021
# Updated By:
# Date Modified:

# group: Select a Point
selectPoint = ASPointSelection()  # nothing selected

# group: CREATE Vectors
# note: Create Vectors via Code Blocks or Nodes
XAxis = Vector.XAxis()
YAxis = Vector.YAxis()
ZAxis = Vector.ZAxis()
code_block = CodeBlock { Point.ByCoordinates(0,0,0); Point.ByCoordinates(0,10,0); }
byTwoPoints = Vector.ByTwoPoints(start=code_block.out0, end=code_block.out1)
watch = Watch(byTwoPoints)
code_block_2 = CodeBlock { 0; 1; }
byCoordinates = Vector.ByCoordinates(x=code_block_2.out0, y=code_block_2.out0, z=code_block_2.out1)
watch_2 = Watch(byCoordinates)
define_z_vector_via_code_block = CodeBlock { Vector.ByCoordinates(0,0,1); Vector.ZAxis(); }
watch_3 = Watch(define_z_vector_via_code_block.out0)
watch_4 = Watch(define_z_vector_via_code_block.out1)

# group: CREATE Points
code_block_3 = CodeBlock { 0; }
byCoordinates_2 = Point.ByCoordinates(x=code_block_3, y=code_block_3, z=code_block_3)
watch_5 = Watch(byCoordinates_2)
world_ucs_origin_point = CodeBlock { Point.Origin(); }
watch_6 = Watch(world_ucs_origin_point)
origin = Point.Origin()
watch_7 = Watch(origin)
# note: Create Points via Code Blocks or Nodes
define_point_with_x_y_z_values = CodeBlock { Point.ByCoordinates(0,0,0); }
watch_8 = Watch(define_point_with_x_y_z_values)

# group: DERIVE Points
code_block_4 = CodeBlock { Point.ByCoordinates(50,-10,20); Point.ByCoordinates(50,10,20); 20; }
n20_units_in_the_z_direction = AdvanceSteel.Nodes.Util.Geometry.GetPointInDirection(point=watch_7, direction=watch_4, distance=code_block_4.out2)
watch_9 = Watch(n20_units_in_the_z_direction)
# note: Derive Points from other points and/or vectors
byStartPointEndPoint = Line.ByStartPointEndPoint(startPoint=code_block_4.out0, endPoint=code_block_4.out1)
orthoProjectPointToLine = AdvanceSteel.Nodes.Util.Geometry.OrthoProjectPointToLine(point=watch_8, line=byStartPointEndPoint)
watch_10 = Watch(orthoProjectPointToLine.FoundPoint)
getMidBetweenPoints = AdvanceSteel.Nodes.Util.Geometry.GetMidBetweenPoints(firstPoint=code_block_4.out0, secondPoint=code_block_4.out1)
watch_11 = Watch(getMidBetweenPoints)
watch_12 = Watch(orthoProjectPointToLine.IsOnline)
