# Dynamo graph 001-Planes.dyn (Dynamo 2.5.2.7915)

# group: NOTES - D4C3D
# note: DESIGN GRAPH STANDARDS
# Author:		Stephan Gumpert
# Date Created:	7 Jan 2021
# Date Updated:	7 Jan 2021
# Version:		001
# DESIGN GRAPH GUIDELINES
# 1. Color code your blocks according to this guide.
# 2. Add grouping with name and description.
# 3. Add notes to explain each critical node process.
# 4. Rename Input / Output / Code Blocks nodes and add suffix to data they carry.
# 5. Align nodes to make it neat.
# 6. Save the graph as Manual instead of Automatic.

# group: GRAPH INFO
# note: ________________________________________________________
# Advance Steel Core Ver: 	2.4.1.6394
# Package Used: 		Advance Steel
# Custom Nodes Used: 	None
# Graph Function:
# 1. How to Create a Plane
# 2. How to Derive a plane
# Created By: 		Stephan Gumpert
# Date Created: 		January 2021
# Updated By:
# Date Modified:

# group: DERIVE Planes
# note: Derive Points from other points and/or vectors
code_block = CodeBlock()
# ---------- code_block.designscript (6 lines) ----------
Point.ByCoordinates(50,50,20);
Point.ByCoordinates(50,10,20);
20;
Point.ByCoordinates(0,-100,0);
150;
Point.ByCoordinates(-100,-100,-100);
# ----------------------------------------
ZAxis = Vector.ZAxis()
getPlaneInDirection = AdvanceSteel.Nodes.Util.Geometry.GetPlaneInDirection(point=code_block.out0, planeNormal=ZAxis, distance=code_block.out2)
watch = Watch(getPlaneInDirection)
setPlaneOrigin = AdvanceSteel.Nodes.Util.Geometry.SetPlaneOrigin(plane=watch, point=code_block.out5)
watch_2 = Watch(setPlaneOrigin)
orthoProjectPointToPlane = AdvanceSteel.Nodes.Util.Geometry.OrthoProjectPointToPlane(point=code_block.out0, projectionPlane=watch_2)
watch_3 = Watch(orthoProjectPointToPlane)
XAxis = Vector.XAxis()
getPlaneOffsetByCentre = AdvanceSteel.Nodes.Util.Geometry.GetPlaneOffsetByCentre(centrePoint=code_block.out3, planeNormal=XAxis, distance=code_block.out4)
watch_4 = Watch(getPlaneOffsetByCentre.PlaneNegative)

# group: CREATE Planes
world_ucs_origin_point = CodeBlock { Point.ByCoordinates(50,20,0); Point.ByCoordinates(70,30,0); Point.ByCoordinates(50,30,0); }
byThreePoints = Plane.ByThreePoints(origin=world_ucs_origin_point.out0, planePoint=world_ucs_origin_point.out1, xAxisPoint=world_ucs_origin_point.out2)
origin = Point.Origin()
watch_5 = Watch(origin)
watch_6 = Watch(world_ucs_origin_point.out0)
code_block_2 = CodeBlock { 0; }
# note: Create Points via Code Blocks or Nodes
byCoordinates = Point.ByCoordinates(x=code_block_2, y=code_block_2, z=code_block_2)
ZAxis_2 = Vector.ZAxis()
byOriginNormal = Plane.ByOriginNormal(origin=byCoordinates, normal=ZAxis_2)
watch_7 = Watch(byOriginNormal)
