# Dynamo graph 002-Selection.dyn (Dynamo 2.13.1.3887)
# author: Autodesk

# group: GET
# note: Select Point In Model - User Interaction
selectPoint = ASPointSelection()  # 1 picked in the model

# group: SET
# note: Set Vector and Distance Value
code_block = CodeBlock { Vector.XAxis(); 100; }

# group: PROCESS
# note: Dynamo data manipulation
translate = Geometry.Translate(geometry=selectPoint, direction=code_block.out0, distance=code_block.out1)
watch = Watch(translate)

# group: SET
# note: Set or Override Selection Parameters
advanceSteelObjectTypes = ASObjecTypes("Straight Beam")
advanceSteelObjectTypes_2 = ASObjecTypes("Grating")
list_create = List.Create(item0=advanceSteelObjectTypes, item1=advanceSteelObjectTypes_2)

# group: GET
# note: User interaction to select objects then filter by object Type of Straight Baem and Grating
selectAdvanceSteelObjects = ASObjectSelection()  # 3 picked in the model
filterSelectionByType = AdvanceSteel.Nodes.Selection.SelectionFilter.FilterSelectionByType(steelObjects=selectAdvanceSteelObjects, objectTypeFilters=list_create)
watch_2 = Watch(filterSelectionByType)

# group: SET
# note: Select All object in Model By Type
getSteelObjectsByType = ASSelectObjecTypes("Straight Beam")

watch_3 = Watch(getSteelObjectsByType)
