# Dynamo graph 003-Beams.dyn (Dynamo 3.7.0.11777)
# author: Autodesk

# group: SET Parameters
# note: BentBeam Parameters
code_block = CodeBlock { Point.ByCoordinates(0,0,0); Point.ByCoordinates(1001,1200,0); Point.ByCoordinates(2001,2000,0); Vector.ZAxis(); }
beam_reference_axis = BeamRefAxisType("Upper Middle")

# group: BENTBEAM
# note: Create By Start Point and End Point
byStartPointEndPoint = AdvanceSteel.Nodes.Beams.BentBeam.ByStartPointEndPoint(start=code_block.out0, end=code_block.out2, ptOnArc=code_block.out1, orientation=code_block.out3, refAxis=beam_reference_axis)

# group: SET Parameters
# note: Set Bent Beam base geometry
code_block_2 = CodeBlock { Point.ByCoordinates(0,0,0); Point.ByCoordinates(2001,1200,0); Point.ByCoordinates(3001,2000,0); Vector.ZAxis(); }
byThreePoints = Arc.ByThreePoints(firstPoint=code_block_2.out0, secondPoint=code_block_2.out1, thirdPoint=code_block_2.out2)
beam_reference_axis_2 = BeamRefAxisType("Upper Middle")

# group: ADDITIONAL PARAMETERS
bent_beam_properties = ASPropertiesBentBeam("Profile Name")
# note: Additional Beam Properties for Creation - Section SIze
code_block_3 = CodeBlock { "Lindab Z Profiles"; "ZUni 35025"; }
createSectionString = AdvanceSteel.Nodes.Util.Beam.CreateSectionString(sectionType=code_block_3.out0, sectionSize=code_block_3.out1)
byNameAndValue = AdvanceSteel.Nodes.Property.ByNameAndValue(propertyName=bent_beam_properties, value=createSectionString)

# group: ADDITIONAL PARAMETERS
# note: Additional Beam Properties for Creation - Profile Name
bentBeamProperties = ASPropertiesBentBeam("Role")
code_block_4 = CodeBlock { "Horizontal_Beam"; }
byNameAndValue_2 = AdvanceSteel.Nodes.Property.ByNameAndValue(propertyName=bentBeamProperties, value=code_block_4)

list_create = List.Create(item0=byNameAndValue, item1=byNameAndValue_2)

# group: BENTBEAM
# note: Create by Arc Object
byArc = AdvanceSteel.Nodes.Beams.BentBeam.ByArc(arc=byThreePoints, orientation=code_block_2.out3, refAxis=beam_reference_axis_2, additionalBeamParameters=list_create)

# group: SET
code_block_5 = CodeBlock { Point.ByCoordinates(0,0,1001); Point.ByCoordinates(2000,0,100); Vector.ZAxis(); Vector.XAxis(); 5000; }
# note: Set or Override Parameter in Civil 3D
code_block_6 = CodeBlock { Point.ByCoordinates(0,0,0); Point.ByCoordinates(2001,0,0); Vector.ZAxis(); Vector.YAxis(); }

# group: CREATE
# note: Create object in Civil 3D
byStartPointEndPoint_2 = AdvanceSteel.Nodes.Beams.StraightBeam.ByStartPointEndPoint(start=code_block_5.out0, end=code_block_5.out1, orientation=code_block_6.out2)

# group: ADDITIONAL PARAMETERS
straight_beam_properties = ASPropertiesStraightBeam("Profile Name")
# note: Set or Override Parameter in Civil 3D
code_block_7 = CodeBlock { "AISC 14.1 Angle equal"; "L4X4X7/16"; }
createSectionString_2 = AdvanceSteel.Nodes.Util.Beam.CreateSectionString(sectionType=code_block_7.out0, sectionSize=code_block_7.out1)
byNameAndValue_3 = AdvanceSteel.Nodes.Property.ByNameAndValue(propertyName=straight_beam_properties, value=createSectionString_2)
straightBeamProperties = ASPropertiesStraightBeam("Role")
code_block_8 = CodeBlock { "Horizontal_Beam"; "Steel"; }
byNameAndValue_4 = AdvanceSteel.Nodes.Property.ByNameAndValue(propertyName=straightBeamProperties, value=code_block_8.out0)
straightBeamProperties_2 = ASPropertiesStraightBeam("Material")
byNameAndValue_5 = AdvanceSteel.Nodes.Property.ByNameAndValue(propertyName=straightBeamProperties_2, value=code_block_8.out1)
list_create_2 = List.Create(item0=byNameAndValue_3, item1=byNameAndValue_4, item2=byNameAndValue_5)

# group: CREATE
# note: Create object in Civil 3D
byStartPointDirectionLength = AdvanceSteel.Nodes.Beams.StraightBeam.ByStartPointDirectionLength(start=code_block_6.out0, direction=code_block_5.out2, orientation=code_block_5.out3, length=code_block_5.out4, additionalBeamParameters=list_create_2)

# group: CREATE STRAIGHT BEAM
# note: Create object in Civil 3D
byStartPointEndPoint_3 = Line.ByStartPointEndPoint(startPoint=code_block_6.out0, endPoint=code_block_5.out1)
beam_reference_axis_3 = BeamRefAxisType("Upper Middle")
byLine = AdvanceSteel.Nodes.Beams.StraightBeam.ByLine(line=byStartPointEndPoint_3, orientation=code_block_6.out3, refAxis=beam_reference_axis_3)

# group: CREATE
beam_reference_axis_4 = BeamRefAxisType("Upper Middle")
# note: Create object in Civil 3D
byStartPointDirectionLength_2 = AdvanceSteel.Nodes.Beams.StraightBeam.ByStartPointDirectionLength(start=code_block_6.out1, direction=code_block_5.out2, orientation=code_block_5.out3, length=code_block_5.out4, refAxis=beam_reference_axis_4)

# group: SET Parameters
# note: Set Tapered Beam base geometry
code_block_9 = CodeBlock { Point.ByCoordinates(0,0,0); Point.ByCoordinates(2000,2000,2000); Vector.ZAxis(); }

# group: ADDITIONAL PARAMETERS
taperedBeamProperties = ASPropertiesTaperedBeam("Profile Name")
# note: Additional Beam Properties for Creation - Profile Name
code_block_10 = CodeBlock { "TaperedBeam"; "Default"; }
createSectionString_3 = AdvanceSteel.Nodes.Util.Beam.CreateSectionString(sectionType=code_block_10.out0, sectionSize=code_block_10.out1)
byNameAndValue_6 = AdvanceSteel.Nodes.Property.ByNameAndValue(propertyName=taperedBeamProperties, value=createSectionString_3)
list_create_3 = List.Create(item0=byNameAndValue_6)

# group: CREATE
# note: Create Tapered Beam via 2 points
byStartPointEndPoint_4 = AdvanceSteel.Nodes.Beams.TaperedBeam.ByStartPointEndPoint(start=code_block_9.out0, end=code_block_9.out1, vOrientation=code_block_9.out2, additionalBeamParameters=list_create_3)

# group: SET Parameters
code_block_11 = CodeBlock { Point.ByCoordinates(0,0,0); Point.ByCoordinates(0,2000,2000); Vector.ZAxis(); }
# note: Set Compund Beam base geometry
code_block_12 = CodeBlock { "Compound2UToe"; "Default"; }
createSectionString_4 = AdvanceSteel.Nodes.Util.Beam.CreateSectionString(sectionType=code_block_12.out0, sectionSize=code_block_12.out1)

# group: CREATE COMPOUND BEAM
# note: Create by using Start and End Point
byStartPointEndPoint_5 = AdvanceSteel.Nodes.Beams.CompoundBeam.ByStartPointEndPoint(start=code_block_11.out0, end=code_block_11.out1, orientation=code_block_11.out2, sectionName=createSectionString_4)
