# Dynamo graph 004-Plates.dyn (Dynamo 3.7.0.11777)
# author: Autodesk

# group: DATA IN
# note: Import information / data from others
code_block = CodeBlock()
# ---------- code_block.designscript (4 lines) ----------
Point.ByCoordinates(1, 0, 0);
Point.ByCoordinates(501, 0, 0);
Point.ByCoordinates(501, 500, 100);
Point.ByCoordinates(0, 500, 100);
# ----------------------------------------

# group: SET
# note: Set a list of point to create polygon
create = List.Create(item0=code_block.out0, item1=code_block.out1, item2=code_block.out2, item3=code_block.out3)
byPoints = Polygon.ByPoints(points=create)

# group: CREATE PLATE
# note: Create Plate by Polygon
byPolygon = AdvanceSteel.Nodes.Plates.Plate.ByPolygon(poly=byPoints)

# group: DATA IN
# note: Import information / data from others
code_block_2 = CodeBlock { Vector.XAxis(); Vector.YAxis(); Vector.ZAxis(); }
code_block_3 = CodeBlock { 250.0; 300.00; }

# group: SET
# note: Create Coordinate System
byOriginVectors = CoordinateSystem.ByOriginVectors(origin=code_block.out0, xAxis=code_block_2.out0, yAxis=code_block_2.out1, zAxis=code_block_2.out2)

# group: DATA IN
# note: Property Name and Data
writable_plate_properties = ASPropertiesPlate("Plate Portioning")
code_block_4 = CodeBlock { 0.0; 0.5; 1.0; }
byNameAndValue = AdvanceSteel.Nodes.Property.ByNameAndValue(propertyName=writable_plate_properties, value=code_block_4.out0)
writable_plate_properties_2 = ASPropertiesPlate("Thickness")
code_block_5 = CodeBlock { 25.0; }
byNameAndValue_2 = AdvanceSteel.Nodes.Property.ByNameAndValue(propertyName=writable_plate_properties_2, value=code_block_5)
list_create = List.Create(item0=byNameAndValue, item1=byNameAndValue_2)

# group: CREATE
# note: Create Plate by rectangular shape and Coordinate System
byRectanglarByCS = AdvanceSteel.Nodes.Plates.Plate.ByRectanglarByCS(coordinateSystem=byOriginVectors, length=code_block_3.out0, width=code_block_3.out1, additionalPlateParameters=list_create)

# group: DATA IN
# note: Import information / data from others
code_block_6 = CodeBlock()
# ---------- code_block_6.designscript (4 lines) ----------
Point.ByCoordinates(0, 0, 0);
Point.ByCoordinates(501, 0, 0);
Point.ByCoordinates(501, 500, 100);
Point.ByCoordinates(0, 500, 100);
# ----------------------------------------
code_block_7 = CodeBlock { 100.00; Vector.YAxis(); 25; 1; }

# group: SET
# note: Set Line object by 2 points
byStartPointEndPoint = Line.ByStartPointEndPoint(startPoint=code_block_6.out0, endPoint=code_block_6.out1)

# group: CREATE PLATE
# note: Create plate by using a the line as one edge of the plate
byLengthEdge = AdvanceSteel.Nodes.Plates.Plate.ByLengthEdge(line=byStartPointEndPoint, normal=code_block_7.out1, width=code_block_7.out0)

# group: DATA IN
# note: Import information / data from others
code_block_8 = CodeBlock()
# ---------- code_block_8.designscript (4 lines) ----------
Point.ByCoordinates(100, 50, 0);
Point.ByCoordinates(1500, 500, 0);
Point.ByCoordinates(501, 500, 100);
Point.ByCoordinates(0, 500, 100);
# ----------------------------------------
code_block_9 = CodeBlock { Vector.XAxis(); Vector.YAxis(); Vector.ZAxis(); }
code_block_10 = CodeBlock { 25; 1; }

# group: SET
# note: Create Coordinate System
byOriginVectors_2 = CoordinateSystem.ByOriginVectors(origin=code_block_8.out0, xAxis=code_block_9.out0, yAxis=code_block_9.out1, zAxis=code_block_9.out2)

# group: CREATE PLATE
# note: Create Plate by 2 diagonal points
byTwoDiagonalPointsByCS = AdvanceSteel.Nodes.Plates.Plate.ByTwoDiagonalPointsByCS(cs=byOriginVectors_2, cornerPoint1=code_block_8.out0, cornerPoint2=code_block_8.out1)

# group: DATA IN
# note: Import information / data from others
code_block_11 = CodeBlock { Point.ByCoordinates(500, 0, 0); Point.ByCoordinates(1505, 0, 0); Point.ByCoordinates(0, 0, 500); }

# group: ADDITIONAL PARAMETERS
# note: Additional Plate Properties for Creation - Plate Thickness / Model Role
plateProperties = ASPropertiesPlate("Role")
code_block_12 = CodeBlock { "JoistTopPlate1"; }
byNameAndValue_3 = AdvanceSteel.Nodes.Property.ByNameAndValue(propertyName=plateProperties, value=code_block_12)
plateProperties_2 = ASPropertiesPlate("Thickness")
code_block_13 = CodeBlock { 25; }
byNameAndValue_4 = AdvanceSteel.Nodes.Property.ByNameAndValue(propertyName=plateProperties_2, value=code_block_13)
list_create_2 = List.Create(item0=byNameAndValue_3, item1=byNameAndValue_4)

# group: CREATE PLATE
# note: Create plate by using a the line as one edge of the plate
byThreePoints = AdvanceSteel.Nodes.Plates.Plate.ByThreePoints(orginPoint=code_block_11.out0, xDirectionPoint=code_block_11.out1, yDirectionPoint=code_block_11.out2, additionalPlateParameters=list_create_2)

# group: DATA IN
# note: Import information / data from others
code_block_14 = CodeBlock()
# ---------- code_block_14.designscript (7 lines) ----------
Point.ByCoordinates(0, 0, 0);
Point.ByCoordinates(500, 0, 0);
Point.ByCoordinates(500, 500, 100);
Point.ByCoordinates(0, 500, 100);
Point.ByCoordinates(1000, 500, 100);
Point.ByCoordinates(1000, 1000, 0);
Point.ByCoordinates(500, 1000, 0);
# ----------------------------------------

# group: SET
# note: Set a list of point to create polygon
create_2 = List.Create(item0=code_block_14.out0, item1=code_block_14.out1, item2=code_block_14.out2, item3=code_block_14.out3)
byPoints_2 = Polygon.ByPoints(points=create_2)
create_3 = List.Create(item0=code_block_14.out2, item1=code_block_14.out4, item2=code_block_14.out5, item3=code_block_14.out6)
byPoints_3 = Polygon.ByPoints(points=create_3)

# group: CREATE PLATE
# note: Create Plate by Polygon
byPolygon_2 = AdvanceSteel.Nodes.Plates.Plate.ByPolygon(poly=byPoints_2)
byPolygon_3 = AdvanceSteel.Nodes.Plates.Plate.ByPolygon(poly=byPoints_3)
