# Dynamo graph 006-Cameras.dyn (Dynamo 3.7.0.11777)
# author: Autodesk

# group: SET
# note: Set Camera base parameters
code_block = CodeBlock { CoordinateSystem.ByOriginVectors(Point.ByCoordinates(0,0),Vector.XAxis(),Vector.YAxis()); }
camera_properties = ASPropertiesCamera("Camera Description")
code_block_2 = CodeBlock { "This is Camera"; }

# group: DATA IN
# note: Import information / data from others
byNameAndValue = AdvanceSteel.Nodes.Property.ByNameAndValue(propertyName=camera_properties, value=code_block_2)
list_create = List.Create(item0=byNameAndValue)

# group: SET
# note: Set or Override Parameter in Civil 3D
byCS = AdvanceSteel.Nodes.Miscellaneous.Camera.ByCS(coordinateSystem=code_block, additionalCameraParameters=list_create)

# group: SET new CAMERA SETTINGS
# note: Override Extents and Clipping Values
code_block_3 = CodeBlock { 501; 1000; 1001; 1000; 2; 3; }
setZClipping = AdvanceSteel.Nodes.Miscellaneous.Camera.SetZClipping(steelObject=byCS, clippingSide=code_block_3.out4, upperClippingValue=code_block_3.out0, lowerClippingValue=code_block_3.out2)
setXYExtents = AdvanceSteel.Nodes.Miscellaneous.Camera.SetXYExtents(steelObject=byCS, cameraExtents=code_block_3.out5, xCameraSize=code_block_3.out1, yCameraSize=code_block_3.out3)

# group: GET
# note: Get Camera Extents
getCameraExtents = AdvanceSteel.Nodes.Miscellaneous.Camera.GetCameraExtents(steelObject=byCS)
watch = Watch(getCameraExtents.X_Length)
watch_2 = Watch(getCameraExtents.Y_Length)

# group: GET
# note: Get Camera Clipping near and farside
getCameraClipping = AdvanceSteel.Nodes.Miscellaneous.Camera.GetCameraClipping(steelObject=byCS)
watch_3 = Watch(getCameraClipping.Farside_Clipping)
watch_4 = Watch(getCameraClipping.Nearside_Clipping)
