# Dynamo graph 007-Modifications.dyn (Dynamo 3.3.2.11986)
# author: Autodesk

# group: SET PARAMETERS
# note: Set base parameters of Plate
code_block = CodeBlock()
# ---------- code_block.designscript (6 lines) ----------
CP1=Point.ByCoordinates(-100,-100,0);
CP2=Point.ByCoordinates(3600,-100,0);
CP3=Point.ByCoordinates(3600,3100,0);
CP4=Point.ByCoordinates(-101,3100,0);
Vector.ZAxis();
EdgeDistance=200;
# ----------------------------------------
getMidBetweenPoints = AdvanceSteel.Nodes.Util.Geometry.GetMidBetweenPoints(firstPoint=code_block.CP1, secondPoint=code_block.CP3)
code_block_2 = CodeBlock { Vector.XAxis(); }
list_create = List.Create(item0=code_block.CP1, item1=code_block.CP2, item2=code_block.CP3, item3=code_block.CP4, item4=code_block.CP1)
byPoints = Polygon.ByPoints(points=list_create)

# group: ADDITIONAL PARAMETERS
# note: Additional Plate Properties for Creation - Plate Thickness / Model Role
plateProperties = ASPropertiesPlate("Plate Portioning")
code_block_3 = CodeBlock { 1; }
byNameAndValue = AdvanceSteel.Nodes.Property.ByNameAndValue(propertyName=plateProperties, value=code_block_3)
plateProperties_2 = ASPropertiesPlate("Thickness")
code_block_4 = CodeBlock { 25; }
byNameAndValue_2 = AdvanceSteel.Nodes.Property.ByNameAndValue(propertyName=plateProperties_2, value=code_block_4)
list_create_2 = List.Create(item0=byNameAndValue, item1=byNameAndValue_2)

# group: CREATE PLATE
# note: Create Plate on bottom portioning & 25mm Thick
byPolygon = AdvanceSteel.Nodes.Plates.Plate.ByPolygon(poly=byPoints, additionalPlateParameters=list_create_2)

# group: CREATE POLYCUT
# note: Create Plate Polycut
code_block_5 = CodeBlock { 500; 750; 10; }
byLengthAndWidth = AdvanceSteel.Nodes.Features.PlatePolycut.ByLengthAndWidth(element=byPolygon, length=code_block_5.out0, width=code_block_5.out0, xOffset=code_block_5.out1, yOffset=code_block_5.out1)

# group: SET PARAMETERS
# note: Set base parameters of Frame
code_block_6 = CodeBlock()
# ---------- code_block_6.designscript (5 lines) ----------
Point.ByCoordinates(0,0,0);
Point.ByCoordinates(1500,0,0);
Point.ByCoordinates(1500,3000,0);
Point.ByCoordinates(0,3000,0);
Vector.ZAxis();
# ----------------------------------------
beamReferenceAxis = BeamRefAxisType("Upper Middle")

# group: CREATE BEAMS
byStartPointEndPoint = AdvanceSteel.Nodes.Beams.StraightBeam.ByStartPointEndPoint(start=code_block_6.out2, end=code_block_6.out3, orientation=code_block_6.out4, refAxis=beamReferenceAxis)
# note: Create 4 Beam from a Frame
byStartPointEndPoint_2 = AdvanceSteel.Nodes.Beams.StraightBeam.ByStartPointEndPoint(start=code_block_6.out0, end=code_block_6.out1, orientation=code_block_6.out4, refAxis=beamReferenceAxis)

# group: SET PARAMETERS
# note: Set Rotated Normal for Plane cut
code_block_7 = CodeBlock { Vector.XAxis(); Vector.YAxis(); 35; }
rotate = Vector.Rotate(vector=code_block_7.out0, axis=code_block_7.out1, degrees=code_block_7.out2)

# group: CREATE SHORTENING
# note: Create Beam Shortening with rotated normal
byPointAndNormal = AdvanceSteel.Nodes.Features.BeamPlaneCut.ByPointAndNormal(element=byStartPointEndPoint, origin=code_block_6.out2, normal=rotate)

# group: CREATE BEAM SHORTENINGS
# note: Create Beam Shortening square to each
code_block_8 = CodeBlock { 150; 300; }
byStartValue = AdvanceSteel.Nodes.Features.BeamPlaneCut.ByStartValue(element=byStartPointEndPoint_2, shorteningLength=code_block_8.out0)
byEndValue = AdvanceSteel.Nodes.Features.BeamPlaneCut.ByEndValue(element=byStartPointEndPoint_2, shorteningLength=code_block_8.out1)

# group: CREATE COPE
# note: Create Beam Cope at End of Beam
code_block_9 = CodeBlock { End=2; Side=1; Len=100; Dep=70; Rad=11; cnr=1; }
byRectangularOrthoCope = AdvanceSteel.Nodes.Features.BeamCope.ByRectangularOrthoCope(element=byStartPointEndPoint, end=code_block_9.End, side=code_block_9.Side, length=code_block_9.Len, depth=code_block_9.Dep, cornerRadius=code_block_9.Rad, cornerType=code_block_9.cnr)

# group: SET
code_block_10 = CodeBlock { Point.ByCoordinates(1150,300,0); Point.ByCoordinates(1350,300,0); }
code_block_11 = CodeBlock { Point.ByCoordinates(1150,100,0); Point.ByCoordinates(1350,100,0); }
# note: Points for Curves
code_block_12 = CodeBlock { Point.ByCoordinates(1250,300,0); }

# group: CREATE
byStartPointEndPoint_3 = Line.ByStartPointEndPoint(startPoint=code_block_10.out1, endPoint=code_block_11.out1)
byStartPointEndPoint_4 = Line.ByStartPointEndPoint(startPoint=code_block_11.out1, endPoint=code_block_11.out0)
byStartPointEndPoint_5 = Line.ByStartPointEndPoint(startPoint=code_block_11.out0, endPoint=code_block_10.out0)
# note: Join Curves
byCenterPointStartPointEndPoint = Arc.ByCenterPointStartPointEndPoint(centerPoint=code_block_12, startPoint=code_block_10.out1, endPoint=code_block_10.out0)
reverse = Curve.Reverse(curve=byCenterPointStartPointEndPoint)
list_create_3 = List.Create(item0=byStartPointEndPoint_3, item1=byStartPointEndPoint_4, item2=byStartPointEndPoint_5, item3=reverse)
byJoinedCurves = PolyCurve.ByJoinedCurves(curves=list_create_3)

# group: CREATE POLYCUT
# note: Create Plate on bottom portioning & 25mm Thick
code_block_13 = CodeBlock { Vector.XAxis(); }
fromPolyCurve = AdvanceSteel.Nodes.Features.PlatePolycut.FromPolyCurve(element=byPolygon, polyCurve=byJoinedCurves, lengthVec=code_block_13)
