# Dynamo graph 009-Joints.dyn (Dynamo 2.13.1.3887)
# author: Autodesk

# group: SET
# note: Set or Override Selection Parameters
advanceSteelObjectTypes = ASObjecTypes("Joint")
list_create = List.Create(item0=advanceSteelObjectTypes)

# group: GET STRAIGHT BEAMS
# note: User Interaction Get Straight Beam objects from selection
selectAdvanceSteelObjects = ASObjectSelection()  # 13 picked in the model
filterSelectionByType = AdvanceSteel.Nodes.Selection.SelectionFilter.FilterSelectionByType(steelObjects=selectAdvanceSteelObjects, objectTypeFilters=list_create)
watch = Watch(filterSelectionByType)

# group: TEMP
# note: Temp Object properties for reference
getObjectProperties = AdvanceSteel.Nodes.Property.GetObjectProperties(steelObject=watch)
jointProperties = ASPropertiesJoint("Created Objects")
getObjectProperty = AdvanceSteel.Nodes.Property.GetObjectProperty(steelObject=watch, propertyName=jointProperties)
value = AdvanceSteel.Nodes.Property.Value(property=getObjectProperty)

# group: GET PROPERTIES
# note: Based on set parameters get Property Values
jointProperties_2 = ASPropertiesJoint("Handle")
getObjectProperty_2 = AdvanceSteel.Nodes.Property.GetObjectProperty(steelObject=watch, propertyName=jointProperties_2)
value_2 = AdvanceSteel.Nodes.Property.Value(property=getObjectProperty_2)
jointProperties_3 = ASPropertiesJoint("Approval Status")
getObjectProperty_3 = AdvanceSteel.Nodes.Property.GetObjectProperty(steelObject=watch, propertyName=jointProperties_3)
value_3 = AdvanceSteel.Nodes.Property.Value(property=getObjectProperty_3)
jointProperties_4 = ASPropertiesJoint("Presize Is Available")
getObjectProperty_4 = AdvanceSteel.Nodes.Property.GetObjectProperty(steelObject=watch, propertyName=jointProperties_4)
value_4 = AdvanceSteel.Nodes.Property.Value(property=getObjectProperty_4)
jointProperties_5 = ASPropertiesJoint("Layer")
getObjectProperty_5 = AdvanceSteel.Nodes.Property.GetObjectProperty(steelObject=watch, propertyName=jointProperties_5)
value_5 = AdvanceSteel.Nodes.Property.Value(property=getObjectProperty_5)
list_create_2 = List.Create(item0=value_2, item1=value_3, item2=value_4, item3=value_5)

# group: PROCESS
# note: Dynamo data manipulation
transpose = List.Transpose(lists=list_create_2)

# group: CREATE CSV File
# note: Use properties combined to be output to a CSV File
code_block = CodeBlock { "C://Temp//DataJoint.csv"; }
exportCSV = Data.ExportCSV(filePath=code_block, data=transpose)
