# Dynamo graph 009_HeadChuteSampleA.dyn (Dynamo 2.5.2.7915)

# group: GRAPH INFO
# note: ________________________________________________________
# Advance Steel Core Ver: 	2.4.1.6394
# Package Used: 		Advance Steel
# Custom Nodes Used: 	None
# Graph Function:
# 1. Create platework via many different function
# 2. Add corner modifcation
# 3. Create Contour Cuts
# 4. Demonstrate Plane Geometry functions
# Created By: 		Stephan Gumpert
# Date Created: 		December 2020
# Updated By:
# Date Modified:

# group: TEMP
# note: Work in progress / To delete

# group: SET
# note: Set or Override Parameter in Civil 3D

# group: DATA OUT
# note: Export information / data to others

# group: PROCESS
# note: Dynamo data manipulation

# group: DATA IN
# note: Import information / data from others

# group: GEOM
# note: Dynamo geometry creation

# group: GET
# note: Get information / data from Civil 3D

# group: CREATE
# note: Create object in Civil 3D

# group: NOTES - D4C3D
# note: DESIGN GRAPH STANDARDS
# Author:		Jowenn S. Lua
# Date Created:	10 August 2019
# Date Updated:	4 September 2020
# Version:		004
# DESIGN GRAPH GUIDELINES
# 1. Color code your blocks according to this guide.
# 2. Add grouping with name and description.
# 3. Add notes to explain each critical node process.
# 4. Rename Input / Output / Code Blocks nodes and add suffix to data they carry.
# 5. Align nodes to make it neat.
# 6. Save the graph as Manual instead of Automatic.

# group: Overall Chute Details
chut_height_split_to_i_s = CodeBlock { 585; }
# note: Chute Size Details
centre_line_pulley_origin = CodeBlock { Point.ByCoordinates(0,0,0); }
x_y_z_vectors = CodeBlock { Vector.ByCoordinates(1,0,0); Vector.ByCoordinates(0,1,0); Vector.ByCoordinates(0,0,1); }
byOriginVectors = CoordinateSystem.ByOriginVectors(origin=centre_line_pulley_origin, xAxis=x_y_z_vectors.out0, yAxis=x_y_z_vectors.out1, zAxis=x_y_z_vectors.out2)
plan_width_i_s = CodeBlock { 900; }
plan_internal_front_width_i_s = CodeBlock { 470; }
pulley_to_front_face_i_s = CodeBlock { 600; }
length_to_connecting_face = CodeBlock { 920; }
clp_top_i_s = CodeBlock { 525; }

# group: Chute Specification
# note: Import information / data from others
chute_wall_thickness = CodeBlock { 10.0; }
flange_thickness_at_split = CodeBlock { 12.0; }
flange_thickness_at_conveyor = CodeBlock { 12.0; }

# group: Chute Internal CS Details
# note: Dynamo geometry creation
origin = CoordinateSystem.Origin(coordinateSystem=byOriginVectors)
YAxis = CoordinateSystem.YAxis(coordinateSystem=byOriginVectors)
XAxis = CoordinateSystem.XAxis(coordinateSystem=byOriginVectors)
ZAxis = CoordinateSystem.ZAxis(coordinateSystem=byOriginVectors)

# group: PROCESS
# note: Dynamo data manipulation
code_block = CodeBlock { 2; }
div = plan_width_i_s / code_block
div_2 = plan_internal_front_width_i_s / code_block
code_block_2 = CodeBlock(x=div, y=div_2) { -x; -y; }
sub = pulley_to_front_face_i_s - length_to_connecting_face
sub_2 = plan_width_i_s - plan_internal_front_width_i_s

# group: GEOM
# note: Dynamo geometry creation
list_create = List.Create(item0=div, item1=div_2, item2=code_block_2.out1, item3=code_block_2.out0)
getPointInDirection = AdvanceSteel.Nodes.Util.Geometry.GetPointInDirection(point=origin, direction=YAxis, distance=list_create)

code_block_3 = CodeBlock { [0, 3]; }

# group: Chute Specification
# note: Import information / data from others
chute_wall_thickness_2 = CodeBlock { 10.0; }
flange_thickness_at_split_2 = CodeBlock { 12.0; }
flange_thickness_at_conveyor_2 = CodeBlock { 12.0; }

# group: Pulley Details
# note: X & Y relative to viewing the side wall
pulley_clearance_x = CodeBlock { 60; }
pulley_clearance_y = CodeBlock { -120; }
pulley_clearance_y_2 = CodeBlock { 120; }

# group: GEOM
# note: Dynamo geometry creation
side_length_plane_values = List.Create(item0=sub, item1=pulley_clearance_x, item2=sub_2, item3=pulley_to_front_face_i_s)
getPointInDirection_2 = AdvanceSteel.Nodes.Util.Geometry.GetPointInDirection(point=origin, direction=XAxis, distance=side_length_plane_values)

# group: GEOM
# note: Dynamo geometry creation
height_plane_levels = List.Create(item0=pulley_clearance_y, item1=pulley_clearance_y_2, item2=clp_top_i_s)
getPointInDirection_3 = AdvanceSteel.Nodes.Util.Geometry.GetPointInDirection(point=origin, direction=ZAxis, distance=height_plane_levels)

# group: Both X & Y Planes while looking at Chute Elevation
width_planes = Plane.ByOriginNormal(origin=getPointInDirection, normal=YAxis)
watch = Watch(width_planes)
planes_across = Plane.ByOriginNormal(origin=getPointInDirection_2, normal=XAxis)
watch_2 = Watch(planes_across)
# note: Dynamo geometry creation
planes_height = Plane.ByOriginNormal(origin=getPointInDirection_3, normal=ZAxis)
watch_3 = Watch(planes_height)

removeItemAtIndex = List.RemoveItemAtIndex(list=watch, indices=code_block_3)
origin_2 = Plane.Origin(plane=watch_2)
code_block_4 = CodeBlock { 2; 1; 0; }
getItemAtIndex = List.GetItemAtIndex(list=watch_3, index=code_block_4.out0)
orthoProjectPointToPlane = AdvanceSteel.Nodes.Util.Geometry.OrthoProjectPointToPlane(point=origin_2, projectionPlane=getItemAtIndex)
watch_4 = Watch(orthoProjectPointToPlane)
lastItem = List.LastItem(list=watch_4)
getItemAtIndex_2 = List.GetItemAtIndex(list=watch_3, index=code_block_4.out2)
reverse = Vector.Reverse(vector=ZAxis)
project = Point.Project(point=origin_2, baseGeometry=getItemAtIndex_2, projectionDirection=reverse)
flat_list_level_a = List.Flatten(list=project)
watch_5 = Watch(flat_list_level_a)
lastItem_2 = List.LastItem(list=watch_5)
list_create_2 = List.Create(item0=lastItem, item1=lastItem_2)
code_block_5 = CodeBlock { 2; }
div_3 = plan_internal_front_width_i_s / code_block_5
getPlaneOffsetByCentre = AdvanceSteel.Nodes.Util.Geometry.GetPlaneOffsetByCentre(centrePoint=origin, planeNormal=YAxis, distance=div_3)
project_2 = Point.Project(point=list_create_2, baseGeometry=getPlaneOffsetByCentre, projectionDirection=YAxis)
orthoProjectPointToPlane_2 = AdvanceSteel.Nodes.Util.Geometry.OrthoProjectPointToPlane(point=list_create_2, projectionPlane=getPlaneOffsetByCentre)
orthoProjectPointToPlane_3 = AdvanceSteel.Nodes.Util.Geometry.OrthoProjectPointToPlane(point=lastItem, projectionPlane=getPlaneOffsetByCentre)
orthoProjectPointToPlane_4 = AdvanceSteel.Nodes.Util.Geometry.OrthoProjectPointToPlane(point=lastItem_2, projectionPlane=getPlaneOffsetByCentre)
reverse_2 = List.Reverse(list=orthoProjectPointToPlane_4)
join = List.Join(list0=orthoProjectPointToPlane_3, list1=reverse_2)
watch_6 = Watch(join)
code_block_6 = CodeBlock { [1, 2]; [1, 2]; }
getItemAtIndex_3 = List.GetItemAtIndex(list=watch_6, index=code_block_6.out0)
code_block_7 = CodeBlock { 0; 1; 2; 3; }
points_3_4 = List.RemoveItemAtIndex(list=watch_4, indices=code_block_7.out3)
points_3_4_2 = List.RemoveItemAtIndex(list=points_3_4, indices=code_block_7.out1)
points_8_7 = List.RemoveItemAtIndex(list=watch_5, indices=code_block_7.out0)
removeItemAtIndex_2 = List.RemoveItemAtIndex(list=points_8_7, indices=code_block_7.out2)
reverse_3 = List.Reverse(list=removeItemAtIndex_2)
getItemAtIndex_4 = List.GetItemAtIndex(list=watch_3, index=code_block_4.out1)
orthoProjectPointToPlane_5 = AdvanceSteel.Nodes.Util.Geometry.OrthoProjectPointToPlane(point=origin_2, projectionPlane=getItemAtIndex_4)
watch_7 = Watch(orthoProjectPointToPlane_5)
points_2_1 = List.RemoveItemAtIndex(list=watch_7, indices=code_block_7.out3)
removeItemAtIndex_3 = List.RemoveItemAtIndex(list=points_2_1, indices=code_block_7.out2)
reverse_4 = List.Reverse(list=removeItemAtIndex_3)
join_2 = List.Join(list0=points_3_4_2, list1=reverse_3, list2=reverse_4)

# group: Create Planes on outside of Chute
code_block_8 = CodeBlock { 2; }
# note: Dynamo geometry creation
div_4 = plan_width_i_s / code_block_8
getPlaneOffsetByCentre_2 = AdvanceSteel.Nodes.Util.Geometry.GetPlaneOffsetByCentre(centrePoint=origin, planeNormal=YAxis, distance=div_4)
watch_8 = Watch(getPlaneOffsetByCentre_2)

code_block_9 = CodeBlock { 0; 1; }

# group: Left Wall Geometry Point on Plane (- Y Values)
# note: Take 1 Index of Created Planes to project points onto.
getItemAtIndex_5 = List.GetItemAtIndex(list=watch_8, index=code_block_9.out1)
orthoProjectPointToPlane_6 = AdvanceSteel.Nodes.Util.Geometry.OrthoProjectPointToPlane(point=join_2, projectionPlane=getItemAtIndex_5)
watch_9 = Watch(orthoProjectPointToPlane_6)

getItemAtIndex_6 = List.GetItemAtIndex(list=watch_9, index=code_block_6.out1)
reverse_5 = List.Reverse(list=getItemAtIndex_6)
join_3 = List.Join(list0=getItemAtIndex_3, list1=reverse_5)

# group: DATA IN
# note: Import information / data from others
writable_plate_properties = ASPropertiesPlate("Plate Face Alignment")
code_block_10 = CodeBlock { 0.0; 0.5; 1.0; }
writable_plate_properties_2 = ASPropertiesPlate("Plate Thickness")

# group: SET
# note: Set or Override Parameter in Civil 3D
byNameAndValue = AdvanceSteel.Nodes.Util.Property.ByNameAndValue(propertyType=writable_plate_properties, propertyValue=code_block_10.out0)
byNameAndValue_2 = AdvanceSteel.Nodes.Util.Property.ByNameAndValue(propertyType=writable_plate_properties_2, propertyValue=flange_thickness_at_conveyor)
list_create_3 = List.Create(item0=byNameAndValue, item1=byNameAndValue_2)

# group: CREATE Diagonal Left Plate
# note: Create object in Civil 3D
byPoints = Polygon.ByPoints(points=join_3)
byPolygon = AdvanceSteel.Nodes.Plates.Plate.ByPolygon(poly=byPoints, additionalPlateParameters=list_create_3)

code_block_11 = CodeBlock { [0, 3]; }
getItemAtIndex_7 = List.GetItemAtIndex(list=watch_6, index=code_block_11)

# group: Right Wall Geometry Point on Plane (+ Y Values)
# note: Take 0 Index of Created Planes to project points onto.
getItemAtIndex_8 = List.GetItemAtIndex(list=watch_8, index=code_block_9.out0)
orthoProjectPointToPlane_7 = AdvanceSteel.Nodes.Util.Geometry.OrthoProjectPointToPlane(point=join_2, projectionPlane=getItemAtIndex_8)
watch_10 = Watch(orthoProjectPointToPlane_7)

code_block_12 = CodeBlock { [1, 2]; }
getItemAtIndex_9 = List.GetItemAtIndex(list=watch_10, index=code_block_12)
reverse_6 = List.Reverse(list=getItemAtIndex_9)
join_4 = List.Join(list0=getItemAtIndex_7, list1=reverse_6)

# group: DATA IN
# note: Import information / data from others
writable_plate_properties_3 = ASPropertiesPlate("Plate Face Alignment")
code_block_13 = CodeBlock { 0.0; 0.5; 1.0; }
writable_plate_properties_4 = ASPropertiesPlate("Plate Thickness")

# group: SET
# note: Set or Override Parameter in Civil 3D
byNameAndValue_3 = AdvanceSteel.Nodes.Util.Property.ByNameAndValue(propertyType=writable_plate_properties_3, propertyValue=code_block_13.out2)
byNameAndValue_4 = AdvanceSteel.Nodes.Util.Property.ByNameAndValue(propertyType=writable_plate_properties_4, propertyValue=flange_thickness_at_conveyor_2)
list_create_4 = List.Create(item0=byNameAndValue_3, item1=byNameAndValue_4)

# group: CREATE Diagonal Right Plate
# note: Create object in Civil 3D
byPoints_2 = Polygon.ByPoints(points=join_4)
byPolygon_2 = AdvanceSteel.Nodes.Plates.Plate.ByPolygon(poly=byPoints_2, additionalPlateParameters=list_create_4)

watch_11 = Watch(join)

# group: Top Plate Geometry
code_block_14 = CodeBlock { [0, 1]; }
getItemAtIndex_10 = List.GetItemAtIndex(list=watch_9, index=code_block_14)
code_block_15 = CodeBlock { [1, 0]; }
getItemAtIndex_11 = List.GetItemAtIndex(list=watch_11, index=code_block_15)
code_block_16 = CodeBlock { [1, 0]; }
getItemAtIndex_12 = List.GetItemAtIndex(list=watch_10, index=code_block_16)
list_create_5 = List.Create(item0=getItemAtIndex_10, item1=getItemAtIndex_11, item2=getItemAtIndex_12)
flatten = List.Flatten(list=list_create_5)

# group: CREATE TopPlate
# note: Create object in Civil 3D
byPoints_3 = Polygon.ByPoints(points=flatten)
byPolygon_3 = AdvanceSteel.Nodes.Plates.Plate.ByPolygon(poly=byPoints_3, additionalPlateParameters=list_create_4)

# group: CREATE Right Plate
# note: Create object in Civil 3D
byPoints_4 = Polygon.ByPoints(points=watch_10)
byPolygon_4 = AdvanceSteel.Nodes.Plates.Plate.ByPolygon(poly=byPoints_4, additionalPlateParameters=list_create_4)

# group: CREATE Left Plate
# note: Create object in Civil 3D
byPoints_5 = Polygon.ByPoints(points=watch_9)
byPolygon_5 = AdvanceSteel.Nodes.Plates.Plate.ByPolygon(poly=byPoints_5, additionalPlateParameters=list_create_3)

# group: Fillet internal corner of plate
plate_fillet_vertex_type = PlateFilletVertexType("Convex")
code_block_17 = CodeBlock { 4; }
byRadius = AdvanceSteel.Nodes.Modifications.PlateVertexCut.ByRadius(element=byPolygon_4, radius=pulley_clearance_y_2, filletType=plate_fillet_vertex_type, cornerIndex=code_block_17)
byRadius_2 = AdvanceSteel.Nodes.Modifications.PlateVertexCut.ByRadius(element=byPolygon_5, radius=pulley_clearance_y_2, filletType=plate_fillet_vertex_type, cornerIndex=code_block_17)

sub_3 = pulley_to_front_face_i_s - sub_2
sub_4 = _ - _  # unwired: x, y
watch_12 = Watch(join_2)

# group: DATA IN
# note: Import information / data from others
writable_plate_properties_5 = ASPropertiesPlate("Plate Face Alignment")
code_block_18 = CodeBlock { 0.0; 0.5; 1.0; }
writable_plate_properties_6 = ASPropertiesPlate("Plate Thickness")

# group: SET
# note: Set or Override Parameter in Civil 3D
byNameAndValue_5 = AdvanceSteel.Nodes.Util.Property.ByNameAndValue(propertyType=writable_plate_properties_5, propertyValue=code_block_18.out1)
byNameAndValue_6 = AdvanceSteel.Nodes.Util.Property.ByNameAndValue(propertyType=writable_plate_properties_6, propertyValue=flange_thickness_at_conveyor_2)
list_create_6 = List.Create(item0=byNameAndValue_5, item1=byNameAndValue_6)

# group: CREATE Top Stiffener - Via ByLengthEndge
code_block_19 = CodeBlock { 0; 1; 75; }
getItemAtIndex_13 = List.GetItemAtIndex(list=watch_12, index=code_block_19.out0)
getPointInDirection_4 = AdvanceSteel.Nodes.Util.Geometry.GetPointInDirection(point=getItemAtIndex_13, direction=ZAxis, distance=flange_thickness_at_conveyor_2)
add = length_to_connecting_face + flange_thickness_at_conveyor_2
getPointInDirection_5 = AdvanceSteel.Nodes.Util.Geometry.GetPointInDirection(point=getPointInDirection_4, direction=XAxis, distance=add)
getPointInDirection_6 = AdvanceSteel.Nodes.Util.Geometry.GetPointInDirection(point=getPointInDirection_5, direction=XAxis, distance=code_block_19.out2)
byStartPointEndPoint = Line.ByStartPointEndPoint(startPoint=getPointInDirection_4, endPoint=getPointInDirection_6)
byLengthEdge = AdvanceSteel.Nodes.Plates.Plate.ByLengthEdge(line=byStartPointEndPoint, normal=YAxis, width=code_block_19.out2, additionalPlateParameters=list_create_6)

# group: Add Chamfer to Stiffener
code_block_20 = CodeBlock { 50; 1; }
byChamfer = AdvanceSteel.Nodes.Modifications.PlateVertexCut.ByChamfer(element=byLengthEdge, length1=code_block_20.out0, length2=code_block_20.out0, cornerIndex=code_block_20.out1)

# group: CREATE Front Plate
# note: Create object in Civil 3D
byPoints_6 = Polygon.ByPoints(points=watch_11)
byPolygon_6 = AdvanceSteel.Nodes.Plates.Plate.ByPolygon(poly=byPoints_6, additionalPlateParameters=list_create_4)

# group: CREATE Front Stiffener Top - Via Three Point
reverse_7 = Vector.Reverse(vector=ZAxis)
code_block_21 = CodeBlock { 150; 150; 150; }
add_2 = code_block_21.out0 + flange_thickness_at_conveyor_2
getPointInDirection_7 = AdvanceSteel.Nodes.Util.Geometry.GetPointInDirection(point=getPointInDirection_5, direction=reverse_7, distance=add_2)
byThreePoints = AdvanceSteel.Nodes.Plates.Plate.ByThreePoints(orginPoint=getPointInDirection_5, xDirectionPoint=getPointInDirection_7, yDirectionPoint=getPointInDirection_6, additionalPlateParameters=list_create_6)

getPointInDirection_8 = AdvanceSteel.Nodes.Util.Geometry.GetPointInDirection(point=getPointInDirection_7, direction=reverse_7, distance=code_block_21.out1)

# group: Create Rectangular Opening in Front Plate
getPlane = AdvanceSteel.Nodes.Util.Geometry.GetPlane(steelObject=byPolygon_6)
setPlaneOrigin = AdvanceSteel.Nodes.Util.Geometry.SetPlaneOrigin(plane=getPlane, point=getPointInDirection_8)
code_block_22 = CodeBlock { 300; 300; }
byWidthLength = Rectangle.ByWidthLength(plane=setPlaneOrigin, width=code_block_22.out0, length=code_block_22.out1)
fromPolyCurve = AdvanceSteel.Nodes.Modifications.PlatePolycut.FromPolyCurve(element=byPolygon_6, polyCurve=byWidthLength, lengthVec=YAxis)

code_block_23 = CodeBlock {  }
