# Dynamo graph 009_StairTower.dyn (Dynamo 2.5.2.7915)

# group: SET
# note: Set or Override Parameter in Civil 3D

# group: DATA OUT
# note: Export information / data to others

# group: PROCESS
# note: Dynamo data manipulation

# group: DATA IN
# note: Import information / data from others

# group: GET
# note: Get information / data from Civil 3D

# group: CREATE
# note: Create object in Civil 3D

# group: TEMP
# note: Work in progress / To delete

# group: GEOM
# note: Dynamo geometry creation

# group: NOTES - D4C3D
# note: DESIGN GRAPH STANDARDS
# Author:		Jowenn S. Lua
# Date Created:	10 August 2019
# Date Updated:	4 September 2020
# Version:		004
# DESIGN GRAPH GUIDELINES
# 1. Color code your blocks according to this guide.
# 2. Add grouping with name and description.
# 3. Add notes to explain each critical node process.
# 4. Rename Input / Output / Code Blocks nodes and add suffix to data they carry.
# 5. Align nodes to make it neat.
# 6. Save the graph as Manual instead of Automatic.

# group: GRAPH INFO
# note: ________________________________________________________
# Advance Steel Core Ver: 	2.4.1.6394
# Package Used: 		Advance Steel
# Custom Nodes Used: 	None
# Graph Function:
# 1. Create platework via many different function
# 2. Add corner modifcation
# 3. Create Contour Cuts
# 4. Demonstrate Plane Geometry functions
# Created By: 		Stephan Gumpert
# Date Created: 		December 2020
# Updated By:
# Date Modified:

# group: Stair Details
code_block = CodeBlock { TowerLength=6000; TowerWidth=3000; Stair1Centres=900; StairWidth=750; TreadName="6_f325mpg 245x750"; }
code_block_2 = CodeBlock { Vector.XAxis(); Vector.YAxis(); Vector.ZAxis(); }
code_block_3 = CodeBlock { LowerLanding=1100; Rise=180; Run=240; TreadCount=10; }
list_create = List.Create(item0=code_block_3.LowerLanding, item1=code_block_3.Rise, item2=code_block_3.Run, item3=code_block_3.TreadCount)
code_block_4 = CodeBlock { LowerLanding=1300; Rise=180; Run=240; TreadCount=12; }
list_create_2 = List.Create(item0=code_block_4.LowerLanding, item1=code_block_4.Rise, item2=code_block_4.Run, item3=code_block_4.TreadCount)
code_block_5 = CodeBlock { LowerLanding=1500; Rise=180; Run=240; TreadCount=18; }
list_create_3 = List.Create(item0=code_block_5.LowerLanding, item1=code_block_5.Rise, item2=code_block_5.Run, item3=code_block_5.TreadCount)
list_create_4 = List.Create(item0=list_create, item1=list_create_2, item2=list_create_3)
watch = Watch(list_create_4)

# group: Bottom Building Base Geometry
XY = Plane.XY()
byWidthLength = Rectangle.ByWidthLength(plane=XY, width=code_block.TowerLength, length=code_block.TowerWidth)
points = Polygon.Points(polygon=byWidthLength)
watch_2 = Watch(points)

code_block_6 = CodeBlock { 2; 3; }
getItemAtIndex = List.GetItemAtIndex(list=watch, index=code_block_6.out0, lacing=Longest)
getItemAtIndex_2 = List.GetItemAtIndex(list=watch, index=code_block_6.out1, lacing=Longest)
code_block_7 = CodeBlock { 1; 2; }
code_block_8 = CodeBlock { 2; }
div = code_block.StairWidth / code_block_8
code_block_9 = CodeBlock { 0; 1; }
reverse = Vector.Reverse(vector=code_block_2.out0)
code_block_10 = CodeBlock { 0; 1; 2; }
takeEveryNthItem = List.TakeEveryNthItem(list=watch, n=code_block_10.out2, offset=code_block_10.out0)
watch_3 = Watch(takeEveryNthItem)
code_block_11 = CodeBlock { 0; }
getItemAtIndex_3 = List.GetItemAtIndex(list=watch_3, index=code_block_11, lacing=Longest)

# group: SET - Additional Beam Properties
# note: Set or Override Parameter in Civil 3D
code_block_12 = CodeBlock { "AS-NZS Parallel Flange Channel"; "PFC 200"; }
createSectionString = AdvanceSteel.Nodes.Util.BeamSection.CreateSectionString(sectionType=code_block_12.out0, sectionSize=code_block_12.out1)
byNameAndValue = AdvanceSteel.Nodes.Property.ByNameAndValue(value=createSectionString)  # unwired: propertyName
list_create_5 = List.Create(item0=byNameAndValue)
code_block_13 = CodeBlock { "Horizontal_Beam"; "Steel"; }
byNameAndValue_2 = AdvanceSteel.Nodes.Property.ByNameAndValue(value=code_block_13.out0)  # unwired: propertyName
byNameAndValue_3 = AdvanceSteel.Nodes.Property.ByNameAndValue(value=code_block_13.out1)  # unwired: propertyName

code_block_14 = CodeBlock { 0; }
code_block_15 = CodeBlock { 1; 2; true; 3; }
getrise_list_getitematindex = List.GetItemAtIndex(list=watch_3, index=code_block_15.out0, lacing=Longest)
sub = code_block_14 - getrise_list_getitematindex
getrun_list_getitematindex = List.GetItemAtIndex(list=watch_3, index=code_block_15.out1, lacing=Longest)
stairvector_vector_bycoordinates = Vector.ByCoordinates(x=sub, y=code_block_11, z=getrun_list_getitematindex, normalized=code_block_15.out2)
code_block_16 = CodeBlock { 2; }
pow = Math.Pow(number=getrun_list_getitematindex, power=code_block_16)
pow_2 = Math.Pow(number=getrise_list_getitematindex, power=code_block_16)
add = pow + pow_2
distalongslopepertread_math_sqrt = Math.Sqrt(number=add)
nooftreads_list_getitematindex = List.GetItemAtIndex(list=watch_3, index=code_block_15.out3, lacing=Longest)
disttolanding = distalongslopepertread_math_sqrt * nooftreads_list_getitematindex
code_block_17 = CodeBlock { Point.Origin(); }
code_block_18 = CodeBlock { 2; }
div_2 = code_block.TowerLength / code_block_18
getPlaneOffsetByCentre = AdvanceSteel.Nodes.Util.Geometry.GetPlaneOffsetByCentre(centrePoint=code_block_17, planeNormal=code_block_2.out0, distance=div_2)
lastItem = List.LastItem(list=getPlaneOffsetByCentre.PlaneNegative)
code_block_19 = CodeBlock { 1; }
code_block_20 = CodeBlock { 1; }
code_block_21 = CodeBlock { 1; }
code_block_22 = CodeBlock { 0; }
takeEveryNthItem_2 = List.TakeEveryNthItem(list=watch, n=code_block_10.out2, offset=code_block_10.out1)
watch_4 = Watch(takeEveryNthItem_2)
getItemAtIndex_4 = List.GetItemAtIndex(list=watch_4, index=code_block_11, lacing=Longest)
code_block_23 = CodeBlock { 1; 2; true; 3; }
getrise_list_getitematindex_2 = List.GetItemAtIndex(list=watch_4, index=code_block_23.out0, lacing=Longest)
getrun_list_getitematindex_2 = List.GetItemAtIndex(list=watch_4, index=code_block_23.out1, lacing=Longest)
stairvector_vector_bycoordinates_2 = Vector.ByCoordinates(x=getrise_list_getitematindex_2, y=code_block_11, z=getrun_list_getitematindex_2, normalized=code_block_23.out2)
code_block_24 = CodeBlock { 2; }
pow_3 = Math.Pow(number=getrun_list_getitematindex_2, power=code_block_24)
pow_4 = Math.Pow(number=getrise_list_getitematindex_2, power=code_block_24)
add_2 = pow_3 + pow_4
distalongslopepertread_math_sqrt_2 = Math.Sqrt(number=add_2)
nooftreads_list_getitematindex_2 = List.GetItemAtIndex(list=watch_4, index=code_block_23.out3, lacing=Longest)
disttolanding_2 = distalongslopepertread_math_sqrt_2 * nooftreads_list_getitematindex_2
firstItem = List.FirstItem(list=getPlaneOffsetByCentre.PlaneNegative)
beam_reference_axis = BeamRefAxisType("Upper Left")
code_block_25 = CodeBlock { 0; }
code_block_26 = CodeBlock { 0; }
code_block_27 = CodeBlock { 0; }

# group: Create Columns
beam_reference_axis_2 = BeamRefAxisType("Middle Middle")

# group: Geometry for the Floor Steel
code_block_28 = CodeBlock { 2; 3; }
getItemAtIndex_5 = List.GetItemAtIndex(list=watch_2, index=code_block_28.out0)
getItemAtIndex_6 = List.GetItemAtIndex(list=watch_2, index=code_block_28.out1)
getMidBetweenPoints = AdvanceSteel.Nodes.Util.Geometry.GetMidBetweenPoints(firstPoint=getItemAtIndex_5, secondPoint=getItemAtIndex_6)

# group: Determine Levels of Stair Tower
mul = getItemAtIndex * getItemAtIndex_2
code_block_29 = CodeBlock { 1; }
count = List.Count(list=mul)
sequence = Sequence(start=code_block_29, amount=count, step=code_block_29)
takeItems = List.TakeItems(list=mul, amount=sequence)
sum = Math.Sum(values=takeItems)
getPointInDirection = AdvanceSteel.Nodes.Util.Geometry.GetPointInDirection(point=getMidBetweenPoints, direction=code_block_2.out2, distance=sum)
watch_5 = Watch(sum)

addItemToFront = List.AddItemToFront(item=getMidBetweenPoints, list=getPointInDirection)
watch_6 = Watch(addItemToFront)
count_2 = List.Count(list=watch_6)
slice = List.Slice(list=watch_6, start=code_block_7.out0, end=count_2, step=code_block_7.out1)
getPointInDirection_2 = AdvanceSteel.Nodes.Util.Geometry.GetPointInDirection(point=slice, direction=code_block_2.out0, distance=code_block.TowerLength)
lastItem_2 = List.LastItem(list=getPointInDirection_2)

# group (continued): Create Columns
Z = Point.Z(point=lastItem_2)
byStartPointDirectionLength = AdvanceSteel.Nodes.Beams.StraightBeam.ByStartPointDirectionLength(start=watch_2, direction=code_block_2.out2, orientation=code_block_2.out0, refAxis=beam_reference_axis_2, length=Z)

# group (continued): Geometry for the Floor Steel
getPointInDirection_3 = AdvanceSteel.Nodes.Util.Geometry.GetPointInDirection(point=watch_2, direction=code_block_2.out2, distance=watch_5, lacing=CrossProduct)
watch_7 = Watch(getPointInDirection_3)
flatten = List.Flatten(list=watch_7)

# group: Create Floor Edge Beams
Z_2 = Point.Z(point=flatten)
sortByKey = List.SortByKey(list=flatten, keys=Z_2)
watch_8 = Watch(sortByKey.sorted_list)
code_block_30 = CodeBlock { 4; }
chop = List.Chop(list=watch_8, lengths=code_block_30)
firstItem_2 = List.FirstItem(list=chop, lacing=Longest)
addItemToEnd = List.AddItemToEnd(item=firstItem_2, list=chop, lacing=Longest)
code_block_31 = CodeBlock { 0; }
removeItemAtIndex = List.RemoveItemAtIndex(list=addItemToEnd, indices=code_block_31, lacing=Longest)
watch_9 = Watch(removeItemAtIndex)
beam_reference_axis_3 = BeamRefAxisType("Upper Middle")
byStartPointEndPoint = AdvanceSteel.Nodes.Beams.StraightBeam.ByStartPointEndPoint(start=chop, end=watch_9, orientation=code_block_2.out2, refAxis=beam_reference_axis_3)

watch_points_on_right_side = Watch(getPointInDirection_2)
getPlaneOffsetByCentre_2 = AdvanceSteel.Nodes.Util.Geometry.GetPlaneOffsetByCentre(centrePoint=getMidBetweenPoints, planeNormal=code_block_2.out1, distance=code_block.Stair1Centres)
origin = Plane.Origin(plane=getPlaneOffsetByCentre_2.PlaneNegative)
getPlaneOffsetByCentre_3 = AdvanceSteel.Nodes.Util.Geometry.GetPlaneOffsetByCentre(centrePoint=origin, planeNormal=code_block_2.out1, distance=div)
getItemAtIndex_7 = List.GetItemAtIndex(list=getPlaneOffsetByCentre_3.PlaneNegative, index=code_block_9.out1)
orthoProjectPointToPlane = AdvanceSteel.Nodes.Util.Geometry.OrthoProjectPointToPlane(point=watch_points_on_right_side, projectionPlane=getItemAtIndex_7, lacing=CrossProduct)
firstItem_3 = List.FirstItem(list=orthoProjectPointToPlane)
watch_10 = Watch(firstItem_3)

# group: Lower Stringer Far Side of X
getPointInDirection_4 = AdvanceSteel.Nodes.Util.Geometry.GetPointInDirection(point=watch_10, direction=reverse, distance=getItemAtIndex_3, lacing=Longest)
beam_reference_axis_4 = BeamRefAxisType("Upper Left")
byStartPointEndPoint_2 = AdvanceSteel.Nodes.Beams.StraightBeam.ByStartPointEndPoint(start=watch_10, end=getPointInDirection_4, orientation=code_block_2.out2, refAxis=beam_reference_axis_4, additionalBeamParameters=list_create_5)

# group: Stringer Creation
getPointFromEnd = AdvanceSteel.Nodes.Util.Beams.GetPointFromEnd(steelObject=byStartPointEndPoint_2)
getPointInDirection_5 = AdvanceSteel.Nodes.Util.Geometry.GetPointInDirection(point=getPointFromEnd, direction=stairvector_vector_bycoordinates, distance=disttolanding, lacing=Longest)
beam_reference_axis_5 = BeamRefAxisType("Upper Left")
byStartPointEndPoint_3 = AdvanceSteel.Nodes.Beams.StraightBeam.ByStartPointEndPoint(start=getPointFromEnd, end=getPointInDirection_5, orientation=code_block_2.out2, refAxis=beam_reference_axis_5, additionalBeamParameters=list_create_5)

# group: Top Landing Left Side
getPointFromEnd_2 = AdvanceSteel.Nodes.Util.Beams.GetPointFromEnd(steelObject=byStartPointEndPoint_3)
orthoProjectPointToPlane_2 = AdvanceSteel.Nodes.Util.Geometry.OrthoProjectPointToPlane(point=getPointFromEnd_2, projectionPlane=lastItem)
beam_reference_axis_6 = BeamRefAxisType("Upper Left")
byStartPointEndPoint_4 = AdvanceSteel.Nodes.Beams.StraightBeam.ByStartPointEndPoint(start=getPointFromEnd_2, end=orthoProjectPointToPlane_2, orientation=code_block_2.out2, refAxis=beam_reference_axis_6, additionalBeamParameters=list_create_5)

getItemAtIndex_8 = List.GetItemAtIndex(list=byStartPointEndPoint_4, index=code_block_19)
setBeamCrossSectionMirrored = AdvanceSteel.Nodes.Util.Beams.SetBeamCrossSectionMirrored(steelObject=getItemAtIndex_8)
getItemAtIndex_9 = List.GetItemAtIndex(list=byStartPointEndPoint_3, index=code_block_20)
setBeamCrossSectionMirrored_2 = AdvanceSteel.Nodes.Util.Beams.SetBeamCrossSectionMirrored(steelObject=getItemAtIndex_9)
getItemAtIndex_10 = List.GetItemAtIndex(list=byStartPointEndPoint_2, index=code_block_21)
setBeamCrossSectionMirrored_3 = AdvanceSteel.Nodes.Util.Beams.SetBeamCrossSectionMirrored(steelObject=getItemAtIndex_10)
slice_2 = List.Slice(list=watch_6, start=code_block_22, end=count_2, step=code_block_7.out1)
watch_points_on_left_side = Watch(slice_2)
getItemAtIndex_11 = List.GetItemAtIndex(list=getPlaneOffsetByCentre_3.PlaneNegative, index=code_block_9.out0)
orthoProjectPointToPlane_3 = AdvanceSteel.Nodes.Util.Geometry.OrthoProjectPointToPlane(point=watch_points_on_left_side, projectionPlane=getItemAtIndex_11, lacing=CrossProduct)
watch_11 = Watch(orthoProjectPointToPlane_3)

# group: Lower Stringers Near Side of X
getPointInDirection_6 = AdvanceSteel.Nodes.Util.Geometry.GetPointInDirection(point=watch_11, direction=code_block_2.out0, distance=getItemAtIndex_4)
beam_reference_axis_7 = BeamRefAxisType("Upper Left")
byStartPointEndPoint_5 = AdvanceSteel.Nodes.Beams.StraightBeam.ByStartPointEndPoint(start=watch_11, end=getPointInDirection_6, orientation=code_block_2.out2, refAxis=beam_reference_axis_7, additionalBeamParameters=list_create_5)

# group: Stringer Creation
getPointFromEnd_3 = AdvanceSteel.Nodes.Util.Beams.GetPointFromEnd(steelObject=byStartPointEndPoint_5)
getPointInDirection_7 = AdvanceSteel.Nodes.Util.Geometry.GetPointInDirection(point=getPointFromEnd_3, direction=stairvector_vector_bycoordinates_2, distance=disttolanding_2)
beam_reference_axis_8 = BeamRefAxisType("Upper Left")
byStartPointEndPoint_6 = AdvanceSteel.Nodes.Beams.StraightBeam.ByStartPointEndPoint(start=getPointFromEnd_3, end=getPointInDirection_7, orientation=code_block_2.out2, refAxis=beam_reference_axis_8, additionalBeamParameters=list_create_5)

getPointFromEnd_4 = AdvanceSteel.Nodes.Util.Beams.GetPointFromEnd(steelObject=byStartPointEndPoint_6)
orthoProjectPointToPlane_4 = AdvanceSteel.Nodes.Util.Geometry.OrthoProjectPointToPlane(point=getPointFromEnd_4, projectionPlane=firstItem)
byStartPointEndPoint_7 = AdvanceSteel.Nodes.Beams.StraightBeam.ByStartPointEndPoint(start=getPointFromEnd_4, end=orthoProjectPointToPlane_4, orientation=code_block_2.out2, refAxis=beam_reference_axis, additionalBeamParameters=list_create_5)
getItemAtIndex_12 = List.GetItemAtIndex(list=byStartPointEndPoint_7, index=code_block_25, lacing=Longest)
setBeamCrossSectionMirrored_4 = AdvanceSteel.Nodes.Util.Beams.SetBeamCrossSectionMirrored(steelObject=getItemAtIndex_12)
getItemAtIndex_13 = List.GetItemAtIndex(list=byStartPointEndPoint_6, index=code_block_26, lacing=Longest)
setBeamCrossSectionMirrored_5 = AdvanceSteel.Nodes.Util.Beams.SetBeamCrossSectionMirrored(steelObject=getItemAtIndex_13)
getItemAtIndex_14 = List.GetItemAtIndex(list=byStartPointEndPoint_5, index=code_block_27, lacing=Longest)
setBeamCrossSectionMirrored_6 = AdvanceSteel.Nodes.Util.Beams.SetBeamCrossSectionMirrored(steelObject=getItemAtIndex_14)
