# Dynamo graph 009_SunShade.dyn (Dynamo 2.5.2.7915)

# group: GET
# note: Get information / data
code_block = CodeBlock { BaseLengthWidth=6000; CornerHeight=3000; MidSupportHeight=1500; ApexHeight=4500; RafterLength=5000; }

byWidthLength = Rectangle.ByWidthLength(width=code_block.BaseLengthWidth, length=code_block.BaseLengthWidth)
corners = Polygon.Corners(polygon=byWidthLength)
code_block_2 = CodeBlock { Vector.ZAxis(); Vector.XAxis(); 0; 2; }

# group: GEOM
# note: Dynamo geometry creation
getItemAtIndex = List.GetItemAtIndex(list=corners, index=code_block_2.out2)
getItemAtIndex_2 = List.GetItemAtIndex(list=corners, index=code_block_2.out3)
getMidBetweenPoints = AdvanceSteel.Nodes.Util.Geometry.GetMidBetweenPoints(firstPoint=getItemAtIndex, secondPoint=getItemAtIndex_2)
translate = Geometry.Translate(geometry=getMidBetweenPoints, direction=code_block_2.out0, distance=code_block.ApexHeight)

beamReferenceAxis = BeamRefAxisType("Middle Middle")

# group: ADDITIONAL PARAMETERS
bent_beam_properties = ASPropertiesBentBeam("Profile Name")
# note: Additional Beam Properties for Creation - Section SIze
code_block_3 = CodeBlock { "AS-NZS CHS - CF C250_L0"; "CHS 139.7x5.0 "; }
createSectionString = AdvanceSteel.Nodes.Util.Beam.CreateSectionString(sectionType=code_block_3.out0, sectionSize=code_block_3.out1)
byNameAndValue = AdvanceSteel.Nodes.Property.ByNameAndValue(propertyName=bent_beam_properties, value=createSectionString)

list_create = List.Create(item0=byNameAndValue)

# group: CREATE
# note: Create Advance Steel Object
byStartPointDirectionLength = AdvanceSteel.Nodes.Beams.StraightBeam.ByStartPointDirectionLength(start=corners, direction=code_block_2.out0, orientation=code_block_2.out1, length=code_block.CornerHeight, refAxis=beamReferenceAxis, additionalBeamParameters=list_create)

# group: GET
getPointFromEnd = AdvanceSteel.Nodes.Util.Beam.GetPointFromEnd(steelObject=byStartPointDirectionLength)
# note: Get information / data
code_block_4 = CodeBlock { Vector.ZAxis(); }

# group: GEOM
# note: Dynamo geometry creation
byTwoPoints = Vector.ByTwoPoints(start=translate, end=getPointFromEnd)
translate_2 = Geometry.Translate(geometry=translate, direction=byTwoPoints, distance=code_block.RafterLength)

beamReferenceAxis_2 = BeamRefAxisType("Middle Middle")
reverse = Vector.Reverse(vector=code_block_4)
translate_3 = Geometry.Translate(geometry=translate, direction=reverse, distance=code_block.MidSupportHeight)
code_block_5 = CodeBlock { Vector.XAxis(); }

# group: CREATE
byStartPointEndPoint = AdvanceSteel.Nodes.Beams.StraightBeam.ByStartPointEndPoint(start=translate, end=translate_2, orientation=code_block_4, refAxis=beamReferenceAxis_2, additionalBeamParameters=list_create)
# note: Create Advance Steel Object
byStartPointEndPoint_2 = AdvanceSteel.Nodes.Beams.StraightBeam.ByStartPointEndPoint(start=translate, end=translate_3, orientation=code_block_5, refAxis=beamReferenceAxis_2, additionalBeamParameters=list_create)

# group: GET
# note: Get information / data
code_block_6 = CodeBlock { Vector.ZAxis(); BasePlateSize=300; BasePlateThickness=20; 1; }

# group: CREATE
# note: Create Advance Steel Object
byStartValue = AdvanceSteel.Nodes.Features.BeamPlaneCut.ByStartValue(element=byStartPointDirectionLength, shorteningLength=code_block_6.BasePlateThickness)

# group: ADDITIONAL PARAMETERS
# note: Additional Plate Properties for Creation - Plate Thickness
plateProperties = ASPropertiesPlate("Thickness")
byNameAndValue_2 = AdvanceSteel.Nodes.Property.ByNameAndValue(propertyName=plateProperties, value=code_block_6.BasePlateThickness)
plateProperties_2 = ASPropertiesPlate("Plate Portioning")
byNameAndValue_3 = AdvanceSteel.Nodes.Property.ByNameAndValue(propertyName=plateProperties_2, value=code_block_6.out3)

list_create_2 = List.Create(item0=byNameAndValue_2, item1=byNameAndValue_3)
byRectanglarByPointandNormal = AdvanceSteel.Nodes.Plates.Plate.ByRectanglarByPointandNormal(origin=corners, normal=code_block_6.out0, length=code_block_6.BasePlateSize, width=code_block_6.BasePlateSize, additionalPlateParameters=list_create_2)
plateProperties_3 = ASPropertiesPlate("CenterPoint")

# group: GET
# note: Get information / data
getObjectProperty = AdvanceSteel.Nodes.Property.GetObjectProperty(steelObject=byRectanglarByPointandNormal, propertyName=plateProperties_3)
value = AdvanceSteel.Nodes.Property.Value(property=getObjectProperty)
code_block_7 = CodeBlock { CoordinateSystem.Identity(); }

# group: GEOM
# note: Dynamo geometry creation
list_create_3 = List.Create(item0=byRectanglarByPointandNormal)
transpose = List.Transpose(lists=list_create_3)

# group: ADDITIONAL PARAMETERS
# note: Additional Anchor Bolt Properties for Creation - X & Y Spacing
anchorBoltProperties = ASPropertiesAnchorBolt("Anchor Spacing X Direction")
code_block_8 = CodeBlock { 210; }
byNameAndValue_4 = AdvanceSteel.Nodes.Property.ByNameAndValue(propertyName=anchorBoltProperties, value=code_block_8)
anchorBoltProperties_2 = ASPropertiesAnchorBolt("Anchor Spacing Y Direction")
byNameAndValue_5 = AdvanceSteel.Nodes.Property.ByNameAndValue(propertyName=anchorBoltProperties_2, value=code_block_8)

list_create_4 = List.Create(item0=byNameAndValue_4, item1=byNameAndValue_5)

# group: CREATE
# note: Create Advance Steel Object
atCentrePoint = AdvanceSteel.Nodes.ConnectionObjects.Anchors.RectangularAnchorPattern.AtCentrePoint(connectionPoint=value, boltCS=code_block_7, objectsToConnect=transpose, additionalAnchorBoltParameters=list_create_4)

list_create_5 = List.Create(item0=byRectanglarByPointandNormal, item1=byStartPointDirectionLength)
transpose_2 = List.Transpose(lists=list_create_5)

# group: CREATE
# note: Create Advance Steel Object
byPoint = AdvanceSteel.Nodes.ConnectionObjects.Welds.WeldPoint.ByPoint(point=value, objectsToConnect=transpose_2)
