# Dynamo graph 010-Polycurve.dyn "TestePoly" (Dynamo 2.13.1.3887)

# group: Get Poly Curve of any Polybeam
# Use the polycurve of any polybeam for set in another polybeam
selectAdvanceSteelObjects = ASObjectSelection()  # 1 picked in the model
polyBeamProperties = ASPropertiesPolyBeam("Poly Curve")
getObjectProperty = AdvanceSteel.Nodes.Property.GetObjectProperty(steelObject=selectAdvanceSteelObjects, propertyName=polyBeamProperties)
firstItem = List.FirstItem(list=getObjectProperty)
value = AdvanceSteel.Nodes.Property.Value(property=firstItem)

# group: Set Poly Curve of any Polybeam
selectAdvanceSteelObjects_2 = ASObjectSelection()  # 1 picked in the model
polyBeamProperties_2 = ASPropertiesPolyBeam("Poly Curve")
byNameAndValue = AdvanceSteel.Nodes.Property.ByNameAndValue(propertyName=polyBeamProperties_2, value=value)
setObjectProperty = AdvanceSteel.Nodes.Property.SetObjectProperty(steelObject=selectAdvanceSteelObjects_2, property=byNameAndValue)
