# Dynamo graph AnchorBolts.dyn (Dynamo 2.5.2.7915)

# group: GET
# note: Get information / data from Civil 3D

# group: DATA IN
# note: Import information / data from others

# group: PROCESS
# note: Dynamo data manipulation

# group: DATA OUT
# note: Export information / data to others

# group: CREATE
# note: Create object in Civil 3D

# group: SET
# note: Set or Override Parameter in Civil 3D

# group: TEMP
# note: Work in progress / To delete

# group: GEOM
# note: Dynamo geometry creation

# group: GRAPH INFO
# note: ________________________________________________________
# Dynamo Core Ver: 	2.4.1.6394
# Dynamo Civil 3D Ver: 	2.4.1.2161
# Package Used: 		Civil 3D Toolkit
# Custom Nodes Used: 	None
# Graph Function:
# 1. ???
# 2. ???
# 3. ???
# Created By: 		Jowenn S. Lua
# Date Created: 		September 2020
# Updated By:
# Date Modified:

# group: NOTES - D4C3D
# note: DESIGN GRAPH STANDARDS
# Author:		Jowenn S. Lua
# Date Created:	10 August 2019
# Date Updated:	4 September 2020
# Version:		004
# DESIGN GRAPH GUIDELINES
# 1. Color code your blocks according to this guide.
# 2. Add grouping with name and description.
# 3. Add notes to explain each critical node process.
# 4. Rename Input / Output / Code Blocks nodes and add suffix to data they carry.
# 5. Align nodes to make it neat.
# 6. Save the graph as Manual instead of Automatic.

code_block = CodeBlock { "MuS"; "4.6"; "HOLDING DOWN BOLTS"; 300; }
code_block_2 = CodeBlock()
# ---------- code_block_2.designscript (3 lines) ----------
CoordinateSystem.ByOriginVectors(Point.Origin(), Vector.XAxis(), Vector.YAxis(), Vector.ZAxis());
Point.Origin();
Vector.ZAxis();
# ----------------------------------------
byOriginNormal = Plane.ByOriginNormal(origin=code_block_2.out1, normal=code_block_2.out2)
code_block_3 = CodeBlock { 300; 300; }
byWidthLength = Rectangle.ByWidthLength(plane=byOriginNormal, width=code_block_3.out0, length=code_block_3.out1)
code_block_4 = CodeBlock { 500; 650; 20; 0; -1; 1; }
byRectanglarByCS = AdvanceSteel.Nodes.Plates.Plate.ByRectanglarByCS(coordinateSystem=code_block_2.out0, length=code_block_4.out0, width=code_block_4.out1, corner=code_block_4.out2, additionalPlateParameters=code_block_4.out3)
byRectanglarByCS_2 = AdvanceSteel.Nodes.Plates.Plate.ByRectanglarByCS(coordinateSystem=code_block_2.out0, length=code_block_4.out0, width=code_block_4.out1, corner=code_block_4.out2, additionalPlateParameters=code_block_4.out5)
list_create = List.Create(item0=byRectanglarByCS, item1=byRectanglarByCS_2)
bolt_connection_type = BoltConnectionType("InShop")
anchor_bolt_properties = ASPropertiesAnchorBolt("IsInverted")
code_block_5 = CodeBlock { 20; 2; 2; true; }
byNameAndValue = AdvanceSteel.Nodes.Property.ByNameAndValue(propertyName=anchor_bolt_properties, value=code_block_5.out3)
list_create_2 = List.Create(item0=byNameAndValue)
byRectangle = AdvanceSteel.Nodes.ConnectionObjects.Anchors.RectangularAnchorPattern.ByRectangle(rectangle=byWidthLength, objectsToConnect=list_create, boltConnectionType=bolt_connection_type, additionalAnchorBoltParameters=list_create_2)
code_block_6 = CodeBlock()
# ---------- code_block_6.designscript (3 lines) ----------
CoordinateSystem.ByOriginVectors(Point.ByCoordinates(1500,0,0), Vector.XAxis(), Vector.YAxis(), Vector.ZAxis());
Point.ByCoordinates(1500,0,0);
Vector.ZAxis();
# ----------------------------------------
byOriginNormal_2 = Plane.ByOriginNormal(origin=code_block_6.out1, normal=code_block_6.out2)
code_block_7 = CodeBlock { 300; 300; }
byWidthLength_2 = Rectangle.ByWidthLength(plane=byOriginNormal_2, width=code_block_7.out0, length=code_block_7.out1)
code_block_8 = CodeBlock { 500; 650; 20; 0; -1; 1; }
byRectanglarByCS_3 = AdvanceSteel.Nodes.Plates.Plate.ByRectanglarByCS(coordinateSystem=code_block_6.out0, length=code_block_8.out0, width=code_block_8.out1, corner=code_block_8.out2, additionalPlateParameters=code_block_8.out3)
byRectanglarByCS_4 = AdvanceSteel.Nodes.Plates.Plate.ByRectanglarByCS(coordinateSystem=code_block_6.out0, length=code_block_8.out0, width=code_block_8.out1, corner=code_block_8.out2, additionalPlateParameters=code_block_8.out5)
list_create_3 = List.Create(item0=byRectanglarByCS_3, item1=byRectanglarByCS_4)
bolt_connection_type_2 = BoltConnectionType("InShop")
atCentrePoint = AdvanceSteel.Nodes.ConnectionObjects.Anchors.RectangularAnchorPattern.AtCentrePoint(connectionPoint=code_block_6.out1, boltCS=code_block_6.out0, objectsToConnect=list_create_3, boltConnectionType=bolt_connection_type_2)
code_block_9 = CodeBlock { 20; 3; 4; 150; 200; }
code_block_10 = CodeBlock { "MuS"; "4.6"; "HOLDING DOWN BOLTS"; 300; }
code_block_11 = CodeBlock { "MuS"; "4.6"; "HOLDING DOWN BOLTS"; 300; }
code_block_12 = CodeBlock {  }
byNameAndValue_2 = AdvanceSteel.Nodes.Property.ByNameAndValue()  # unwired: propertyName, value
byNameAndValue_3 = AdvanceSteel.Nodes.Property.ByNameAndValue()  # unwired: propertyName, value
code_block_13 = CodeBlock { Point.ByCoordinates(1500,1500,0); 600; Vector.ZAxis(); 1500; 20; 0; 1; -1; }
byCenterPointRadius = Circle.ByCenterPointRadius(centerPoint=code_block_13.out0, radius=code_block_13.out1)
code_block_14 = CodeBlock { Vector.XAxis(); }
byRectanglarByPointandNormal = AdvanceSteel.Nodes.Plates.Plate.ByRectanglarByPointandNormal(origin=code_block_13.out0, normal=code_block_13.out2, length=code_block_13.out3, width=code_block_13.out3, corner=code_block_13.out4, additionalPlateParameters=code_block_13.out5)
byRectanglarByPointandNormal_2 = AdvanceSteel.Nodes.Plates.Plate.ByRectanglarByPointandNormal(origin=code_block_13.out0, normal=code_block_13.out2, length=code_block_13.out3, width=code_block_13.out3, corner=code_block_13.out4, additionalPlateParameters=code_block_13.out6)
list_create_4 = List.Create(item0=byRectanglarByPointandNormal, item1=byRectanglarByPointandNormal_2)
bolt_connection_type_3 = BoltConnectionType("InShop")
code_block_15 = CodeBlock { 20; 7; 300; }
byNameAndValue_4 = AdvanceSteel.Nodes.Util.Property.ByNameAndValue(propertyValue=code_block_15.out1)  # unwired: propertyType
list_create_5 = List.Create(item0=byNameAndValue_4)
byCircle = AdvanceSteel.Nodes.ConnectionObjects.Anchors.CircularAnchorPattern.ByCircle(circle=byCenterPointRadius, referenceVector=code_block_14, objectsToConnect=list_create_4, anchorBoltConnectionType=bolt_connection_type_3, additionalAnchorBoltParameters=list_create_5)
anchor_orientation_type = AnchorOrientationType("Normal Orientation")
setAnchorBoltOrientation = AdvanceSteel.Nodes.Util.ConnectionObjects.SetAnchorBoltOrientation(anchorBolts=byCircle, orientation=anchor_orientation_type)
