# Dynamo graph BeamData.dyn (Dynamo 2.5.2.7915)

# group: GET
# note: Get information / data from Civil 3D

# group: CREATE
# note: Create object in Civil 3D

# group: DATA IN
# note: Import information / data from others

# group: DATA OUT
# note: Export information / data to others

# group: SET
# note: Set or Override Parameter in Civil 3D

# group: PROCESS
# note: Dynamo data manipulation

# group: TEMP
# note: Work in progress / To delete

# group: GEOM
# note: Dynamo geometry creation

# group: NOTES - D4C3D
# note: DESIGN GRAPH STANDARDS
# Author:		Jowenn S. Lua
# Date Created:	10 August 2019
# Date Updated:	4 September 2020
# Version:		004
# DESIGN GRAPH GUIDELINES
# 1. Color code your blocks according to this guide.
# 2. Add grouping with name and description.
# 3. Add notes to explain each critical node process.
# 4. Rename Input / Output / Code Blocks nodes and add suffix to data they carry.
# 5. Align nodes to make it neat.
# 6. Save the graph as Manual instead of Automatic.

# group: GRAPH INFO
# note: ________________________________________________________
# Dynamo Core Ver: 	2.4.1.6394
# Dynamo Civil 3D Ver: 	2.4.1.2161
# Package Used: 		Civil 3D Toolkit
# Custom Nodes Used: 	None
# Graph Function:
# 1. ???
# 2. ???
# 3. ???
# Created By: 		Jowenn S. Lua
# Date Created: 		September 2020
# Updated By:
# Date Modified:

getSteelObjectsByType = ASSelectObjecTypes("Straight Beam")
bodyResolutions = BodyResolution("Detailed")
getBeamData = AdvanceSteel.Nodes.Util.Beam.GetBeamData(steelObject=getSteelObjectsByType, bodyResolutionForLength=bodyResolutions)
watch = Watch(getBeamData.beamData)
watch_2 = Watch(getBeamData.ExactWeight)
watch_3 = Watch(getBeamData.PaintArea)
watch_4 = Watch(getBeamData.WeightPerUnit)
watch_5 = Watch(getBeamData.ProfileType)
watch_6 = Watch(getBeamData.ProfileTypeCode)
getBeamSawInformation = AdvanceSteel.Nodes.Util.Beam.GetBeamSawInformation(steelObject=getSteelObjectsByType)
list_create = List.Create(item0=getBeamSawInformation.beamSawCutInformation, item1=getBeamSawInformation.FlangeAngleAtStart, item2=getBeamSawInformation.WebAngleAtStart, item3=getBeamSawInformation.FlangeAngleAtEnd, item4=getBeamSawInformation.WebAngleAtEnd)
watch_7 = Watch(list_create)
