# Dynamo graph BeamShortening.dyn (Dynamo 2.5.2.7915)

# group: PROCESS
# note: Dynamo data manipulation

# group: DATA IN
# note: Import information / data from others

# group: GET
# note: Get information / data from Civil 3D

# group: GEOM
# note: Dynamo geometry creation

# group: NOTES - D4C3D
# note: DESIGN GRAPH STANDARDS
# Author:		Jowenn S. Lua
# Date Created:	10 August 2019
# Date Updated:	4 September 2020
# Version:		004
# DESIGN GRAPH GUIDELINES
# 1. Color code your blocks according to this guide.
# 2. Add grouping with name and description.
# 3. Add notes to explain each critical node process.
# 4. Rename Input / Output / Code Blocks nodes and add suffix to data they carry.
# 5. Align nodes to make it neat.
# 6. Save the graph as Manual instead of Automatic.

# group: TEMP
# note: Work in progress / To delete

# group: SET
# note: Set or Override Parameter in Civil 3D

# group: DATA OUT
# note: Export information / data to others

# group: CREATE
# note: Create object in Civil 3D

# group: GRAPH INFO
# note: ________________________________________________________
# Dynamo Core Ver: 	2.4.1.6394
# Dynamo Civil 3D Ver: 	2.4.1.2161
# Package Used: 		Civil 3D Toolkit
# Custom Nodes Used: 	None
# Graph Function:
# 1. ???
# 2. ???
# 3. ???
# Created By: 		Jowenn S. Lua
# Date Created: 		September 2020
# Updated By:
# Date Modified:

code_block = CodeBlock { Point.ByCoordinates(0,0,0); Point.ByCoordinates(0,1200,0); Vector.ZAxis(); }
code_block_2 = CodeBlock { 4; }
byStartPointEndPoint = AdvanceSteel.Nodes.Beams.StraightBeam.ByStartPointEndPoint(start=code_block.out0, end=code_block.out1, orientation=code_block.out2, refAxis=code_block_2)
code_block_3 = CodeBlock { CoordinateSystem.ByOriginVectors(Point.ByCoordinates(0,1000,0),Vector.XAxis(),Vector.Reverse(Vector.ZAxis()),Vector.YAxis()); }
byCS = AdvanceSteel.Nodes.Modifications.BeamPlaneCut.ByCS(element=byStartPointEndPoint, coordinateSystem=code_block_3)
code_block_4 = CodeBlock { Point.ByCoordinates(0,0,0); Point.ByCoordinates(2002,1200,0); Point.ByCoordinates(3000,2000,0); Vector.ZAxis(); }
byThreePoints = Arc.ByThreePoints(firstPoint=code_block_4.out0, secondPoint=code_block_4.out1, thirdPoint=code_block_4.out2)
byArc = AdvanceSteel.Nodes.Beams.BentBeam.ByArc(arc=byThreePoints, orientation=code_block_4.out3)
code_block_5 = CodeBlock { CoordinateSystem.ByOriginVectors(Point.ByCoordinates(2573,1639,0),Vector.XAxis(),Vector.Reverse(Vector.ZAxis()),Vector.YAxis()); }
byCS_2 = AdvanceSteel.Nodes.Modifications.BeamPlaneCut.ByCS(element=byArc, coordinateSystem=code_block_5)
code_block_6 = CodeBlock { 100; }
byStartValue = AdvanceSteel.Nodes.Modifications.BeamPlaneCut.ByStartValue(element=byStartPointEndPoint, shorteningLength=code_block_6)
code_block_7 = CodeBlock { 1000; }
byStartValue_2 = AdvanceSteel.Nodes.Modifications.BeamPlaneCut.ByStartValue(element=byArc, shorteningLength=code_block_7)
code_block_8 = CodeBlock { Point.ByCoordinates(5001,0,0); Point.ByCoordinates(5000,1200,0); Vector.ZAxis(); }
code_block_9 = CodeBlock { 2; }
byStartPointEndPoint_2 = AdvanceSteel.Nodes.Beams.StraightBeam.ByStartPointEndPoint(start=code_block_8.out0, end=code_block_8.out1, orientation=code_block_8.out2, refAxis=code_block_9)
code_block_10 = CodeBlock { 2; 103; 50; 11; 1; }
byRectangularOrthoCope = AdvanceSteel.Nodes.Modifications.BeamCope.ByRectangularOrthoCope(element=byStartPointEndPoint_2, end=code_block_10.out0, side=code_block_10.out0, length=code_block_10.out1, depth=code_block_10.out2, cornerRadius=code_block_10.out3, cornerType=code_block_10.out4)
