# Dynamo graph Beams.dyn (Dynamo 2.5.2.7915)

# group: GET
# note: Get information / data from Civil 3D

# group: DATA IN
# note: Import information / data from others

# group: PROCESS
# note: Dynamo data manipulation

# group: DATA OUT
# note: Export information / data to others

# group: CREATE
# note: Create object in Civil 3D

# group: SET
# note: Set or Override Parameter in Civil 3D

# group: TEMP
# note: Work in progress / To delete

# group: GEOM
# note: Dynamo geometry creation

# group: GRAPH INFO
# note: ________________________________________________________
# Dynamo Core Ver: 	2.4.1.6394
# Dynamo Civil 3D Ver: 	2.4.1.2161
# Package Used: 		Civil 3D Toolkit
# Custom Nodes Used: 	None
# Graph Function:
# 1. ???
# 2. ???
# 3. ???
# Created By: 		Jowenn S. Lua
# Date Created: 		September 2020
# Updated By:
# Date Modified:

# group: NOTES - D4C3D
# note: DESIGN GRAPH STANDARDS
# Author:		Jowenn S. Lua
# Date Created:	10 August 2019
# Date Updated:	4 September 2020
# Version:		004
# DESIGN GRAPH GUIDELINES
# 1. Color code your blocks according to this guide.
# 2. Add grouping with name and description.
# 3. Add notes to explain each critical node process.
# 4. Rename Input / Output / Code Blocks nodes and add suffix to data they carry.
# 5. Align nodes to make it neat.
# 6. Save the graph as Manual instead of Automatic.

code_block = CodeBlock { Point.ByCoordinates(0,0,0); Point.ByCoordinates(2000,2000,2000); Vector.ZAxis(); }
byStartPointEndPoint = AdvanceSteel.Nodes.Beams.TaperedBeam.ByStartPointEndPoint(start=code_block.out0, end=code_block.out1, vOrientation=code_block.out2)
code_block_2 = CodeBlock { "TaperedBeam"; "Default"; }
createSectionString = AdvanceSteel.Nodes.Util.BeamSection.CreateSectionString(sectionType=code_block_2.out0, sectionSize=code_block_2.out1)
setSection = AdvanceSteel.Nodes.Util.BeamSection.SetSection(beamElement=byStartPointEndPoint, sectionName=createSectionString)
code_block_3 = CodeBlock { Point.ByCoordinates(0,0,0); Point.ByCoordinates(0,2000,2000); Vector.ZAxis(); }
code_block_4 = CodeBlock { "Compound2UToe"; "Default CISC"; "Default"; }
createSectionString_2 = AdvanceSteel.Nodes.Util.BeamSection.CreateSectionString(sectionType=code_block_4.out0, sectionSize=code_block_4.out1)
byStartPointEndPoint_2 = AdvanceSteel.Nodes.Beams.CompoundBeam.ByStartPointEndPoint(start=code_block_3.out0, end=code_block_3.out1, orientation=code_block_3.out2, sectionName=createSectionString_2)
createSectionString_3 = AdvanceSteel.Nodes.Util.BeamSection.CreateSectionString(sectionType=code_block_4.out0, sectionSize=code_block_4.out2)
setSection_2 = AdvanceSteel.Nodes.Util.BeamSection.SetSection(beamElement=byStartPointEndPoint_2, sectionName=createSectionString_3)
code_block_5 = CodeBlock { Point.ByCoordinates(0,0,0); Point.ByCoordinates(2000,0,0); Vector.ZAxis(); }
code_block_6 = CodeBlock { "WeldedHalfColumn"; "Default"; }
createSectionString_4 = AdvanceSteel.Nodes.Util.BeamSection.CreateSectionString(sectionType=code_block_6.out0, sectionSize=code_block_6.out1)
byStartPointEndPoint_3 = AdvanceSteel.Nodes.Beams.CompoundBeam.ByStartPointEndPoint(start=code_block_5.out0, end=code_block_5.out1, orientation=code_block_5.out2, sectionName=createSectionString_4)
code_block_7 = CodeBlock { "WeldedHollow"; "Default"; }
createSectionString_5 = AdvanceSteel.Nodes.Util.BeamSection.CreateSectionString(sectionType=code_block_7.out0, sectionSize=code_block_7.out1)
setSection_3 = AdvanceSteel.Nodes.Util.BeamSection.SetSection(beamElement=byStartPointEndPoint_3, sectionName=createSectionString_5)
code_block_8 = CodeBlock { Point.ByCoordinates(0,0,0); Point.ByCoordinates(1000,1200,0); Point.ByCoordinates(2000,2001,0); Vector.ZAxis(); }
byStartPointEndPoint_4 = AdvanceSteel.Nodes.Beams.BentBeam.ByStartPointEndPoint(start=code_block_8.out0, end=code_block_8.out2, ptOnArc=code_block_8.out1, orientation=code_block_8.out3)
code_block_9 = CodeBlock { "Lindab Z Profiles"; "ZUni 35030"; }
createSectionString_6 = AdvanceSteel.Nodes.Util.BeamSection.CreateSectionString(sectionType=code_block_9.out0, sectionSize=code_block_9.out1)
setSection_4 = AdvanceSteel.Nodes.Util.BeamSection.SetSection(beamElement=byStartPointEndPoint_4, sectionName=createSectionString_6)
code_block_10 = CodeBlock { Point.ByCoordinates(0,0,0); Point.ByCoordinates(0,0,2000); Vector.ZAxis(); }
byStartPointEndPoint_5 = AdvanceSteel.Nodes.Beams.StraightBeam.ByStartPointEndPoint(start=code_block_10.out0, end=code_block_10.out1, orientation=code_block_10.out2)
code_block_11 = CodeBlock { "AISC 14.1 Angle equal"; "L4X4X7/16"; }
createSectionString_7 = AdvanceSteel.Nodes.Util.BeamSection.CreateSectionString(sectionType=code_block_11.out0, sectionSize=code_block_11.out1)
setSection_5 = AdvanceSteel.Nodes.Util.BeamSection.SetSection(beamElement=byStartPointEndPoint_5, sectionName=createSectionString_7)
code_block_12 = CodeBlock { Point.ByCoordinates(0,0,0); Point.ByCoordinates(0,2000,0); Vector.ZAxis(); }
code_block_13 = CodeBlock { "Compound2UToe"; "Default CISC"; }
createSectionString_8 = AdvanceSteel.Nodes.Util.BeamSection.CreateSectionString(sectionType=code_block_13.out0, sectionSize=code_block_13.out1)
byStartPointEndPoint_6 = AdvanceSteel.Nodes.Beams.CompoundBeam.ByStartPointEndPoint(start=code_block_12.out0, end=code_block_12.out1, orientation=code_block_12.out2, sectionName=createSectionString_8)
code_block_14 = CodeBlock { "Compound2U"; "Default"; }
createSectionString_9 = AdvanceSteel.Nodes.Util.BeamSection.CreateSectionString(sectionType=code_block_14.out0, sectionSize=code_block_14.out1)
setSection_6 = AdvanceSteel.Nodes.Util.BeamSection.SetSection(beamElement=byStartPointEndPoint_6, sectionName=createSectionString_9)
