# Dynamo graph Beams2.dyn (Dynamo 2.5.2.7915)

# group: GRAPH INFO
# note: ________________________________________________________
# Dynamo Core Ver: 	2.4.1.6394
# Dynamo Civil 3D Ver: 	2.4.1.2161
# Package Used: 		Civil 3D Toolkit
# Custom Nodes Used: 	None
# Graph Function:
# 1. ???
# 2. ???
# 3. ???
# Created By: 		Jowenn S. Lua
# Date Created: 		September 2020
# Updated By:
# Date Modified:

# group: TEMP
# note: Work in progress / To delete

# group: SET
# note: Set or Override Parameter in Civil 3D

# group: DATA OUT
# note: Export information / data to others

# group: PROCESS
# note: Dynamo data manipulation

# group: DATA IN
# note: Import information / data from others

# group: GEOM
# note: Dynamo geometry creation

# group: GET
# note: Get information / data from Civil 3D

# group: CREATE
# note: Create object in Civil 3D

# group: NOTES - D4C3D
# note: DESIGN GRAPH STANDARDS
# Author:		Jowenn S. Lua
# Date Created:	10 August 2019
# Date Updated:	4 September 2020
# Version:		004
# DESIGN GRAPH GUIDELINES
# 1. Color code your blocks according to this guide.
# 2. Add grouping with name and description.
# 3. Add notes to explain each critical node process.
# 4. Rename Input / Output / Code Blocks nodes and add suffix to data they carry.
# 5. Align nodes to make it neat.
# 6. Save the graph as Manual instead of Automatic.

code_block = CodeBlock { Point.ByCoordinates(0,0,0); Point.ByCoordinates(2000,2000,2000); Vector.ZAxis(); }
byStartPointEndPoint = AdvanceSteel.Nodes.Beams.TaperedBeam.ByStartPointEndPoint(end=code_block.out1, vOrientation=code_block.out2)  # unwired: start
code_block_2 = CodeBlock { "Compound2UToe"; "Default CISC"; "Default"; }
createSectionString = AdvanceSteel.Nodes.Util.BeamSection.CreateSectionString(sectionType=code_block_2.out0, sectionSize=code_block_2.out1)
createSectionString_2 = AdvanceSteel.Nodes.Util.BeamSection.CreateSectionString(sectionType=code_block_2.out0, sectionSize=code_block_2.out2)
code_block_3 = CodeBlock { "Compound2U"; "Default"; }
createSectionString_3 = AdvanceSteel.Nodes.Util.BeamSection.CreateSectionString(sectionType=code_block_3.out0, sectionSize=code_block_3.out1)
code_block_4 = CodeBlock { "TaperedBeam"; "Default"; }
createSectionString_4 = AdvanceSteel.Nodes.Util.BeamSection.CreateSectionString(sectionType=code_block_4.out0, sectionSize=code_block_4.out1)
code_block_5 = CodeBlock { Point.ByCoordinates(0,0,0); Point.ByCoordinates(0,2000,0); Vector.ZAxis(); }
code_block_6 = CodeBlock { "Compound2UToe"; "Default CISC"; }
createSectionString_5 = AdvanceSteel.Nodes.Util.BeamSection.CreateSectionString(sectionType=code_block_6.out0, sectionSize=code_block_6.out1)
byStartPointEndPoint_2 = AdvanceSteel.Nodes.Beams.CompoundBeam.ByStartPointEndPoint(end=code_block_5.out1, orientation=code_block_5.out2, sectionName=createSectionString_5)  # unwired: start
code_block_7 = CodeBlock { Point.ByCoordinates(0,0,0); Point.ByCoordinates(0,2000,2000); Vector.ZAxis(); }
byStartPointEndPoint_3 = AdvanceSteel.Nodes.Beams.CompoundBeam.ByStartPointEndPoint(end=code_block_7.out1, orientation=code_block_7.out2)  # unwired: start, sectionName
code_block_8 = CodeBlock { Point.ByCoordinates(0,0,0); Point.ByCoordinates(2000,0,0); Vector.ZAxis(); }
code_block_9 = CodeBlock { "WeldedHalfColumn"; "Default"; }
createSectionString_6 = AdvanceSteel.Nodes.Util.BeamSection.CreateSectionString(sectionType=code_block_9.out0, sectionSize=code_block_9.out1)
byStartPointEndPoint_4 = AdvanceSteel.Nodes.Beams.CompoundBeam.ByStartPointEndPoint(end=code_block_8.out1, orientation=code_block_8.out2, sectionName=createSectionString_6)  # unwired: start
code_block_10 = CodeBlock { "AISC 14.1 Angle equal"; "L4X4X7/16"; }
createSectionString_7 = AdvanceSteel.Nodes.Util.BeamSection.CreateSectionString(sectionType=code_block_10.out0, sectionSize=code_block_10.out1)
code_block_11 = CodeBlock { Point.ByCoordinates(0,0,0); Point.ByCoordinates(0,0,2000); Vector.ZAxis(); }
byStartPointEndPoint_5 = AdvanceSteel.Nodes.Beams.StraightBeam.ByStartPointEndPoint(end=code_block_11.out1, orientation=code_block_11.out2)  # unwired: start

# group: SET
# note: Set or Override Parameter in Civil 3D
code_block_12 = CodeBlock { Point.ByCoordinates(0,0,1001); Point.ByCoordinates(2000,0,100); Vector.ZAxis(); Vector.XAxis(); 5000; }
code_block_13 = CodeBlock { Point.ByCoordinates(0,0,0); Point.ByCoordinates(2001,0,0); Vector.ZAxis(); Vector.YAxis(); }

# group: CREATE
# note: Create object in Civil 3D
byStartPointEndPoint_6 = AdvanceSteel.Nodes.Beams.StraightBeam.ByStartPointEndPoint(start=code_block_12.out0, end=code_block_12.out1, orientation=code_block_13.out2)

# group: SET
straight_beam_properties = ASPropertiesStraightBeam("Profile Name")
# note: Set or Override Parameter in Civil 3D
code_block_14 = CodeBlock { "AISC 14.1 Angle equal"; "L4X4X7/16"; }
createSectionString_8 = AdvanceSteel.Nodes.Util.BeamSection.CreateSectionString(sectionType=code_block_14.out0, sectionSize=code_block_14.out1)
byNameAndValue = AdvanceSteel.Nodes.Property.ByNameAndValue(propertyName=straight_beam_properties, value=createSectionString_8)
byNameAndValue_2 = AdvanceSteel.Nodes.Property.ByNameAndValue()  # unwired: propertyName, value
code_block_15 = CodeBlock { "Horizontal_Beam"; "Steel"; }
byNameAndValue_3 = AdvanceSteel.Nodes.Property.ByNameAndValue(value=code_block_15.out1)  # unwired: propertyName
list_create = List.Create(item0=byNameAndValue, item1=byNameAndValue_2, item2=byNameAndValue_3)

# group: CREATE
# note: Create object in Civil 3D
byStartPointDirectionLength = AdvanceSteel.Nodes.Beams.StraightBeam.ByStartPointDirectionLength(start=code_block_13.out0, direction=code_block_12.out2, orientation=code_block_12.out3, length=code_block_12.out4, additionalBeamParameters=list_create)

beam_reference_axis = BeamRefAxisType("Upper Middle")

# group: CREATE
# note: Create object in Civil 3D
byStartPointDirectionLength_2 = AdvanceSteel.Nodes.Beams.StraightBeam.ByStartPointDirectionLength(start=code_block_13.out1, direction=code_block_12.out2, orientation=code_block_12.out3, length=code_block_12.out4, refAxis=beam_reference_axis)

beam_reference_axis_2 = BeamRefAxisType("Upper Middle")

# group: CREATE
# note: Create object in Civil 3D
byStartPointEndPoint_7 = Line.ByStartPointEndPoint(startPoint=code_block_13.out0, endPoint=code_block_12.out1)
byLine = AdvanceSteel.Nodes.Beams.StraightBeam.ByLine(line=byStartPointEndPoint_7, orientation=code_block_13.out3, refAxis=beam_reference_axis_2)

bent_beam_properties = ASPropertiesBentBeam("Layer")
getObjectProperty = AdvanceSteel.Nodes.Property.GetObjectProperty(propertyName=bent_beam_properties)  # unwired: steelObject
code_block_16 = CodeBlock { Point.ByCoordinates(0,0,0); Point.ByCoordinates(1000,1200,0); Point.ByCoordinates(2000,2000,0); Vector.ZAxis(); }
straight_beam_properties_2 = ASPropertiesStraightBeam("Profile Name")
code_block_17 = CodeBlock { "Lindab Z Profiles"; "ZUni 35030"; }
createSectionString_9 = AdvanceSteel.Nodes.Util.Beam.CreateSectionString(sectionType=code_block_17.out0, sectionSize=code_block_17.out1)
byNameAndValue_4 = AdvanceSteel.Nodes.Property.ByNameAndValue(propertyName=straight_beam_properties_2, value=createSectionString_9)
straight_beam_properties_3 = ASPropertiesStraightBeam("Role")
code_block_18 = CodeBlock { "Horizontal_Beam"; }
byNameAndValue_5 = AdvanceSteel.Nodes.Property.ByNameAndValue(propertyName=straight_beam_properties_3, value=code_block_18)
list_create_2 = List.Create(item0=byNameAndValue_4, item1=byNameAndValue_5)
byStartPointEndPoint_8 = AdvanceSteel.Nodes.Beams.BentBeam.ByStartPointEndPoint(start=code_block_16.out0, end=code_block_16.out2, ptOnArc=code_block_16.out1, orientation=code_block_16.out3, additionalBeamParameters=list_create_2)
body_resolution = BodyResolution("Normal")
getBeamData = AdvanceSteel.Nodes.Util.Beam.GetBeamData(steelObject=byStartPointEndPoint_8, bodyResolutionForLength=body_resolution)
