# Dynamo custom node BeamsByGrid.dyf (Dynamo 0.7.3.3034)
# category: AsNodes.AdvanceSteel.Nodes.AsBentBeam.Create
# create beams by grid

Grid_Points = Input()
flatten = Flatten(Grid_Points)
count = List.Count(flatten)
sqrt = Math.Sqrt(count)
chop = List.Chop(flatten, sqrt)
code_block = CodeBlock(list=chop) { list; }
count_2 = List.Count(code_block)
code_block_2 = CodeBlock(x=count_2) { 0..x-2..1; }
getItemAtIndex = List.GetItemAtIndex(code_block, code_block_2)
code_block_3 = CodeBlock(x=count_2) { 1..x-1..1; }
getItemAtIndex_2 = List.GetItemAtIndex(code_block, code_block_3)
byStartPointEndPoint = AdvanceSteel.Nodes.StraightBeam.ByStartPointEndPoint(getItemAtIndex, getItemAtIndex_2)
X_Beams = Output(byStartPointEndPoint)
code_block_4 = CodeBlock(list=chop) { list; }
python_script = Python(IN[0]=code_block_4)
# ---------- python_script.python (15 lines) ----------
import clr
clr.AddReference('ProtoGeometry')
from Autodesk.DesignScript.Geometry import *
#The inputs to this node will be stored as a list in the IN variable.
inp = IN[0]

#Assign your output to the OUT variable

start = []
end = []
for i in range(len(inp)):
 for j in range(len(inp[i])-1):
  start.append(inp[i][j])
  end.append(inp[i][j+1])
OUT = [start,end]
# ----------------------------------------
code_block_5 = CodeBlock(x=python_script) { x[0]; x[1]; }
byStartPointEndPoint_2 = AdvanceSteel.Nodes.StraightBeam.ByStartPointEndPoint(code_block_5.out0, code_block_5.out1)
Y_Beams = Output(byStartPointEndPoint_2)
