# Dynamo graph Bolts.dyn (Dynamo 2.5.2.7915)

# group: GRAPH INFO
# note: ________________________________________________________
# Dynamo Core Ver: 	2.4.1.6394
# Dynamo Civil 3D Ver: 	2.4.1.2161
# Package Used: 		Civil 3D Toolkit
# Custom Nodes Used: 	None
# Graph Function:
# 1. ???
# 2. ???
# 3. ???
# Created By: 		Jowenn S. Lua
# Date Created: 		September 2020
# Updated By:
# Date Modified:

# group: TEMP
# note: Work in progress / To delete

# group: SET
# note: Set or Override Parameter in Civil 3D

# group: PROCESS
# note: Dynamo data manipulation

# group: GEOM
# note: Dynamo geometry creation

# group: DATA IN
# note: Import information / data from others

# group: DATA OUT
# note: Export information / data to others

# group: NOTES - D4C3D
# note: DESIGN GRAPH STANDARDS
# Author:		Jowenn S. Lua
# Date Created:	10 August 2019
# Date Updated:	4 September 2020
# Version:		004
# DESIGN GRAPH GUIDELINES
# 1. Color code your blocks according to this guide.
# 2. Add grouping with name and description.
# 3. Add notes to explain each critical node process.
# 4. Rename Input / Output / Code Blocks nodes and add suffix to data they carry.
# 5. Align nodes to make it neat.
# 6. Save the graph as Manual instead of Automatic.

# group: GET
# note: Get information / data from Civil 3D

# group: CREATE
# note: Create object in Civil 3D

code_block = CodeBlock { 500; 650; 20; 0; -1; 1; }
byRectanglarByCS = AdvanceSteel.Nodes.Plates.Plate.ByRectanglarByCS(length=code_block.out0, width=code_block.out1, corner=code_block.out2, additionalPlateParameters=code_block.out3)  # unwired: coordinateSystem
byRectanglarByCS_2 = AdvanceSteel.Nodes.Plates.Plate.ByRectanglarByCS(length=code_block.out0, width=code_block.out1, corner=code_block.out2, additionalPlateParameters=code_block.out5)  # unwired: coordinateSystem
list_create = List.Create(item0=byRectanglarByCS, item1=byRectanglarByCS_2)
code_block_2 = CodeBlock { "MuS"; "4.6"; "AS 1111"; }
code_block_3 = CodeBlock { 20; 2; 3; }
code_block_4 = CodeBlock { 150; 65; }
bolt_connection_type = BoltConnectionType("InShop")
bolts = AdvanceSteel.Nodes.Util.BuildPropertyCollection.Bolts(standard=code_block_2.out2, boltAssembly=code_block_2.out0, grade=code_block_2.out1, diameter=code_block_3.out0, xHoleCount=code_block_3.out1, yHoleCount=code_block_3.out2, xHoleSpacing=code_block_4.out0, yHoleSpacing=code_block_4.out1, boltType=bolt_connection_type)
code_block_5 = CodeBlock()
# ---------- code_block_5.designscript (3 lines) ----------
CoordinateSystem.ByOriginVectors(Point.ByCoordinates(1500,0,0), Vector.XAxis(), Vector.YAxis(), Vector.ZAxis());
Point.ByCoordinates(1500,0,0);
Vector.ZAxis();
# ----------------------------------------
byOriginNormal = Plane.ByOriginNormal(origin=code_block_5.out1, normal=code_block_5.out2)
code_block_6 = CodeBlock { 300; 300; }
byWidthLength = Rectangle.ByWidthLength(plane=byOriginNormal, width=code_block_6.out0, length=code_block_6.out1)
atCentrePoint = AdvanceSteel.Nodes.ConnectionObjects.Bolts.RectangularBoltPattern.AtCentrePoint(connectionPoint=code_block_5.out1, boltCS=code_block_5.out0)  # unwired: noOfBoltsX, noOfBoltsY, objectsToConnect, boltConnectionType
code_block_7 = CodeBlock { Point.ByCoordinates(1500,1500,0); 600; Vector.ZAxis(); 1500; 20; 0; 1; -1; Vector.XAxis(); }
byCenterPointRadius = Circle.ByCenterPointRadius(centerPoint=code_block_7.out0, radius=code_block_7.out1)
byCircle = AdvanceSteel.Nodes.ConnectionObjects.Bolts.CircularBoltPattern.ByCircle(circle=byCenterPointRadius, referenceVector=code_block_7.out8)  # unwired: objectsToConnect, boltConnectionType
byRectanglarByPointandNormal = AdvanceSteel.Nodes.Plates.Plate.ByRectanglarByPointandNormal(normal=code_block_7.out2, length=code_block_7.out3, width=code_block_7.out3, corner=code_block_7.out4, additionalPlateParameters=code_block_7.out5)  # unwired: origin
byRectanglarByPointandNormal_2 = AdvanceSteel.Nodes.Plates.Plate.ByRectanglarByPointandNormal(normal=code_block_7.out2, length=code_block_7.out3, width=code_block_7.out3, corner=code_block_7.out4, additionalPlateParameters=code_block_7.out6)  # unwired: origin
list_create_2 = List.Create(item0=byRectanglarByPointandNormal, item1=byRectanglarByPointandNormal_2)
code_block_8 = CodeBlock { "MuS"; "4.6"; "AS 1111"; }
code_block_9 = CodeBlock { 20; 7; }
code_block_10 = CodeBlock { 300; }
code_block_11 = CodeBlock { 50; }
bolt_connection_type_2 = BoltConnectionType("InShop")
bolts_2 = AdvanceSteel.Nodes.Util.BuildPropertyCollection.Bolts(standard=code_block_8.out2, boltAssembly=code_block_8.out0, grade=code_block_8.out1, diameter=code_block_9.out0, xHoleCount=code_block_9.out1, radius=code_block_10, lengthAddition=code_block_11, boltType=bolt_connection_type_2)
code_block_12 = CodeBlock { "MuS"; "4.6"; "AS 1111"; }
code_block_13 = CodeBlock()
# ---------- code_block_13.designscript (3 lines) ----------
CoordinateSystem.ByOriginVectors(Point.Origin(), Vector.XAxis(), Vector.YAxis(), Vector.ZAxis());
Point.Origin();
Vector.ZAxis();
# ----------------------------------------
byOriginNormal_2 = Plane.ByOriginNormal(origin=code_block_13.out1, normal=code_block_13.out2)
code_block_14 = CodeBlock { 300; 300; }
byWidthLength_2 = Rectangle.ByWidthLength(plane=byOriginNormal_2, width=code_block_14.out0, length=code_block_14.out1)
code_block_15 = CodeBlock { 20; 2; 2; }
code_block_16 = CodeBlock { 600; 650; 25; 0; -1; 1; }
byRectanglarByCS_3 = AdvanceSteel.Nodes.Plates.Plate.ByRectanglarByCS(coordinateSystem=code_block_13.out0, length=code_block_16.out0, width=code_block_16.out1, corner=code_block_16.out2, additionalPlateParameters=code_block_16.out3)
byRectanglarByCS_4 = AdvanceSteel.Nodes.Plates.Plate.ByRectanglarByCS(coordinateSystem=code_block_13.out0, length=code_block_16.out0, width=code_block_16.out1, corner=code_block_16.out2, additionalPlateParameters=code_block_16.out5)
list_create_3 = List.Create(item0=byRectanglarByCS_3, item1=byRectanglarByCS_4)
bolt_connection_type_3 = BoltConnectionType("InShop")
byRectangle = AdvanceSteel.Nodes.ConnectionObjects.Bolts.RectangularBoltPattern.ByRectangle(rectangle=byWidthLength_2, noOfBoltsX=code_block_15.out1, noOfBoltsY=code_block_15.out2, objectsToConnect=list_create_3, additionalBoltParameters=bolt_connection_type_3)  # unwired: boltConnectionType
