# Dynamo graph Bolts2.dyn (Dynamo 2.5.2.7915)

# group: GRAPH INFO
# note: ________________________________________________________
# Dynamo Core Ver: 	2.4.1.6394
# Dynamo Civil 3D Ver: 	2.4.1.2161
# Package Used: 		Civil 3D Toolkit
# Custom Nodes Used: 	None
# Graph Function:
# 1. ???
# 2. ???
# 3. ???
# Created By: 		Jowenn S. Lua
# Date Created: 		September 2020
# Updated By:
# Date Modified:

# group: TEMP
# note: Work in progress / To delete

# group: SET
# note: Set or Override Parameter in Civil 3D

# group: PROCESS
# note: Dynamo data manipulation

# group: GEOM
# note: Dynamo geometry creation

# group: DATA IN
# note: Import information / data from others

# group: DATA OUT
# note: Export information / data to others

# group: NOTES - D4C3D
# note: DESIGN GRAPH STANDARDS
# Author:		Jowenn S. Lua
# Date Created:	10 August 2019
# Date Updated:	4 September 2020
# Version:		004
# DESIGN GRAPH GUIDELINES
# 1. Color code your blocks according to this guide.
# 2. Add grouping with name and description.
# 3. Add notes to explain each critical node process.
# 4. Rename Input / Output / Code Blocks nodes and add suffix to data they carry.
# 5. Align nodes to make it neat.
# 6. Save the graph as Manual instead of Automatic.

# group: GET
# note: Get information / data from Civil 3D

# group: CREATE
# note: Create object in Civil 3D

code_block = CodeBlock { Point.ByCoordinates(1500,1500,0); 600; Vector.ZAxis(); 1500; 20; 0; 1; -1; Vector.XAxis(); }
byCenterPointRadius = Circle.ByCenterPointRadius(centerPoint=code_block.out0, radius=code_block.out1)
byRectanglarByPointandNormal = AdvanceSteel.Nodes.Plates.Plate.ByRectanglarByPointandNormal(origin=code_block.out0, normal=code_block.out2, length=code_block.out3, width=code_block.out3, corner=code_block.out4, additionalPlateParameters=code_block.out5)
byRectanglarByPointandNormal_2 = AdvanceSteel.Nodes.Plates.Plate.ByRectanglarByPointandNormal(origin=code_block.out0, normal=code_block.out2, length=code_block.out3, width=code_block.out3, corner=code_block.out4, additionalPlateParameters=code_block.out6)
list_create = List.Create(item0=byRectanglarByPointandNormal, item1=byRectanglarByPointandNormal_2)
bolt_connection_type = BoltConnectionType("InShop")
advance_steel_bolt_property = ASPropertiesBolts("Bolt Inverted")
code_block_2 = CodeBlock { true; }
byNameAndValue = AdvanceSteel.Nodes.Property.ByNameAndValue(propertyName=advance_steel_bolt_property, value=code_block_2)
advance_steel_bolt_property_2 = ASPropertiesBolts("No of Bolts Circle")
code_block_3 = CodeBlock { 6; }
byNameAndValue_2 = AdvanceSteel.Nodes.Property.ByNameAndValue(propertyName=advance_steel_bolt_property_2, value=code_block_3)
list_create_2 = List.Create(item0=byNameAndValue, item1=byNameAndValue_2)
byCircle = AdvanceSteel.Nodes.ConnectionObjects.Bolts.CircularBoltPattern.ByCircle(circle=byCenterPointRadius, referenceVector=code_block.out8, objectsToConnect=list_create, boltConnectionType=bolt_connection_type, additionalBoltParameters=list_create_2)

# group: Rectangular Pattern at a point
code_block_4 = CodeBlock()
# ---------- code_block_4.designscript (3 lines) ----------
CoordinateSystem.ByOriginVectors(Point.ByCoordinates(1500,0,0), Vector.XAxis(), Vector.YAxis(), Vector.ZAxis());
Point.ByCoordinates(1500,0,0);
Vector.ZAxis();
# ----------------------------------------
code_block_5 = CodeBlock { 500; 650; 20; 0; -1; 1; 3; }
byRectanglarByCS = AdvanceSteel.Nodes.Plates.Plate.ByRectanglarByCS(coordinateSystem=code_block_4.out0, length=code_block_5.out0, width=code_block_5.out1, corner=code_block_5.out2, additionalPlateParameters=code_block_5.out3)
byRectanglarByCS_2 = AdvanceSteel.Nodes.Plates.Plate.ByRectanglarByCS(coordinateSystem=code_block_4.out0, length=code_block_5.out0, width=code_block_5.out1, corner=code_block_5.out2, additionalPlateParameters=code_block_5.out5)
list_create_3 = List.Create(item0=byRectanglarByCS, item1=byRectanglarByCS_2)
bolt_connection_type_2 = BoltConnectionType("Site Drill")
advance_steel_bolt_property_3 = ASPropertiesBolts("Bolt Assembly")
code_block_6 = CodeBlock { "MuS"; "8.8"; "AS 1252"; }
byNameAndValue_3 = AdvanceSteel.Nodes.Property.ByNameAndValue(propertyName=advance_steel_bolt_property_3, value=code_block_6.out0)
advance_steel_bolt_property_4 = ASPropertiesBolts("Grade")
byNameAndValue_4 = AdvanceSteel.Nodes.Property.ByNameAndValue(propertyName=advance_steel_bolt_property_4, value=code_block_6.out1)
advance_steel_bolt_property_5 = ASPropertiesBolts("Standard")
byNameAndValue_5 = AdvanceSteel.Nodes.Property.ByNameAndValue(propertyName=advance_steel_bolt_property_5, value=code_block_6.out2)
list_create_4 = List.Create(item0=byNameAndValue_3, item1=byNameAndValue_4, item2=byNameAndValue_5)
atCentrePoint = AdvanceSteel.Nodes.ConnectionObjects.Bolts.RectangularBoltPattern.AtCentrePoint(connectionPoint=code_block_4.out1, boltCS=code_block_4.out0, noOfBoltsX=code_block_5.out6, objectsToConnect=list_create_3, boltConnectionType=bolt_connection_type_2, additionalBoltParameters=list_create_4)

code_block_7 = CodeBlock { "MuS"; "4.6"; "AS 1111"; }
code_block_8 = CodeBlock { 20; 7; }
code_block_9 = CodeBlock { 300; }

# group: Rectangular pattern and Rectangle
code_block_10 = CodeBlock()
# ---------- code_block_10.designscript (3 lines) ----------
CoordinateSystem.ByOriginVectors(Point.Origin(), Vector.XAxis(), Vector.YAxis(), Vector.ZAxis());
Point.Origin();
Vector.ZAxis();
# ----------------------------------------
byOriginNormal = Plane.ByOriginNormal(origin=code_block_10.out1, normal=code_block_10.out2)
code_block_11 = CodeBlock { 300; 300; 5; }
byWidthLength = Rectangle.ByWidthLength(plane=byOriginNormal, width=code_block_11.out0, length=code_block_11.out1)
code_block_12 = CodeBlock { 500; 650; 25; 0; -1; 1; }
byRectanglarByCS_3 = AdvanceSteel.Nodes.Plates.Plate.ByRectanglarByCS(coordinateSystem=code_block_10.out0, length=code_block_12.out0, width=code_block_12.out1, corner=code_block_12.out2, additionalPlateParameters=code_block_12.out3)
byRectanglarByCS_4 = AdvanceSteel.Nodes.Plates.Plate.ByRectanglarByCS(coordinateSystem=code_block_10.out0, length=code_block_12.out0, width=code_block_12.out1, corner=code_block_12.out2, additionalPlateParameters=code_block_12.out5)
list_create_5 = List.Create(item0=byRectanglarByCS_3, item1=byRectanglarByCS_4)
bolt_connection_type_3 = BoltConnectionType("InShop")
advance_steel_bolt_property_6 = ASPropertiesBolts("Bolt Standard")
code_block_13 = CodeBlock { "MuS"; "8.8"; "AS 1252"; }
byNameAndValue_6 = AdvanceSteel.Nodes.Property.ByNameAndValue(propertyName=advance_steel_bolt_property_6, value=code_block_13.out2)
advance_steel_bolt_property_7 = ASPropertiesBolts("Bolt Grade")
byNameAndValue_7 = AdvanceSteel.Nodes.Property.ByNameAndValue(propertyName=advance_steel_bolt_property_7, value=code_block_13.out1)
advance_steel_bolt_property_8 = ASPropertiesBolts("Bolt Assembly")
byNameAndValue_8 = AdvanceSteel.Nodes.Property.ByNameAndValue(propertyName=advance_steel_bolt_property_8, value=code_block_13.out0)
list_create_6 = List.Create(item0=byNameAndValue_6, item1=byNameAndValue_7, item2=byNameAndValue_8)
byRectangle = AdvanceSteel.Nodes.ConnectionObjects.Bolts.RectangularBoltPattern.ByRectangle(rectangle=byWidthLength, noOfBoltsX=code_block_11.out2, objectsToConnect=list_create_5, boltConnectionType=bolt_connection_type_3, additionalBoltParameters=list_create_6)
code_block_14 = CodeBlock { 20; 2; 2; }
advance_steel_bolt_property_9 = ASPropertiesBolts("Bolt Inverted")
code_block_15 = CodeBlock { true; }
byNameAndValue_9 = AdvanceSteel.Nodes.Property.ByNameAndValue(propertyName=advance_steel_bolt_property_9, value=code_block_15)
