# Dynamo graph Bridge.dyn (Dynamo 2.5.2.7915)

# group: GET
# note: Get information / data from Civil 3D

# group: DATA IN
# note: Import information / data from others

# group: PROCESS
# note: Dynamo data manipulation

# group: DATA OUT
# note: Export information / data to others

# group: CREATE
# note: Create object in Civil 3D

# group: SET
# note: Set or Override Parameter in Civil 3D

# group: TEMP
# note: Work in progress / To delete

# group: GEOM
# note: Dynamo geometry creation

# group: GRAPH INFO
# note: ________________________________________________________
# Dynamo Core Ver: 	2.4.1.6394
# Dynamo Civil 3D Ver: 	2.4.1.2161
# Package Used: 		Civil 3D Toolkit
# Custom Nodes Used: 	None
# Graph Function:
# 1. ???
# 2. ???
# 3. ???
# Created By: 		Jowenn S. Lua
# Date Created: 		September 2020
# Updated By:
# Date Modified:

# group: NOTES - D4C3D
# note: DESIGN GRAPH STANDARDS
# Author:		Jowenn S. Lua
# Date Created:	10 August 2019
# Date Updated:	4 September 2020
# Version:		004
# DESIGN GRAPH GUIDELINES
# 1. Color code your blocks according to this guide.
# 2. Add grouping with name and description.
# 3. Add notes to explain each critical node process.
# 4. Rename Input / Output / Code Blocks nodes and add suffix to data they carry.
# 5. Align nodes to make it neat.
# 6. Save the graph as Manual instead of Automatic.

# group: Input values
width = CodeBlock { 5000; }
length = CodeBlock { 15000; }
height_difference_at_ends = CodeBlock { 1500; }
height = CodeBlock { 2500; }
divisions = CodeBlock { 10; }

code_block = CodeBlock(x=width) { -x/2; }
byCoordinates = Point.ByCoordinates(y=code_block)
code_block_2 = CodeBlock(x=length) { x; }
byCoordinates_2 = Point.ByCoordinates(x=code_block_2, y=code_block, z=height_difference_at_ends)
byStartPointEndPoint = Line.ByStartPointEndPoint(startPoint=byCoordinates, endPoint=byCoordinates_2)
code_block_3 = CodeBlock(x=width) { x/2; }
byCoordinates_3 = Point.ByCoordinates(y=code_block_3)
byCoordinates_4 = Point.ByCoordinates(x=length, y=code_block_3, z=height_difference_at_ends)
byStartPointEndPoint_2 = Line.ByStartPointEndPoint(startPoint=byCoordinates_3, endPoint=byCoordinates_4)
ZAxis = Vector.ZAxis()
code_block_4 = CodeBlock(x=height) { x; }
translate = Geometry.Translate(geometry=byStartPointEndPoint, direction=ZAxis, distance=code_block_4)
translate_2 = Geometry.Translate(geometry=byStartPointEndPoint_2, direction=ZAxis, distance=code_block_4)

# group: Lateral beams
bottom_lines = List.Create(item0=byStartPointEndPoint, item1=byStartPointEndPoint_2)
startPoint = Curve.StartPoint(curve=bottom_lines)
endPoint = Curve.EndPoint(curve=bottom_lines)
XAxis = Vector.XAxis()
byStartPointEndPoint_3 = AdvanceSteel.Nodes.Beams.StraightBeam.ByStartPointEndPoint(start=startPoint, end=endPoint, orientation=XAxis)
top_lines = List.Create(item0=translate, item1=translate_2)
startPoint_2 = Curve.StartPoint(curve=top_lines)
endPoint_2 = Curve.EndPoint(curve=top_lines)
XAxis_2 = Vector.XAxis()
byStartPointEndPoint_4 = AdvanceSteel.Nodes.Beams.StraightBeam.ByStartPointEndPoint(start=startPoint_2, end=endPoint_2, orientation=XAxis_2)
code_block_5 = CodeBlock(x=divisions) { 0..1..#x; }
pointAtParameter = Curve.PointAtParameter(curve=bottom_lines, param=code_block_5, lacing=CrossProduct)
pointAtParameter_2 = Curve.PointAtParameter(curve=top_lines, param=code_block_5, lacing=CrossProduct)
XAxis_3 = Vector.XAxis()
byStartPointEndPoint_5 = AdvanceSteel.Nodes.Beams.StraightBeam.ByStartPointEndPoint(start=pointAtParameter, end=pointAtParameter_2, orientation=XAxis_3)
code_block_6 = CodeBlock(x=byStartPointEndPoint_5) { x[0]; 1; "Right side vertical bracing"; x[1]; 1; "Left side vertical bracing"; }
setUserAttribute = AdvanceSteel.Nodes.Util.UserAttribute.SetUserAttribute(steelObject=code_block_6.out0, AttIdx=code_block_6.out1, value=code_block_6.out2)
setUserAttribute_2 = AdvanceSteel.Nodes.Util.UserAttribute.SetUserAttribute(steelObject=code_block_6.out3, AttIdx=code_block_6.out4, value=code_block_6.out5)
code_block_7 = CodeBlock { -1; }
shiftIndices = List.ShiftIndices(amount=code_block_7)  # unwired: list
map = List.Map(list=pointAtParameter_2, f_x=shiftIndices)
keep_connection_between_first = BoolSelector(false)  # "Keep connection between first and last points?"; graph input
formula = Formula("if(keep, 0, -1)", keep=keep_connection_between_first, lacing=CrossProduct)
dropItems = List.DropItems(amount=formula)  # unwired: list
map_2 = List.Map(list=map, f_x=dropItems)
dropItems_2 = List.DropItems(amount=formula)  # unwired: list
map_3 = List.Map(list=pointAtParameter, f_x=dropItems_2)
XAxis_4 = Vector.XAxis()
byStartPointEndPoint_6 = AdvanceSteel.Nodes.Beams.StraightBeam.ByStartPointEndPoint(start=map_2, end=map_3, orientation=XAxis_4)
code_block_8 = CodeBlock(x=byStartPointEndPoint_6) { x[0]; 1; "Right side forward diagonal bracing"; x[1]; 1; "Left side forward diagonal bracing"; }
setUserAttribute_3 = AdvanceSteel.Nodes.Util.UserAttribute.SetUserAttribute(steelObject=code_block_8.out0, AttIdx=code_block_8.out1, value=code_block_8.out2)
setUserAttribute_4 = AdvanceSteel.Nodes.Util.UserAttribute.SetUserAttribute(steelObject=code_block_8.out3, AttIdx=code_block_8.out4, value=code_block_8.out5)
code_block_9 = CodeBlock { 1; }
shiftIndices_2 = List.ShiftIndices(amount=code_block_9)  # unwired: list
map_4 = List.Map(list=pointAtParameter_2, f_x=shiftIndices_2)
formula_2 = Formula("if(keep, 0, 1)", keep=keep_connection_between_first)
dropItems_3 = List.DropItems(amount=formula_2)  # unwired: list
map_5 = List.Map(list=map_4, f_x=dropItems_3)
dropItems_4 = List.DropItems(amount=formula_2)  # unwired: list
map_6 = List.Map(list=pointAtParameter, f_x=dropItems_4)
XAxis_5 = Vector.XAxis()
byStartPointEndPoint_7 = AdvanceSteel.Nodes.Beams.StraightBeam.ByStartPointEndPoint(start=map_5, end=map_6, orientation=XAxis_5)
code_block_10 = CodeBlock(x=byStartPointEndPoint_7) { x[0]; 1; "Right side backward diagonal bracing"; x[1]; 1; "Left side backward diagonal bracing"; }
setUserAttribute_5 = AdvanceSteel.Nodes.Util.UserAttribute.SetUserAttribute(steelObject=code_block_10.out0, AttIdx=code_block_10.out1, value=code_block_10.out2)
setUserAttribute_6 = AdvanceSteel.Nodes.Util.UserAttribute.SetUserAttribute(steelObject=code_block_10.out3, AttIdx=code_block_10.out4, value=code_block_10.out5)

byTwoPoints = Vector.ByTwoPoints(start=byCoordinates, end=byCoordinates_2)
YAxis = Vector.YAxis()
cross = Vector.Cross(vector=byTwoPoints, cross=YAxis)

# group: Top and bottom beams
create = List.Create(item0=translate, item1=byStartPointEndPoint)
code_block_11 = CodeBlock(x=divisions) { 0..1..#x; }
pointAtParameter_3 = Curve.PointAtParameter(curve=create, param=code_block_11, lacing=CrossProduct)
create_2 = List.Create(item0=translate_2, item1=byStartPointEndPoint_2)
pointAtParameter_4 = Curve.PointAtParameter(curve=create_2, param=code_block_11, lacing=CrossProduct)
code_block_12 = CodeBlock(orientation=cross) { orientation; }
byStartPointEndPoint_8 = AdvanceSteel.Nodes.Beams.StraightBeam.ByStartPointEndPoint(start=pointAtParameter_3, end=pointAtParameter_4, orientation=code_block_12)
code_block_13 = CodeBlock(x=byStartPointEndPoint_8) { x[0]; 1; "Top bracing"; x[1]; 1; "Bottom bracing"; }
setUserAttribute_7 = AdvanceSteel.Nodes.Util.UserAttribute.SetUserAttribute(steelObject=code_block_13.out3, AttIdx=code_block_13.out4, value=code_block_13.out5)
setUserAttribute_8 = AdvanceSteel.Nodes.Util.UserAttribute.SetUserAttribute(steelObject=code_block_13.out0, AttIdx=code_block_13.out1, value=code_block_13.out2)
code_block_14 = CodeBlock { -1; }
dropItems_5 = List.DropItems(amount=code_block_14)  # unwired: list
map_7 = List.Map(list=pointAtParameter_3, f_x=dropItems_5)
byStartPointEndPoint_9 = Line.ByStartPointEndPoint(startPoint=pointAtParameter_3, endPoint=pointAtParameter_4)
code_block_15 = CodeBlock { 0.5; }
pointAtParameter_5 = Curve.PointAtParameter(curve=byStartPointEndPoint_9, param=code_block_15, lacing=CrossProduct)
code_block_16 = CodeBlock { -1; }
shiftIndices_3 = List.ShiftIndices(amount=code_block_16)  # unwired: list
map_8 = List.Map(list=pointAtParameter_5, f_x=shiftIndices_3)
code_block_17 = CodeBlock { -1; }
dropItems_6 = List.DropItems(amount=code_block_17)  # unwired: list
map_9 = List.Map(list=map_8, f_x=dropItems_6)
byStartPointEndPoint_10 = AdvanceSteel.Nodes.Beams.StraightBeam.ByStartPointEndPoint(start=map_7, end=map_9, orientation=code_block_12)
code_block_18 = CodeBlock(x=byStartPointEndPoint_10) { x[0]; 1; "Right side top bracing"; x[1]; 1; "Right side bottom bracing"; }
setUserAttribute_9 = AdvanceSteel.Nodes.Util.UserAttribute.SetUserAttribute(steelObject=code_block_18.out3, AttIdx=code_block_18.out4, value=code_block_18.out5)
setUserAttribute_10 = AdvanceSteel.Nodes.Util.UserAttribute.SetUserAttribute(steelObject=code_block_18.out0, AttIdx=code_block_18.out1, value=code_block_18.out2)
code_block_19 = CodeBlock { -1; }
dropItems_7 = List.DropItems(amount=code_block_19)  # unwired: list
map_10 = List.Map(list=pointAtParameter_4, f_x=dropItems_7)
byStartPointEndPoint_11 = AdvanceSteel.Nodes.Beams.StraightBeam.ByStartPointEndPoint(start=map_10, end=map_9, orientation=code_block_12)
code_block_20 = CodeBlock(x=byStartPointEndPoint_11) { x[0]; 1; "Left side top bracing"; x[1]; 1; "Left side bottom bracing"; }
setUserAttribute_11 = AdvanceSteel.Nodes.Util.UserAttribute.SetUserAttribute(steelObject=code_block_20.out3, AttIdx=code_block_20.out4, value=code_block_20.out5)
setUserAttribute_12 = AdvanceSteel.Nodes.Util.UserAttribute.SetUserAttribute(steelObject=code_block_20.out0, AttIdx=code_block_20.out1, value=code_block_20.out2)
