# Dynamo graph Cameras.dyn (Dynamo 2.5.2.7915)

# group: GRAPH INFO
# note: ________________________________________________________
# Dynamo Core Ver: 	2.4.1.6394
# Dynamo Civil 3D Ver: 	2.4.1.2161
# Package Used: 		Civil 3D Toolkit
# Custom Nodes Used: 	None
# Graph Function:
# 1. ???
# 2. ???
# 3. ???
# Created By: 		Jowenn S. Lua
# Date Created: 		September 2020
# Updated By:
# Date Modified:

# group: SET
# note: Set or Override Parameter in Civil 3D

# group: TEMP
# note: Work in progress / To delete

# group: DATA OUT
# note: Export information / data to others

# group: DATA IN
# note: Import information / data from others

# group: PROCESS
# note: Dynamo data manipulation

# group: GEOM
# note: Dynamo geometry creation

# group: GET
# note: Get information / data from Civil 3D

# group: CREATE
# note: Create object in Civil 3D

# group: NOTES - D4C3D
# note: DESIGN GRAPH STANDARDS
# Author:		Jowenn S. Lua
# Date Created:	10 August 2019
# Date Updated:	4 September 2020
# Version:		004
# DESIGN GRAPH GUIDELINES
# 1. Color code your blocks according to this guide.
# 2. Add grouping with name and description.
# 3. Add notes to explain each critical node process.
# 4. Rename Input / Output / Code Blocks nodes and add suffix to data they carry.
# 5. Align nodes to make it neat.
# 6. Save the graph as Manual instead of Automatic.

# group: SET
# note: Set or Override Parameter in Civil 3D
code_block = CodeBlock { CoordinateSystem.ByOriginVectors(Point.ByCoordinates(0,0),Vector.XAxis(),Vector.YAxis()); }
camera_properties = ASPropertiesCamera("Camera Description")
code_block_2 = CodeBlock { "This is   Camera"; }

byNameAndValue = AdvanceSteel.Nodes.Property.ByNameAndValue(propertyName=camera_properties, value=code_block_2)

# group: DATA IN
# note: Import information / data from others
list_create = List.Create(item0=byNameAndValue)

# group: SET
# note: Set or Override Parameter in Civil 3D
byCS = AdvanceSteel.Nodes.Miscellaneous.Camera.ByCS(coordinateSystem=code_block, additionalCameraParameters=list_create)

getCameraExtents = AdvanceSteel.Nodes.Miscellaneous.Camera.GetCameraExtents(steelObject=byCS)
getCameraClipping = AdvanceSteel.Nodes.Miscellaneous.Camera.GetCameraClipping(steelObject=byCS)
code_block_3 = CodeBlock { 501; 1000; 1001; 1000; 2; 3; }
setZClipping = AdvanceSteel.Nodes.Miscellaneous.Camera.SetZClipping(steelObject=byCS, clippingSide=code_block_3.out4, upperClippingValue=code_block_3.out0, lowerClippingValue=code_block_3.out2)
setXYExtents = AdvanceSteel.Nodes.Miscellaneous.Camera.SetXYExtents(steelObject=byCS, cameraExtents=code_block_3.out5, xCameraSize=code_block_3.out1, yCameraSize=code_block_3.out3)
byNameAndValue_2 = AdvanceSteel.Nodes.Property.ByNameAndValue()  # unwired: propertyName, value
