# Dynamo graph Concrete.dyn (Dynamo 2.5.2.7915)

# group: GET
# note: Get information / data from Civil 3D

# group: DATA IN
# note: Import information / data from others

# group: PROCESS
# note: Dynamo data manipulation

# group: DATA OUT
# note: Export information / data to others

# group: CREATE
# note: Create object in Civil 3D

# group: SET
# note: Set or Override Parameter in Civil 3D

# group: TEMP
# note: Work in progress / To delete

# group: GEOM
# note: Dynamo geometry creation

# group: GRAPH INFO
# note: ________________________________________________________
# Dynamo Core Ver: 	2.4.1.6394
# Dynamo Civil 3D Ver: 	2.4.1.2161
# Package Used: 		Civil 3D Toolkit
# Custom Nodes Used: 	None
# Graph Function:
# 1. ???
# 2. ???
# 3. ???
# Created By: 		Jowenn S. Lua
# Date Created: 		September 2020
# Updated By:
# Date Modified:

# group: NOTES - D4C3D
# note: DESIGN GRAPH STANDARDS
# Author:		Jowenn S. Lua
# Date Created:	10 August 2019
# Date Updated:	4 September 2020
# Version:		004
# DESIGN GRAPH GUIDELINES
# 1. Color code your blocks according to this guide.
# 2. Add grouping with name and description.
# 3. Add notes to explain each critical node process.
# 4. Rename Input / Output / Code Blocks nodes and add suffix to data they carry.
# 5. Align nodes to make it neat.
# 6. Save the graph as Manual instead of Automatic.

# group: Isolated Footing Radius
code_block = CodeBlock { 0; }
byCoordinates = Point.ByCoordinates(x=code_block, y=code_block, z=code_block)
code_block_2 = CodeBlock { 1; }
byCoordinates_2 = Vector.ByCoordinates(x=code_block_2, y=code_block, z=code_block)
byCoordinates_3 = Vector.ByCoordinates(x=code_block, y=code_block_2, z=code_block)
byOriginVectors = CoordinateSystem.ByOriginVectors(origin=byCoordinates, xAxis=byCoordinates_2, yAxis=byCoordinates_3)
code_block_3 = CodeBlock { 400; }
code_block_4 = CodeBlock { 1000; }
byRadiusOnCS = AdvanceSteel.Nodes.Concrete.Footings.ByRadiusOnCS(coordinateSystem=byOriginVectors, footingDepth=code_block_3, footingRadius=code_block_4)

# group: Isolated Footing Length Width
code_block_5 = CodeBlock { 1500; }
code_block_6 = CodeBlock { 0; }
byCoordinates_4 = Point.ByCoordinates(x=code_block_5, y=code_block_5, z=code_block_6)
code_block_7 = CodeBlock { 1; }
byCoordinates_5 = Vector.ByCoordinates(x=code_block_7, y=code_block_6, z=code_block_6)
byCoordinates_6 = Vector.ByCoordinates(x=code_block_6, y=code_block_7, z=code_block_6)
byOriginVectors_2 = CoordinateSystem.ByOriginVectors(origin=byCoordinates_4, xAxis=byCoordinates_5, yAxis=byCoordinates_6)
code_block_8 = CodeBlock { 500; }
code_block_9 = CodeBlock { 1000; }
code_block_10 = CodeBlock { 4000; }
byLengthWidthOnCS = AdvanceSteel.Nodes.Concrete.Footings.ByLengthWidthOnCS(coordinateSystem=byOriginVectors_2, footingDepth=code_block_8, footingWidth=code_block_9, footingLength=code_block_10)

# group: Slab Rectangular
code_block_11 = CodeBlock { 5000; }
code_block_12 = CodeBlock { 0; }
byCoordinates_7 = Point.ByCoordinates(x=code_block_11, y=code_block_11, z=code_block_12)
code_block_13 = CodeBlock { 1; }
byCoordinates_8 = Vector.ByCoordinates(x=code_block_13, y=code_block_12, z=code_block_12)
byCoordinates_9 = Vector.ByCoordinates(x=code_block_12, y=code_block_13, z=code_block_12)
byOriginVectors_3 = CoordinateSystem.ByOriginVectors(origin=byCoordinates_7, xAxis=byCoordinates_8, yAxis=byCoordinates_9)
code_block_14 = CodeBlock { 2500; }
code_block_15 = CodeBlock { 5000; }
code_block_16 = CodeBlock { 200; }
byRectangularByCS = AdvanceSteel.Nodes.Concrete.Slabs.ByRectangularByCS(coordinateSystem=byOriginVectors_3, width=code_block_14, length=code_block_15, thickness=code_block_16)  # unwired: additionalConcParameters

# group: Slab By Polygon
code_block_17 = CodeBlock()
# ---------- code_block_17.designscript (4 lines) ----------
Point.ByCoordinates(0, 0, 0);
Point.ByCoordinates(5000, 0, 0);
Point.ByCoordinates(5000, 5000, 0);
Point.ByCoordinates(0, 5000, 0);
# ----------------------------------------
create = List.Create(item0=code_block_17.out0, item1=code_block_17.out1, item2=code_block_17.out2, item3=code_block_17.out3)
byPoints = Polygon.ByPoints(points=create)
code_block_18 = CodeBlock { 200; }
byPolygon = AdvanceSteel.Nodes.Concrete.Slabs.ByPolygon(poly=byPoints, thickness=code_block_18)  # unwired: additionalConcParameters

# group: Circular Slab by Coordinate System
code_block_19 = CodeBlock { 6000; }
code_block_20 = CodeBlock { 0; }
byCoordinates_10 = Point.ByCoordinates(x=code_block_19, y=code_block_19, z=code_block_20)
code_block_21 = CodeBlock { 1; }
byCoordinates_11 = Vector.ByCoordinates(x=code_block_21, y=code_block_20, z=code_block_20)
byCoordinates_12 = Vector.ByCoordinates(x=code_block_20, y=code_block_21, z=code_block_20)
byOriginVectors_4 = CoordinateSystem.ByOriginVectors(origin=byCoordinates_10, xAxis=byCoordinates_11, yAxis=byCoordinates_12)
code_block_22 = CodeBlock { 2500; }
code_block_23 = CodeBlock { 200; }
byCircularByCS = AdvanceSteel.Nodes.Concrete.Slabs.ByCircularByCS(coordinateSystem=byOriginVectors_4, radius=code_block_22, thickness=code_block_23)  # unwired: additionalConcParameters

# group: Concrete Column by Point and Direction
code_block_24 = CodeBlock { "R500x500"; }
code_block_25 = CodeBlock { Point.ByCoordinates(1500,1500,0); 2000; Vector.ZAxis(); Vector.XAxis(); }
byStartPointDirectionLength = AdvanceSteel.Nodes.Concrete.ConcreteStraightBeam.ByStartPointDirectionLength(concName=code_block_24, start=code_block_25.out0, direction=code_block_25.out2, orientation=code_block_25.out3, length=code_block_25.out1)

# group: Concrete Beam by Two Points
code_block_26 = CodeBlock { "D500"; }
code_block_27 = CodeBlock { Point.ByCoordinates(0,0,0); Point.ByCoordinates(0,0,20000); Vector.ZAxis(); }
code_block_28 = CodeBlock { 66; }
byNameAndValue = AdvanceSteel.Nodes.Property.ByNameAndValue(value=code_block_28)  # unwired: propertyName
list_create = List.Create(item0=byNameAndValue)
byStartPointEndPoint = AdvanceSteel.Nodes.Concrete.ConcreteStraightBeam.ByStartPointEndPoint(concName=code_block_26, start=code_block_27.out0, end=code_block_27.out1, orientation=code_block_27.out2, additionalConcParameters=list_create)
concrete_straight_beam = ASPropertiesConcStraightBeam("CenterPoint")  # "Concrete Straight Beam Properties"
byNameAndValue_2 = AdvanceSteel.Nodes.Property.ByNameAndValue(propertyName=concrete_straight_beam, value=code_block_28)

# group: Arc Bent Beam - Start, End and Point on Curve
code_block_29 = CodeBlock { "D500"; }
code_block_30 = CodeBlock { Point.ByCoordinates(0,0,0); Point.ByCoordinates(1000,1200,0); Point.ByCoordinates(2000,2000,0); Vector.ZAxis(); }
byStartPointEndPointOnArc = AdvanceSteel.Nodes.Concrete.ConcreteBentBeam.ByStartPointEndPointOnArc(concName=code_block_29, start=code_block_30.out0, end=code_block_30.out2, ptOnArc=code_block_30.out1, orientation=code_block_30.out3)

# group: Arc Concrete Beams by Dynamo Geometry
code_block_31 = CodeBlock { "D500"; }
code_block_32 = CodeBlock { Point.ByCoordinates(0,15000,0); Point.ByCoordinates(5000,15000,0); Point.ByCoordinates(5000,10000,0); }
byThreePoints = Arc.ByThreePoints(firstPoint=code_block_32.out0, secondPoint=code_block_32.out1, thirdPoint=code_block_32.out2)
byArc = AdvanceSteel.Nodes.Concrete.ConcreteBentBeam.ByArc(concName=code_block_31, arc=byThreePoints)
code_block_33 = CodeBlock { Point.ByCoordinates(0,0,0); Point.ByCoordinates(1000,1200,0); Point.ByCoordinates(2000,2000,0); Vector.ZAxis(); }
code_block_34 = CodeBlock { 45; 135; 3000; }
byCenterPointRadiusAngle = Arc.ByCenterPointRadiusAngle(center=code_block_33.out2, radius=code_block_34.out2, startAngle=code_block_34.out0, endAngle=code_block_34.out1, normal=code_block_33.out3)
byArc_2 = AdvanceSteel.Nodes.Concrete.ConcreteBentBeam.ByArc(concName=code_block_31, arc=byCenterPointRadiusAngle)

# group: Straight Concrete Beam By Dynamo Line
code_block_35 = CodeBlock { "D500"; }
code_block_36 = CodeBlock { Point.ByCoordinates(0,10000,0); Point.ByCoordinates(0,10000,2000); Vector.ZAxis(); }
byStartPointEndPoint_2 = Line.ByStartPointEndPoint(startPoint=code_block_36.out0, endPoint=code_block_36.out1)
byLine = AdvanceSteel.Nodes.Concrete.ConcreteStraightBeam.ByLine(concName=code_block_35, line=byStartPointEndPoint_2, orientation=code_block_36.out2)
