# Dynamo graph Core_AttractorPoint.dyn (Dynamo 0.7.2.2921)

number = DoubleInput(1..15000..1000)
byCoordinates = Point.ByCoordinates(number, number, lacing=CrossProduct)
flatten = Flatten(byCoordinates)
code_block = CodeBlock { 0; }
number_slider = DoubleSlider(7500, range=-10..10000)
number_slider_2 = DoubleSlider(7500, range=-10..10000)
byCoordinates_2 = Point.ByCoordinates(number_slider, number_slider_2)
distanceTo = Geometry.DistanceTo(flatten, byCoordinates_2, lacing=Longest)
code_block_2 = CodeBlock(x=distanceTo) { x/-2; }
byCoordinates_3 = Vector.ByCoordinates(code_block, code_block, code_block_2)
add = Point.Add(flatten, byCoordinates_3)
beamsByGrid = Custom[BeamsByGrid](Grid_Points=add)  # create beams by grid
count = Count(add)
sqrt = Math.Sqrt(count)
chop = List.Chop(add, sqrt)
byPoints = NurbsSurface.ByPoints(chop)
