# Dynamo graph Dome.dyn (Dynamo 2.5.2.7915)
# packages: MeshToolkit 2.0.1

# group: GRAPH INFO
# note: ________________________________________________________
# Dynamo Core Ver: 	2.4.1.6394
# Dynamo Civil 3D Ver: 	2.4.1.2161
# Package Used: 		Civil 3D Toolkit
# Custom Nodes Used: 	None
# Graph Function:
# 1. ???
# 2. ???
# 3. ???
# Created By: 		Jowenn S. Lua
# Date Created: 		September 2020
# Updated By:
# Date Modified:

# group: TEMP
# note: Work in progress / To delete

# group: SET
# note: Set or Override Parameter in Civil 3D

# group: PROCESS
# note: Dynamo data manipulation

# group: GEOM
# note: Dynamo geometry creation

# group: DATA IN
# note: Import information / data from others

# group: DATA OUT
# note: Export information / data to others

# group: NOTES - D4C3D
# note: DESIGN GRAPH STANDARDS
# Author:		Jowenn S. Lua
# Date Created:	10 August 2019
# Date Updated:	4 September 2020
# Version:		004
# DESIGN GRAPH GUIDELINES
# 1. Color code your blocks according to this guide.
# 2. Add grouping with name and description.
# 3. Add notes to explain each critical node process.
# 4. Rename Input / Output / Code Blocks nodes and add suffix to data they carry.
# 5. Align nodes to make it neat.
# 6. Save the graph as Manual instead of Automatic.

# group: GET
# note: Get information / data from Civil 3D

# group: CREATE
# note: Create object in Civil 3D

# group: Input Surface
code_block = CodeBlock { Point.ByCoordinates(0,0,0); }
radius = DoubleSlider(15000, range=0..20000 step 0.1)  # graph input
code_block_2 = CodeBlock { 85; 175; 360; }
XAxis = Vector.XAxis()
byCenterPointRadiusAngle = Arc.ByCenterPointRadiusAngle(center=code_block, radius=radius, startAngle=code_block_2.out0, endAngle=code_block_2.out1, normal=XAxis)
ZAxis = Vector.ZAxis()
byRevolve = Surface.ByRevolve(profile=byCenterPointRadiusAngle, axisDirection=ZAxis, sweepAngle=code_block_2.out2)

# group: Triangulate surface with Advance Steel Plates and Beams
code_block_3 = CodeBlock(surface=byRevolve) { surface; }
# note: You need to have Dynamo Mesh Toolkit in order to use this sample. To install, select "Search for a Package" from the Packages menu, and search for MeshToolkit.
mesh_parameters = CodeBlock { 150; 25; }
code_block_4 = CodeBlock { 0.5; }

byGeometry = Autodesk.Dynamo.MeshToolkit.Mesh.ByGeometry(inputGeometry=code_block_3, tolerance=mesh_parameters.out0, maxGridLines=mesh_parameters.out1)
triangles = Autodesk.Dynamo.MeshToolkit.Mesh.Triangles(mesh=byGeometry)

# group (continued): Triangulate surface with Advance Steel Plates and Beams
perimeterCurves = Surface.PerimeterCurves(surface=triangles)
endPoint = Curve.EndPoint(curve=perimeterCurves)
byPoints = Polygon.ByPoints(points=endPoint)
byPolygon = AdvanceSteel.Nodes.Plates.Plate.ByPolygon(poly=byPoints)

edges = Autodesk.Dynamo.MeshToolkit.Mesh.Edges(mesh=byGeometry)

# group (continued): Triangulate surface with Advance Steel Plates and Beams
startPoint = Curve.StartPoint(curve=edges)
endPoint_2 = Curve.EndPoint(curve=edges)
pointAtParameter = Curve.PointAtParameter(curve=edges, param=code_block_4)
normalAtPoint = Surface.NormalAtPoint(surface=code_block_3, point=pointAtParameter)
byStartPointEndPoint = AdvanceSteel.Nodes.Beams.StraightBeam.ByStartPointEndPoint(start=startPoint, end=endPoint_2, orientation=normalAtPoint)

# group: UserAttibutes
code_block_5 = CodeBlock { 1; "Glass"; "Pipe"; }
setUserAttribute = AdvanceSteel.Nodes.Util.UserAttribute.SetUserAttribute(steelObject=byPolygon, AttIdx=code_block_5.out0, value=code_block_5.out1)
setUserAttribute_2 = AdvanceSteel.Nodes.Util.UserAttribute.SetUserAttribute(steelObject=byStartPointEndPoint, AttIdx=code_block_5.out0, value=code_block_5.out2)
