# Dynamo graph Electrical_Tower.dyn (Dynamo 2.5.2.7915)

# group: GRAPH INFO
# note: ________________________________________________________
# Dynamo Core Ver: 	2.4.1.6394
# Dynamo Civil 3D Ver: 	2.4.1.2161
# Package Used: 		Civil 3D Toolkit
# Custom Nodes Used: 	None
# Graph Function:
# 1. ???
# 2. ???
# 3. ???
# Created By: 		Jowenn S. Lua
# Date Created: 		September 2020
# Updated By:
# Date Modified:

# group: TEMP
# note: Work in progress / To delete

# group: SET
# note: Set or Override Parameter in Civil 3D

# group: PROCESS
# note: Dynamo data manipulation

# group: GEOM
# note: Dynamo geometry creation

# group: DATA IN
# note: Import information / data from others

# group: DATA OUT
# note: Export information / data to others

# group: NOTES - D4C3D
# note: DESIGN GRAPH STANDARDS
# Author:		Jowenn S. Lua
# Date Created:	10 August 2019
# Date Updated:	4 September 2020
# Version:		004
# DESIGN GRAPH GUIDELINES
# 1. Color code your blocks according to this guide.
# 2. Add grouping with name and description.
# 3. Add notes to explain each critical node process.
# 4. Rename Input / Output / Code Blocks nodes and add suffix to data they carry.
# 5. Align nodes to make it neat.
# 6. Save the graph as Manual instead of Automatic.

# group: GET
# note: Get information / data from Civil 3D

# group: CREATE
# note: Create object in Civil 3D

# group: Create Lines for Tower Create Planes Intersection line with plane
code_block = CodeBlock { Point.ByCoordinates(0,0,0); }
XY = Plane.XY()
code_block_2 = CodeBlock { 0; 5000; 10000; 15000; 20000; 25000; }
list_create = List.Create(item0=code_block_2.out0, item1=code_block_2.out1, item2=code_block_2.out2, item3=code_block_2.out3, item4=code_block_2.out4, item5=code_block_2.out5)
offset = Plane.Offset(plane=XY, dist=list_create)
code_block_3 = CodeBlock { 10000; 25000; 5000; 7500; }
byWidthLength = Rectangle.ByWidthLength(plane=offset, width=code_block_3.out2, length=code_block_3.out2)
explode = Geometry.Explode(geometry=byWidthLength)
startPoint = Curve.StartPoint(curve=explode)
endPoint = Curve.EndPoint(curve=explode)
ZAxis = Vector.ZAxis()
byStartPointEndPoint = AdvanceSteel.Nodes.Beams.StraightBeam.ByStartPointEndPoint(start=startPoint, end=endPoint, orientation=ZAxis)
byWidthLength_2 = Rectangle.ByWidthLength(plane=XY, width=code_block_3.out0, length=code_block_3.out0)
explode_2 = Geometry.Explode(geometry=byWidthLength_2)
startPoint_2 = Curve.StartPoint(curve=explode_2)
ZAxis_2 = Vector.ZAxis()
byStartPointEndPoint_2 = AdvanceSteel.Nodes.Beams.StraightBeam.ByStartPointEndPoint(start=startPoint_2, end=startPoint, orientation=ZAxis_2)
endPoint_2 = Curve.EndPoint(curve=explode_2)
