# Dynamo graph GemetricFunctions.dyn (Dynamo 2.5.2.7915)

# group: GET
# note: Get information / data from Civil 3D

# group: DATA IN
# note: Import information / data from others

# group: PROCESS
# note: Dynamo data manipulation

# group: DATA OUT
# note: Export information / data to others

# group: CREATE
# note: Create object in Civil 3D

# group: SET
# note: Set or Override Parameter in Civil 3D

# group: TEMP
# note: Work in progress / To delete

# group: GEOM
# note: Dynamo geometry creation

# group: GRAPH INFO
# note: ________________________________________________________
# Dynamo Core Ver: 	2.4.1.6394
# Dynamo Civil 3D Ver: 	2.4.1.2161
# Package Used: 		Civil 3D Toolkit
# Custom Nodes Used: 	None
# Graph Function:
# 1. ???
# 2. ???
# 3. ???
# Created By: 		Jowenn S. Lua
# Date Created: 		September 2020
# Updated By:
# Date Modified:

# group: NOTES - D4C3D
# note: DESIGN GRAPH STANDARDS
# Author:		Jowenn S. Lua
# Date Created:	10 August 2019
# Date Updated:	4 September 2020
# Version:		004
# DESIGN GRAPH GUIDELINES
# 1. Color code your blocks according to this guide.
# 2. Add grouping with name and description.
# 3. Add notes to explain each critical node process.
# 4. Rename Input / Output / Code Blocks nodes and add suffix to data they carry.
# 5. Align nodes to make it neat.
# 6. Save the graph as Manual instead of Automatic.

code_block = CodeBlock()
# ---------- code_block.designscript (5 lines) ----------
Point.ByCoordinates(0,0,0);
Point.ByCoordinates(2000,0,500);
Point.ByCoordinates(1001,0,0);
Vector.ZAxis();
Vector.XAxis();
# ----------------------------------------
straight_beam_properties = ASPropertiesStraightBeam("Material")
code_block_2 = CodeBlock { "250"; }
byNameAndValue = AdvanceSteel.Nodes.Property.ByNameAndValue(propertyName=straight_beam_properties, value=code_block_2)
list_create = List.Create(item0=byNameAndValue)
byStartPointEndPoint = AdvanceSteel.Nodes.Beams.StraightBeam.ByStartPointEndPoint(start=code_block.out0, end=code_block.out1, orientation=code_block.out3, additionalBeamParameters=list_create)
body_resolution = BodyResolution("Normal")
code_block_3 = CodeBlock { DesignScript.Plane.ByOriginNormal(Point.ByCoordinates(1000,0,0),Vector.XAxis()); }
cutElementByPlane = AdvanceSteel.Nodes.Util.Geometry.CutElementByPlane(steelObject=byStartPointEndPoint, bodyResolution=body_resolution, intersectionPlane=code_block_3)
body_resolution_2 = BodyResolution("Normal")
code_block_4 = CodeBlock { Point.ByCoordinates(500,50,0); Point.ByCoordinates(2000,0,1500); }
byStartPointEndPoint_2 = Line.ByStartPointEndPoint(startPoint=code_block_4.out0, endPoint=code_block_4.out1)
intersectElementByLine = AdvanceSteel.Nodes.Util.Geometry.IntersectElementByLine(steelObject=byStartPointEndPoint, bodyResolution=body_resolution_2, line=byStartPointEndPoint_2)
cutSystemLineByPlane = AdvanceSteel.Nodes.Util.Geometry.CutSystemLineByPlane(steelObject=byStartPointEndPoint, intersectionPlane=code_block_3)
code_block_5 = CodeBlock { Point.ByCoordinates(0,0,0); Point.ByCoordinates(0,100,0); Point.ByCoordinates(500,90,100); }
code_block_6 = CodeBlock { Vector.XAxis(); 100; 200; 300; }
list_create_2 = List.Create(item0=code_block_6.out1, item1=code_block_6.out2, item2=code_block_6.out3)
getPlaneOffsetByCentre = AdvanceSteel.Nodes.Util.Geometry.GetPlaneOffsetByCentre(centrePoint=code_block_5.out1, planeNormal=code_block_6.out0, distance=list_create_2)
getMidBetweenPoints = AdvanceSteel.Nodes.Util.Geometry.GetMidBetweenPoints(firstPoint=code_block_5.out0, secondPoint=code_block_5.out1)
byStartPointEndPoint_3 = Line.ByStartPointEndPoint(startPoint=code_block_5.out0, endPoint=code_block_5.out1)
orthoProjectPointToLine = AdvanceSteel.Nodes.Util.Geometry.OrthoProjectPointToLine(point=code_block_5.out2, line=byStartPointEndPoint_3)
watch = Watch(orthoProjectPointToLine.IsOnline)
watch_2 = Watch(orthoProjectPointToLine.FoundPoint)
getObjectProperties = AdvanceSteel.Nodes.Property.GetObjectProperties(steelObject=byStartPointEndPoint)
byNameAndValue_2 = AdvanceSteel.Nodes.Property.ByNameAndValue(propertyName=straight_beam_properties, value=code_block_2)
