# Dynamo graph Gratings.dyn (Dynamo 2.5.2.7915)

# group: DATA IN
# note: Import information / data from others

# group: GET
# note: Get information / data from Civil 3D

# group: PROCESS
# note: Dynamo data manipulation

# group: SET
# note: Set or Override Parameter in Civil 3D

# group: DATA OUT
# note: Export information / data to others

# group: CREATE
# note: Create object in Civil 3D

# group: GEOM
# note: Dynamo geometry creation

# group: TEMP
# note: Work in progress / To delete

# group: NOTES - D4C3D
# note: DESIGN GRAPH STANDARDS
# Author:		Jowenn S. Lua
# Date Created:	10 August 2019
# Date Updated:	4 September 2020
# Version:		004
# DESIGN GRAPH GUIDELINES
# 1. Color code your blocks according to this guide.
# 2. Add grouping with name and description.
# 3. Add notes to explain each critical node process.
# 4. Rename Input / Output / Code Blocks nodes and add suffix to data they carry.
# 5. Align nodes to make it neat.
# 6. Save the graph as Manual instead of Automatic.

# group: GRAPH INFO
# note: ________________________________________________________
# Dynamo Core Ver: 	2.4.1.6394
# Dynamo Civil 3D Ver: 	2.4.1.2161
# Package Used: 		Civil 3D Toolkit
# Custom Nodes Used: 	None
# Graph Function:
# 1. ???
# 2. ???
# 3. ???
# Created By: 		Jowenn S. Lua
# Date Created: 		September 2020
# Updated By:
# Date Modified:

# group: DATA IN
code_block = CodeBlock { 0; }
# note: Import information / data from others
code_block_2 = CodeBlock { 3000; }
code_block_3 = CodeBlock { 1; }

# group: SET
# note: Set or Override Parameter in Civil 3D
byCoordinates = Point.ByCoordinates(x=code_block, y=code_block, z=code_block)
byCoordinates_2 = Point.ByCoordinates(x=code_block_2, y=code_block, z=code_block)
byStartPointEndPoint = Line.ByStartPointEndPoint(startPoint=byCoordinates, endPoint=byCoordinates_2)
byCoordinates_3 = Vector.ByCoordinates(x=code_block, y=code_block, z=code_block_3)

# group: CREATE
# note: Create object in Civil 3D
byLine = AdvanceSteel.Nodes.Gratings.BarGrating.ByLine(line=byStartPointEndPoint, planeDirection=byCoordinates_3)

# group: SET
# note: Set or Override Parameter in Civil 3D
code_block_4 = CodeBlock { 0; }
code_block_5 = CodeBlock { 1; }

# group: DATA IN
# note: Import information / data from others
byCoordinates_4 = Point.ByCoordinates(x=code_block_4, y=code_block_4, z=code_block_4)
byCoordinates_5 = Vector.ByCoordinates(x=code_block_5, y=code_block_4, z=code_block_4)
byCoordinates_6 = Vector.ByCoordinates(x=code_block_4, y=code_block_5, z=code_block_4)
byOriginVectors = CoordinateSystem.ByOriginVectors(origin=byCoordinates_4, xAxis=byCoordinates_5, yAxis=byCoordinates_6)

# group: SET
# note: Set or Override Parameter in Civil 3D
code_block_6 = CodeBlock { "Webforge Mild Steel"; }
code_block_7 = CodeBlock { "Webforge_Mild _Steel_166"; }

# group: CREATE
# note: Create object in Civil 3D
byCS = AdvanceSteel.Nodes.Gratings.StandardGrating.ByCS(coordinateSystem=byOriginVectors, gratingClass=code_block_6, gratingName=code_block_7)

# group: DATA IN
# note: Import information / data from others
code_block_8 = CodeBlock { 0; }
code_block_9 = CodeBlock { 3000; }
code_block_10 = CodeBlock { 0; }
code_block_11 = CodeBlock { 1000; }
code_block_12 = CodeBlock { 3000; }
code_block_13 = CodeBlock { 1; }

# group: SET
# note: Set or Override Parameter in Civil 3D
byCoordinates_7 = Point.ByCoordinates(x=code_block_8, y=code_block_8, z=code_block_8)
byCoordinates_8 = Point.ByCoordinates(x=code_block_9, y=code_block_8, z=code_block_8)
byCoordinates_9 = Point.ByCoordinates(x=code_block_10, y=code_block_11, z=code_block_10)
byCoordinates_10 = Point.ByCoordinates(x=code_block_12, y=code_block_11, z=code_block_10)
byCoordinates_11 = Vector.ByCoordinates(x=code_block_8, y=code_block_8, z=code_block_13)

# group: CREATE
byStartPointEndPoint_2 = Line.ByStartPointEndPoint(startPoint=byCoordinates_7, endPoint=byCoordinates_8)
byStartPointEndPoint_3 = Line.ByStartPointEndPoint(startPoint=byCoordinates_9, endPoint=byCoordinates_10)
# note: Create object in Civil 3D
list_create = List.Create(item0=byStartPointEndPoint_2, item1=byStartPointEndPoint_3)
byLine_2 = AdvanceSteel.Nodes.Gratings.BarGrating.ByLine(line=list_create, planeDirection=byCoordinates_11)

# group: SET
# note: Set or Override Parameter in Civil 3D
code_block_14 = CodeBlock { 0; }
code_block_15 = CodeBlock { 1; }

# group: DATA IN
# note: Import information / data from others
byCoordinates_12 = Point.ByCoordinates(x=code_block_14, y=code_block_14, z=code_block_14)
byCoordinates_13 = Vector.ByCoordinates(x=code_block_15, y=code_block_14, z=code_block_14)
byCoordinates_14 = Vector.ByCoordinates(x=code_block_14, y=code_block_15, z=code_block_14)
byOriginVectors_2 = CoordinateSystem.ByOriginVectors(origin=byCoordinates_12, xAxis=byCoordinates_13, yAxis=byCoordinates_14)

# group: SET
code_block_16 = CodeBlock { "Webforge Mild Steel"; }
code_block_17 = CodeBlock { "Webforge_Mild _Steel_299"; }
# note: Set or Override Parameter in Civil 3D
code_block_18 = CodeBlock { 1000; }
code_block_19 = CodeBlock { 3000; }

# group: CREATE
# note: Create object in Civil 3D
byRectangularByCS = AdvanceSteel.Nodes.Gratings.VariableGrating.ByRectangularByCS(coordinateSystem=byOriginVectors_2, gratingClass=code_block_16, gratingName=code_block_17, width=code_block_18, length=code_block_19)

# group: SET
# note: Set or Override Parameter in Civil 3D
code_block_20 = CodeBlock()
# ---------- code_block_20.designscript (7 lines) ----------
Point.ByCoordinates(0, 0, 0);
Point.ByCoordinates(500, 0, 0);
Point.ByCoordinates(500, 500, 100);
Point.ByCoordinates(0, 500, 100);
Point.ByCoordinates(1000, 500, 100);
Point.ByCoordinates(1000, 1000, 0);
Point.ByCoordinates(500, 1000, 0);
# ----------------------------------------
create = List.Create(item0=code_block_20.out0, item1=code_block_20.out1, item2=code_block_20.out2, item3=code_block_20.out3)

# group: DATA IN
# note: Import information / data from others
code_block_21 = CodeBlock { "Webforge Mild Steel"; }
code_block_22 = CodeBlock { "Webforge_Mild _Steel_299"; }

# group: CREATE
# note: Create object in Civil 3D
byPoints = Polygon.ByPoints(points=create)
byPolygon = AdvanceSteel.Nodes.Gratings.VariableGrating.ByPolygon(poly=byPoints, gratingClass=code_block_21, gratingName=code_block_22)

# group: SET
# note: Set or Override Parameter in Civil 3D
writable_grating_properties = ASPropertiesGrating("Grating Approval Comment")
code_block_23 = CodeBlock { "sdsd"; }
byNameAndValue = AdvanceSteel.Nodes.Util.Property.ByNameAndValue(propertyType=writable_grating_properties, propertyValue=code_block_23)
writable_grating_properties_2 = ASPropertiesGrating("Select Grating Property...")
byNameAndValue_2 = AdvanceSteel.Nodes.Util.Property.ByNameAndValue(propertyType=writable_grating_properties_2)  # unwired: propertyValue
