# Dynamo graph PlateVertex.dyn (Dynamo 2.5.2.7915)

# group: GRAPH INFO
# note: ________________________________________________________
# Dynamo Core Ver: 	2.4.1.6394
# Dynamo Civil 3D Ver: 	2.4.1.2161
# Package Used: 		Civil 3D Toolkit
# Custom Nodes Used: 	None
# Graph Function:
# 1. ???
# 2. ???
# 3. ???
# Created By: 		Jowenn S. Lua
# Date Created: 		September 2020
# Updated By:
# Date Modified:

# group: TEMP
# note: Work in progress / To delete

# group: SET
# note: Set or Override Parameter in Civil 3D

# group: PROCESS
# note: Dynamo data manipulation

# group: GEOM
# note: Dynamo geometry creation

# group: DATA IN
# note: Import information / data from others

# group: DATA OUT
# note: Export information / data to others

# group: NOTES - D4C3D
# note: DESIGN GRAPH STANDARDS
# Author:		Jowenn S. Lua
# Date Created:	10 August 2019
# Date Updated:	4 September 2020
# Version:		004
# DESIGN GRAPH GUIDELINES
# 1. Color code your blocks according to this guide.
# 2. Add grouping with name and description.
# 3. Add notes to explain each critical node process.
# 4. Rename Input / Output / Code Blocks nodes and add suffix to data they carry.
# 5. Align nodes to make it neat.
# 6. Save the graph as Manual instead of Automatic.

# group: GET
# note: Get information / data from Civil 3D

# group: CREATE
# note: Create object in Civil 3D

# group: DATA IN
# note: Import information / data from others
code_block = CodeBlock { Point.ByCoordinates(1500, 0, 0); Vector.XAxis(); Vector.YAxis(); Vector.ZAxis(); }
code_block_2 = CodeBlock { 350.0; 300.00; }

# group: SET
# note: Set or Override Parameter in Civil 3D
byOriginVectors = CoordinateSystem.ByOriginVectors(origin=code_block.out0, xAxis=code_block.out1, yAxis=code_block.out2, zAxis=code_block.out3)

# group: CREATE
# note: Create object in Civil 3D
byRectanglarByCS = AdvanceSteel.Nodes.Plates.Plate.ByRectanglarByCS(coordinateSystem=byOriginVectors, length=code_block_2.out0, width=code_block_2.out1)

# group: CREATE
code_block_3 = CodeBlock { 51; 0; 1; 2; 3; }
# note: Create object in Civil 3D
byRadius = AdvanceSteel.Nodes.Features.PlateVertexCut.ByRadius(element=byRectanglarByCS, radius=code_block_3.out0, cornerIndex=code_block_3.out2)

# group: DATA IN
# note: Import information / data from others
code_block_4 = CodeBlock { Point.ByCoordinates(2500, 0, 0); Vector.XAxis(); Vector.YAxis(); Vector.ZAxis(); }
code_block_5 = CodeBlock { 350.0; 300.00; }

# group: SET
# note: Set or Override Parameter in Civil 3D
byOriginVectors_2 = CoordinateSystem.ByOriginVectors(origin=code_block_4.out0, xAxis=code_block_4.out1, yAxis=code_block_4.out2, zAxis=code_block_4.out3)

# group: CREATE
# note: Create object in Civil 3D
byRectanglarByCS_2 = AdvanceSteel.Nodes.Plates.Plate.ByRectanglarByCS(coordinateSystem=byOriginVectors_2, length=code_block_5.out0, width=code_block_5.out1)

# group: SET
# note: Set or Override Parameter in Civil 3D
code_block_6 = CodeBlock { 50; 0; 1; 2; 3; 175; }

# group: CREATE
# note: Create object in Civil 3D
byChamfer = AdvanceSteel.Nodes.Features.PlateVertexCut.ByChamfer(element=byRectanglarByCS_2, length1=code_block_6.out0, length2=code_block_6.out5, cornerIndex=code_block_6.out3)

# group: DATA IN
# note: Import information / data from others
code_block_7 = CodeBlock()
# ---------- code_block_7.designscript (4 lines) ----------
Point.ByCoordinates(200, 0, 0);
Point.ByCoordinates(501, 0, 0);
Point.ByCoordinates(501, 500, 100);
Point.ByCoordinates(0, 500, 100);
# ----------------------------------------

# group: SET
# note: Set or Override Parameter in Civil 3D
create = List.Create(item0=code_block_7.out0, item1=code_block_7.out1, item2=code_block_7.out2, item3=code_block_7.out3)
byPoints = Polygon.ByPoints(points=create)

# group: CREATE
# note: Create object in Civil 3D
byPolygon = AdvanceSteel.Nodes.Plates.Plate.ByPolygon(poly=byPoints)

# group: CREATE
# note: Create object in Civil 3D
byChamfer_2 = AdvanceSteel.Nodes.Features.PlateVertexCut.ByChamfer(element=byPolygon, length1=code_block_6.out0, length2=code_block_6.out5, cornerIndex=code_block_6.out4)
