# Dynamo graph Plates.dyn (Dynamo 2.5.2.7915)

# group: GRAPH INFO
# note: ________________________________________________________
# Dynamo Core Ver: 	2.4.1.6394
# Dynamo Civil 3D Ver: 	2.4.1.2161
# Package Used: 		Civil 3D Toolkit
# Custom Nodes Used: 	None
# Graph Function:
# 1. ???
# 2. ???
# 3. ???
# Created By: 		Jowenn S. Lua
# Date Created: 		September 2020
# Updated By:
# Date Modified:

# group: TEMP
# note: Work in progress / To delete

# group: SET
# note: Set or Override Parameter in Civil 3D

# group: PROCESS
# note: Dynamo data manipulation

# group: GEOM
# note: Dynamo geometry creation

# group: DATA IN
# note: Import information / data from others

# group: DATA OUT
# note: Export information / data to others

# group: NOTES - D4C3D
# note: DESIGN GRAPH STANDARDS
# Author:		Jowenn S. Lua
# Date Created:	10 August 2019
# Date Updated:	4 September 2020
# Version:		004
# DESIGN GRAPH GUIDELINES
# 1. Color code your blocks according to this guide.
# 2. Add grouping with name and description.
# 3. Add notes to explain each critical node process.
# 4. Rename Input / Output / Code Blocks nodes and add suffix to data they carry.
# 5. Align nodes to make it neat.
# 6. Save the graph as Manual instead of Automatic.

# group: GET
# note: Get information / data from Civil 3D

# group: CREATE
# note: Create object in Civil 3D

code_block = CodeBlock()
# ---------- code_block.designscript (7 lines) ----------
Point.ByCoordinates(0, 0, 0);
Point.ByCoordinates(500, 0, 0);
Point.ByCoordinates(500, 500, 100);
Point.ByCoordinates(0, 500, 100);
Point.ByCoordinates(1000, 500, 100);
Point.ByCoordinates(1000, 1000, 0);
Point.ByCoordinates(500, 1000, 0);
# ----------------------------------------
create = List.Create(item0=code_block.out0, item1=code_block.out1, item2=code_block.out2, item3=code_block.out3)
byPoints = Polygon.ByPoints(points=create)
byPolygon = AdvanceSteel.Nodes.Plates.Plate.ByPolygon(poly=byPoints)
code_block_2 = CodeBlock { "S235"; }
setMaterial = AdvanceSteel.Nodes.Util.Material.SetMaterial(element=byPolygon, materialName=code_block_2)
create_2 = List.Create(item0=code_block.out2, item1=code_block.out4, item2=code_block.out5, item3=code_block.out6)
byPoints_2 = Polygon.ByPoints(points=create_2)
byPolygon_2 = AdvanceSteel.Nodes.Plates.Plate.ByPolygon(poly=byPoints_2)
code_block_3 = CodeBlock { "S275"; }
setMaterial_2 = AdvanceSteel.Nodes.Util.Material.SetMaterial(element=byPolygon_2, materialName=code_block_3)
