# Dynamo graph Plates_2.dyn (Dynamo 2.5.2.7915)

# group: DATA IN
# note: Import information / data from others

# group: GET
# note: Get information / data from Civil 3D

# group: DATA OUT
# note: Export information / data to others

# group: CREATE
# note: Create object in Civil 3D

# group: PROCESS
# note: Dynamo data manipulation

# group: SET
# note: Set or Override Parameter in Civil 3D

# group: GEOM
# note: Dynamo geometry creation

# group: TEMP
# note: Work in progress / To delete

# group: GRAPH INFO
# note: ________________________________________________________
# Dynamo Core Ver: 	2.4.1.6394
# Dynamo Civil 3D Ver: 	2.4.1.2161
# Package Used: 		Civil 3D Toolkit
# Custom Nodes Used: 	None
# Graph Function:
# 1. ???
# 2. ???
# 3. ???
# Created By: 		Jowenn S. Lua
# Date Created: 		September 2020
# Updated By:
# Date Modified:

# group: NOTES - D4C3D
# note: DESIGN GRAPH STANDARDS
# Author:		Jowenn S. Lua
# Date Created:	10 August 2019
# Date Updated:	4 September 2020
# Version:		004
# DESIGN GRAPH GUIDELINES
# 1. Color code your blocks according to this guide.
# 2. Add grouping with name and description.
# 3. Add notes to explain each critical node process.
# 4. Rename Input / Output / Code Blocks nodes and add suffix to data they carry.
# 5. Align nodes to make it neat.
# 6. Save the graph as Manual instead of Automatic.

# group: DATA IN
# note: Import information / data from others
code_block = CodeBlock()
# ---------- code_block.designscript (4 lines) ----------
Point.ByCoordinates(1, 0, 0);
Point.ByCoordinates(501, 0, 0);
Point.ByCoordinates(501, 500, 100);
Point.ByCoordinates(0, 500, 100);
# ----------------------------------------

# group: SET
# note: Set or Override Parameter in Civil 3D
create = List.Create(item0=code_block.out0, item1=code_block.out1, item2=code_block.out2, item3=code_block.out3)
byPoints = Polygon.ByPoints(points=create)

# group: DATA IN
# note: Import information / data from others
writable_plate_properties = ASPropertiesPlate("Plate Face Alignment")
code_block_2 = CodeBlock { 0.0; 0.5; 1.0; }
writable_plate_properties_2 = ASPropertiesPlate("Plate Thickness")
code_block_3 = CodeBlock { 25.0; }

# group: SET
# note: Set or Override Parameter in Civil 3D
byNameAndValue = AdvanceSteel.Nodes.Util.Property.ByNameAndValue(propertyType=writable_plate_properties, propertyValue=code_block_2.out0)
byNameAndValue_2 = AdvanceSteel.Nodes.Util.Property.ByNameAndValue(propertyType=writable_plate_properties_2, propertyValue=code_block_3)
list_create = List.Create(item0=byNameAndValue, item1=byNameAndValue_2)

# group: CREATE
# note: Create object in Civil 3D
byPolygon = AdvanceSteel.Nodes.Plates.Plate.ByPolygon(poly=byPoints, additionalPlateParameters=list_create)

# group: DATA IN
# note: Import information / data from others
code_block_4 = CodeBlock { Vector.XAxis(); Vector.YAxis(); Vector.ZAxis(); }
code_block_5 = CodeBlock { 250.0; 300.00; }

# group: SET
# note: Set or Override Parameter in Civil 3D
byOriginVectors = CoordinateSystem.ByOriginVectors(origin=code_block.out0, xAxis=code_block_4.out0, yAxis=code_block_4.out1, zAxis=code_block_4.out2)

# group: CREATE
# note: Create object in Civil 3D
byRectanglarByCS = AdvanceSteel.Nodes.Plates.Plate.ByRectanglarByCS(coordinateSystem=byOriginVectors, length=code_block_5.out0, width=code_block_5.out1, additionalPlateParameters=list_create)

# group: DATA IN
# note: Import information / data from others
code_block_6 = CodeBlock()
# ---------- code_block_6.designscript (4 lines) ----------
Point.ByCoordinates(100, 50, 0);
Point.ByCoordinates(1500, 500, 0);
Point.ByCoordinates(501, 500, 100);
Point.ByCoordinates(0, 500, 100);
# ----------------------------------------
code_block_7 = CodeBlock { Vector.XAxis(); Vector.YAxis(); Vector.ZAxis(); }
code_block_8 = CodeBlock { 25; 1; }

# group: SET
# note: Set or Override Parameter in Civil 3D
byOriginVectors_2 = CoordinateSystem.ByOriginVectors(origin=code_block_6.out0, xAxis=code_block_7.out0, yAxis=code_block_7.out1, zAxis=code_block_7.out2)

# group: CREATE
# note: Create object in Civil 3D
byTwoDiagonalPointsByCS = AdvanceSteel.Nodes.Plates.Plate.ByTwoDiagonalPointsByCS(cs=byOriginVectors_2, cornerPoint1=code_block_6.out0, cornerPoint2=code_block_6.out1)

# group: DATA IN
# note: Import information / data from others
code_block_9 = CodeBlock()
# ---------- code_block_9.designscript (4 lines) ----------
Point.ByCoordinates(0, 0, 0);
Point.ByCoordinates(501, 0, 0);
Point.ByCoordinates(501, 500, 100);
Point.ByCoordinates(0, 500, 100);
# ----------------------------------------
code_block_10 = CodeBlock { 100.00; Vector.YAxis(); 25; 1; }

# group: SET
# note: Set or Override Parameter in Civil 3D
byStartPointEndPoint = Line.ByStartPointEndPoint(startPoint=code_block_9.out0, endPoint=code_block_9.out1)

# group: CREATE
# note: Create object in Civil 3D
byLengthEdge = AdvanceSteel.Nodes.Plates.Plate.ByLengthEdge(line=byStartPointEndPoint, normal=code_block_10.out1, width=code_block_10.out0)

code_block_11 = CodeBlock { Point.ByCoordinates(500, 0, 0); Point.ByCoordinates(1505, 0, 0); Point.ByCoordinates(0, 500, 0); 25; 0; }
byThreePoints = AdvanceSteel.Nodes.Plates.Plate.ByThreePoints(xDirectionPoint=code_block_11.out1, yDirectionPoint=code_block_11.out2)  # unwired: orginPoint
