# Dynamo graph PolyCurve.dyn (Dynamo 2.5.2.7915)

# group: GRAPH INFO
# note: ________________________________________________________
# Dynamo Core Ver: 	2.4.1.6394
# Dynamo Civil 3D Ver: 	2.4.1.2161
# Package Used: 		Civil 3D Toolkit
# Custom Nodes Used: 	None
# Graph Function:
# 1. ???
# 2. ???
# 3. ???
# Created By: 		Jowenn S. Lua
# Date Created: 		September 2020
# Updated By:
# Date Modified:

# group: TEMP
# note: Work in progress / To delete

# group: SET
# note: Set or Override Parameter in Civil 3D

# group: PROCESS
# note: Dynamo data manipulation

# group: GEOM
# note: Dynamo geometry creation

# group: DATA IN
# note: Import information / data from others

# group: DATA OUT
# note: Export information / data to others

# group: NOTES - D4C3D
# note: DESIGN GRAPH STANDARDS
# Author:		Jowenn S. Lua
# Date Created:	10 August 2019
# Date Updated:	4 September 2020
# Version:		004
# DESIGN GRAPH GUIDELINES
# 1. Color code your blocks according to this guide.
# 2. Add grouping with name and description.
# 3. Add notes to explain each critical node process.
# 4. Rename Input / Output / Code Blocks nodes and add suffix to data they carry.
# 5. Align nodes to make it neat.
# 6. Save the graph as Manual instead of Automatic.

# group: GET
# note: Get information / data from Civil 3D

# group: CREATE
# note: Create object in Civil 3D

code_block = CodeBlock()
# ---------- code_block.designscript (5 lines) ----------
Point.ByCoordinates(0,0,0);
Point.ByCoordinates(500,0,0);
Point.ByCoordinates(0,300,0);
Point.ByCoordinates(500,300,0);
Point.ByCoordinates(250,300,0);
# ----------------------------------------
byStartPointEndPoint = Line.ByStartPointEndPoint(startPoint=code_block.out0, endPoint=code_block.out1)
byStartPointEndPoint_2 = Line.ByStartPointEndPoint(startPoint=code_block.out0, endPoint=code_block.out2)
byCenterPointStartPointEndPoint = Arc.ByCenterPointStartPointEndPoint(centerPoint=code_block.out4, startPoint=code_block.out3, endPoint=code_block.out2)
byStartPointEndPoint_3 = Line.ByStartPointEndPoint(startPoint=code_block.out1, endPoint=code_block.out3)
list_create = List.Create(item0=byStartPointEndPoint, item1=byStartPointEndPoint_2, item2=byCenterPointStartPointEndPoint, item3=byStartPointEndPoint_3)
byJoinedCurves = PolyCurve.ByJoinedCurves(curves=list_create)
byPolygon = AdvanceSteel.Nodes.Plates.Plate.ByPolygon()  # unwired: poly
