# Dynamo graph PolyCurveExample.dyn (Dynamo 2.5.2.7915)

# group: GET
# note: Get information / data from Civil 3D

# group: DATA IN
# note: Import information / data from others

# group: DATA OUT
# note: Export information / data to others

# group: CREATE
# note: Create object in Civil 3D

# group: PROCESS
# note: Dynamo data manipulation

# group: SET
# note: Set or Override Parameter in Civil 3D

# group: GEOM
# note: Dynamo geometry creation

# group: TEMP
# note: Work in progress / To delete

# group: GRAPH INFO
# note: ________________________________________________________
# Dynamo Core Ver: 	2.4.1.6394
# Dynamo Civil 3D Ver: 	2.4.1.2161
# Package Used: 		Civil 3D Toolkit
# Custom Nodes Used: 	None
# Graph Function:
# 1. ???
# 2. ???
# 3. ???
# Created By: 		Jowenn S. Lua
# Date Created: 		September 2020
# Updated By:
# Date Modified:

# group: NOTES - D4C3D
# note: DESIGN GRAPH STANDARDS
# Author:		Jowenn S. Lua
# Date Created:	10 August 2019
# Date Updated:	4 September 2020
# Version:		004
# DESIGN GRAPH GUIDELINES
# 1. Color code your blocks according to this guide.
# 2. Add grouping with name and description.
# 3. Add notes to explain each critical node process.
# 4. Rename Input / Output / Code Blocks nodes and add suffix to data they carry.
# 5. Align nodes to make it neat.
# 6. Save the graph as Manual instead of Automatic.

# group: SET
code_block = CodeBlock { Point.ByCoordinates(150,300,0); Point.ByCoordinates(350,300,0); }
code_block_2 = CodeBlock { Point.ByCoordinates(150,100,0); Point.ByCoordinates(350,100,0); }
code_block_3 = CodeBlock { Point.ByCoordinates(250,300,0); }
# note: Set or Override Parameter in Civil 3D
code_block_4 = CodeBlock { Point.ByCoordinates(1,390,0); Point.ByCoordinates(502,320,0); Vector.ZAxis(); 1; }
beam_reference_axis = BeamRefAxisType("Upper Left")

# group: CREATE
byStartPointEndPoint = Line.ByStartPointEndPoint(startPoint=code_block.out1, endPoint=code_block_2.out1)
byStartPointEndPoint_2 = Line.ByStartPointEndPoint(startPoint=code_block_2.out1, endPoint=code_block_2.out0)
byStartPointEndPoint_3 = Line.ByStartPointEndPoint(startPoint=code_block_2.out0, endPoint=code_block.out0)
byCenterPointStartPointEndPoint = Arc.ByCenterPointStartPointEndPoint(centerPoint=code_block_3, startPoint=code_block.out1, endPoint=code_block.out0)
reverse = Curve.Reverse(curve=byCenterPointStartPointEndPoint)
# note: Create object in Civil 3D
byStartPointEndPoint_4 = AdvanceSteel.Nodes.Beams.StraightBeam.ByStartPointEndPoint(start=code_block_4.out0, end=code_block_4.out1, orientation=code_block_4.out2, refAxis=beam_reference_axis)

# group: SET
list_create = List.Create(item0=byStartPointEndPoint, item1=byStartPointEndPoint_2, item2=byStartPointEndPoint_3, item3=reverse)
# note: Set or Override Parameter in Civil 3D
code_block_5 = CodeBlock { Vector.XAxis(); }

# group: CREATE
# note: Create object in Civil 3D
fromListCurves = AdvanceSteel.Nodes.Modifications.BeamPolycut.FromListCurves(curves=list_create, lengthVec=code_block_5)  # unwired: element

# group: GET
# note: Get information / data from Civil 3D
endPoint = Curve.EndPoint(curve=byCenterPointStartPointEndPoint)

beam_multi_notch_feature = ASPropertiesBeamPolylineNotchFeatures("Beam Beam Multi Layer")  # "Beam Multi Notch Feature Properties"

# group: SET
code_block_6 = CodeBlock { Point.ByCoordinates(150,300,0); Point.ByCoordinates(350,300,0); }
code_block_7 = CodeBlock { Point.ByCoordinates(150,100,0); Point.ByCoordinates(350,100,0); }
# note: Set or Override Parameter in Civil 3D
code_block_8 = CodeBlock { Point.ByCoordinates(250,300,0); }

# group: CREATE
byStartPointEndPoint_5 = Line.ByStartPointEndPoint(startPoint=code_block_6.out1, endPoint=code_block_7.out1)
byStartPointEndPoint_6 = Line.ByStartPointEndPoint(startPoint=code_block_7.out1, endPoint=code_block_7.out0)
byStartPointEndPoint_7 = Line.ByStartPointEndPoint(startPoint=code_block_7.out0, endPoint=code_block_6.out0)
# note: Create object in Civil 3D
byCenterPointStartPointEndPoint_2 = Arc.ByCenterPointStartPointEndPoint(centerPoint=code_block_8, startPoint=code_block_6.out1, endPoint=code_block_6.out0)
reverse_2 = Curve.Reverse(curve=byCenterPointStartPointEndPoint_2)
list_create_2 = List.Create(item0=byStartPointEndPoint_5, item1=byStartPointEndPoint_6, item2=byStartPointEndPoint_7, item3=reverse_2)
byJoinedCurves = PolyCurve.ByJoinedCurves(curves=list_create_2)

# group: CREATE
# note: Create object in Civil 3D
fromPolyCurve = AdvanceSteel.Nodes.Modifications.BeamPolycut.FromPolyCurve(element=byStartPointEndPoint_4, polyCurve=byJoinedCurves, lengthVec=code_block_5)

# group: CREATE
# note: Create object in Civil 3D
code_block_9 = CodeBlock { Point.ByCoordinates(200,300,0); Vector.ZAxis(); 1000; 2000; }
byRectanglarByPointandNormal = AdvanceSteel.Nodes.Plates.Plate.ByRectanglarByPointandNormal(origin=code_block_9.out0, normal=code_block_9.out1, length=code_block_9.out3, width=code_block_9.out2)

fromPolyCurve_2 = AdvanceSteel.Nodes.Modifications.PlatePolycut.FromPolyCurve(element=byRectanglarByPointandNormal, polyCurve=byJoinedCurves, lengthVec=code_block_5)
plate_notch_contour_feature = ASPropertiesPlatePolylineNotchFeatures("Beam Plate Notch Contour Radius Increment")  # "Plate Notch Contour Feature Properties"
