# Dynamo graph PortalFrame.dyn (Dynamo 2.5.2.7915)

# group: GRAPH INFO
# note: ________________________________________________________
# Dynamo Core Ver: 	2.4.1.6394
# Dynamo Civil 3D Ver: 	2.4.1.2161
# Package Used: 		Civil 3D Toolkit
# Custom Nodes Used: 	None
# Graph Function:
# 1. ???
# 2. ???
# 3. ???
# Created By: 		Jowenn S. Lua
# Date Created: 		September 2020
# Updated By:
# Date Modified:

# group: TEMP
# note: Work in progress / To delete

# group: SET
# note: Set or Override Parameter in Civil 3D

# group: PROCESS
# note: Dynamo data manipulation

# group: GEOM
# note: Dynamo geometry creation

# group: DATA IN
# note: Import information / data from others

# group: DATA OUT
# note: Export information / data to others

# group: NOTES - D4C3D
# note: DESIGN GRAPH STANDARDS
# Author:		Jowenn S. Lua
# Date Created:	10 August 2019
# Date Updated:	4 September 2020
# Version:		004
# DESIGN GRAPH GUIDELINES
# 1. Color code your blocks according to this guide.
# 2. Add grouping with name and description.
# 3. Add notes to explain each critical node process.
# 4. Rename Input / Output / Code Blocks nodes and add suffix to data they carry.
# 5. Align nodes to make it neat.
# 6. Save the graph as Manual instead of Automatic.

# group: GET
# note: Get information / data from Civil 3D

# group: CREATE
# note: Create object in Civil 3D

number = DoubleInput(0)  # graph input

# group: Input values
number_of_frames = IntegerSlider(8, range=0..12 step 1)  # graph input
distance_between_frames = DoubleInput(6000)  # graph input
column_height = DoubleInput(4500)  # graph input
span = DoubleInput(10000)  # graph input
roof_height = DoubleInput(1500)  # graph input
number_of_purlins = DoubleInput(8)  # graph input
number_of_bays_between_bracings = DoubleInput(2)  # graph input

sequence = Sequence(start=number, amount=number_of_frames, step=distance_between_frames, lacing=Longest)
byCoordinates = Point.ByCoordinates(x=sequence, z=column_height)
byCoordinates_2 = Point.ByCoordinates(x=sequence)
byStartPointEndPoint = Line.ByStartPointEndPoint(startPoint=byCoordinates, endPoint=byCoordinates_2)
YAxis = Vector.YAxis()
code_block = CodeBlock(x=span) { x; }
scale = Vector.Scale(vector=YAxis, scale_factor=code_block)
translate = Geometry.Translate(geometry=byStartPointEndPoint, direction=scale)
endPoint = Curve.EndPoint(curve=translate)
pointsBaseLeft = CodeBlock(x=endPoint) { x; }
startPoint = Curve.StartPoint(curve=translate)
pointsRoofLeft = CodeBlock(x=startPoint) { x; }
pointsBaseRight = CodeBlock(x=byCoordinates_2) { x; }
pointsRoofRight = CodeBlock(x=byCoordinates) { x; }

# group: Columns
YAxis_2 = Vector.YAxis()
byStartPointEndPoint_2 = AdvanceSteel.Nodes.Beams.StraightBeam.ByStartPointEndPoint(start=pointsBaseLeft, end=pointsRoofLeft, orientation=YAxis_2)
code_block_2 = CodeBlock { 1; "HEA320"; }
setUserAttribute = AdvanceSteel.Nodes.Util.UserAttribute.SetUserAttribute(steelObject=byStartPointEndPoint_2, AttIdx=code_block_2.out0, value=code_block_2.out1)
byStartPointEndPoint_3 = AdvanceSteel.Nodes.Beams.StraightBeam.ByStartPointEndPoint(start=pointsBaseRight, end=pointsRoofRight, orientation=YAxis_2)
code_block_3 = CodeBlock { 1; "HEA320"; }
setUserAttribute_2 = AdvanceSteel.Nodes.Util.UserAttribute.SetUserAttribute(steelObject=byStartPointEndPoint_3, AttIdx=code_block_3.out0, value=code_block_3.out1)

formula = Formula("x/2", x=code_block)
code_block_4 = CodeBlock(x=roof_height) { x; }
byCoordinates_3 = Vector.ByCoordinates(y=formula, z=code_block_4)
translate_2 = Geometry.Translate(geometry=byCoordinates, direction=byCoordinates_3)
pointsRoofCenter = CodeBlock(x=translate_2) { x; }

# group: Rafter beams
ZAxis = Vector.ZAxis()
byStartPointEndPoint_4 = AdvanceSteel.Nodes.Beams.StraightBeam.ByStartPointEndPoint(start=pointsRoofRight, end=pointsRoofCenter, orientation=ZAxis)
code_block_5 = CodeBlock { 1; "IPE400"; }
setUserAttribute_3 = AdvanceSteel.Nodes.Util.UserAttribute.SetUserAttribute(steelObject=byStartPointEndPoint_4, AttIdx=code_block_5.out0, value=code_block_5.out1)
byStartPointEndPoint_5 = AdvanceSteel.Nodes.Beams.StraightBeam.ByStartPointEndPoint(start=pointsRoofLeft, end=pointsRoofCenter, orientation=ZAxis)
code_block_6 = CodeBlock { 1; "IPE400"; }
setUserAttribute_4 = AdvanceSteel.Nodes.Util.UserAttribute.SetUserAttribute(steelObject=byStartPointEndPoint_5, AttIdx=code_block_6.out0, value=code_block_6.out1)

# group: Eaves beams
pointsRoofRight_2 = CodeBlock(x=pointsRoofRight) { x; }
count = List.Count(list=pointsRoofRight_2)
code_block_7 = CodeBlock(x=count) { 0..x-2; }
getItemAtIndex = List.GetItemAtIndex(list=pointsRoofRight_2, index=code_block_7)
code_block_8 = CodeBlock(x=count) { 1..x-1; }
getItemAtIndex_2 = List.GetItemAtIndex(list=pointsRoofRight_2, index=code_block_8)
ZAxis_2 = Vector.ZAxis()
byStartPointEndPoint_6 = AdvanceSteel.Nodes.Beams.StraightBeam.ByStartPointEndPoint(start=getItemAtIndex, end=getItemAtIndex_2, orientation=ZAxis_2)
code_block_9 = CodeBlock { 1; "IPE200"; }
setUserAttribute_5 = AdvanceSteel.Nodes.Util.UserAttribute.SetUserAttribute(steelObject=byStartPointEndPoint_6, AttIdx=code_block_9.out0, value=code_block_9.out1)
pointsRoofLeft_2 = CodeBlock(x=pointsRoofLeft) { x; }
count_2 = List.Count(list=pointsRoofLeft_2)
code_block_10 = CodeBlock(x=count_2) { 0..x-2; }
getItemAtIndex_3 = List.GetItemAtIndex(list=pointsRoofLeft_2, index=code_block_10)
code_block_11 = CodeBlock(x=count_2) { 1..x-1; }
getItemAtIndex_4 = List.GetItemAtIndex(list=pointsRoofLeft_2, index=code_block_11)
ZAxis_3 = Vector.ZAxis()
byStartPointEndPoint_7 = AdvanceSteel.Nodes.Beams.StraightBeam.ByStartPointEndPoint(start=getItemAtIndex_3, end=getItemAtIndex_4, orientation=ZAxis_3)
code_block_12 = CodeBlock { 1; "IPE200"; }
setUserAttribute_6 = AdvanceSteel.Nodes.Util.UserAttribute.SetUserAttribute(steelObject=byStartPointEndPoint_7, AttIdx=code_block_12.out0, value=code_block_12.out1)

# group: Purlins
pointsRoofRight_3 = CodeBlock(x=pointsRoofRight) { x; }
code_block_13 = CodeBlock(x=pointsRoofRight_3) { x[0]; }
pointsRoofCenter_2 = CodeBlock(x=pointsRoofCenter) { x; }
code_block_14 = CodeBlock(x=pointsRoofCenter_2) { x[0]; }
byTwoPoints = Vector.ByTwoPoints(start=code_block_13, end=code_block_14)
normalized = Vector.Normalized(vector=byTwoPoints)
eaves_offset = CodeBlock { 350; }
translate_3 = Geometry.Translate(geometry=pointsRoofRight_3, direction=normalized, distance=eaves_offset)
reverse = Vector.Reverse(vector=normalized)
apex_offset = CodeBlock { 250; }
translate_4 = Geometry.Translate(geometry=pointsRoofCenter_2, direction=reverse, distance=apex_offset)
byStartPointEndPoint_8 = Line.ByStartPointEndPoint(startPoint=translate_3, endPoint=translate_4)
purlins = CodeBlock(x=number_of_purlins) { x; }
code_block_15 = CodeBlock(x=purlins) { x; }
pointsAtEqualSegmentLength = Curve.PointsAtEqualSegmentLength(curve=byStartPointEndPoint_8, divisions=code_block_15)
splitByPoints = Curve.SplitByPoints(curve=byStartPointEndPoint_8, points=pointsAtEqualSegmentLength)
endPoint_2 = Curve.EndPoint(curve=splitByPoints)
flatten = List.Flatten(list=endPoint_2)
chop = List.Chop(list=flatten, lengths=code_block_15)
count_3 = List.Count(list=chop)
code_block_16 = CodeBlock(x=count_3) { 0..x-2..1; }
getItemAtIndex_5 = List.GetItemAtIndex(list=chop, index=code_block_16)
code_block_17 = CodeBlock(x=count_3) { 1..x-1..1; }
getItemAtIndex_6 = List.GetItemAtIndex(list=chop, index=code_block_17)
code_block_18 = CodeBlock { 0; }
getItemAtIndex_7 = List.GetItemAtIndex(list=byStartPointEndPoint_8, index=code_block_18)
endPoint_3 = Curve.EndPoint(curve=getItemAtIndex_7)
startPoint_2 = Curve.StartPoint(curve=getItemAtIndex_7)
byTwoPoints_2 = Vector.ByTwoPoints(start=endPoint_3, end=startPoint_2)
XAxis = Vector.XAxis()
cross = Vector.Cross(vector=byTwoPoints_2, cross=XAxis)
byStartPointEndPoint_9 = AdvanceSteel.Nodes.Beams.StraightBeam.ByStartPointEndPoint(start=getItemAtIndex_5, end=getItemAtIndex_6, orientation=cross)
code_block_19 = CodeBlock { 1; "Z200"; }
setUserAttribute_7 = AdvanceSteel.Nodes.Util.UserAttribute.SetUserAttribute(steelObject=byStartPointEndPoint_9, AttIdx=code_block_19.out0, value=code_block_19.out1)
pointsRoofLeft_3 = CodeBlock(x=pointsRoofLeft) { x; }
code_block_20 = CodeBlock(x=pointsRoofLeft_3) { x[0]; }
pointsRoofCenter_3 = CodeBlock(x=pointsRoofCenter) { x; }
code_block_21 = CodeBlock(x=pointsRoofCenter_3) { x[0]; }
byTwoPoints_3 = Vector.ByTwoPoints(start=code_block_20, end=code_block_21)
normalized_2 = Vector.Normalized(vector=byTwoPoints_3)
eaves_offset_2 = CodeBlock { 350; }
translate_5 = Geometry.Translate(geometry=pointsRoofLeft_3, direction=normalized_2, distance=eaves_offset_2)
reverse_2 = Vector.Reverse(vector=normalized_2)
apex_offset_2 = CodeBlock { 250; }
translate_6 = Geometry.Translate(geometry=pointsRoofCenter_3, direction=reverse_2, distance=apex_offset_2)
byStartPointEndPoint_10 = Line.ByStartPointEndPoint(startPoint=translate_5, endPoint=translate_6)
code_block_22 = CodeBlock(x=purlins) { x; }
pointsAtEqualSegmentLength_2 = Curve.PointsAtEqualSegmentLength(curve=byStartPointEndPoint_10, divisions=code_block_22)
splitByPoints_2 = Curve.SplitByPoints(curve=byStartPointEndPoint_10, points=pointsAtEqualSegmentLength_2)
endPoint_4 = Curve.EndPoint(curve=splitByPoints_2)
flatten_2 = List.Flatten(list=endPoint_4)
chop_2 = List.Chop(list=flatten_2, lengths=code_block_22)
count_4 = List.Count(list=chop_2)
code_block_23 = CodeBlock(x=count_4) { 0..x-2..1; }
getItemAtIndex_8 = List.GetItemAtIndex(list=chop_2, index=code_block_23)
code_block_24 = CodeBlock(x=count_4) { 1..x-1..1; }
getItemAtIndex_9 = List.GetItemAtIndex(list=chop_2, index=code_block_24)
code_block_25 = CodeBlock { 0; }
getItemAtIndex_10 = List.GetItemAtIndex(list=byStartPointEndPoint_10, index=code_block_25)
endPoint_5 = Curve.EndPoint(curve=getItemAtIndex_10)
startPoint_3 = Curve.StartPoint(curve=getItemAtIndex_10)
byTwoPoints_4 = Vector.ByTwoPoints(start=endPoint_5, end=startPoint_3)
XAxis_2 = Vector.XAxis()
cross_2 = Vector.Cross(vector=byTwoPoints_4, cross=XAxis_2)
byStartPointEndPoint_11 = AdvanceSteel.Nodes.Beams.StraightBeam.ByStartPointEndPoint(start=getItemAtIndex_8, end=getItemAtIndex_9, orientation=cross_2)
code_block_26 = CodeBlock { 1; "Z200"; }
setUserAttribute_8 = AdvanceSteel.Nodes.Util.UserAttribute.SetUserAttribute(steelObject=byStartPointEndPoint_11, AttIdx=code_block_26.out0, value=code_block_26.out1)
listOfPoints = CodeBlock(x=translate_3) { x; }
count_5 = List.Count(list=listOfPoints)
code_block_27 = CodeBlock(x=count_5) { 0..x-2; }
getItemAtIndex_11 = List.GetItemAtIndex(list=listOfPoints, index=code_block_27)
code_block_28 = CodeBlock(x=count_5) { 1..x-1; }
getItemAtIndex_12 = List.GetItemAtIndex(list=listOfPoints, index=code_block_28)
byStartPointEndPoint_12 = AdvanceSteel.Nodes.Beams.StraightBeam.ByStartPointEndPoint(start=getItemAtIndex_11, end=getItemAtIndex_12, orientation=cross)
code_block_29 = CodeBlock { 1; "Z200"; }
setUserAttribute_9 = AdvanceSteel.Nodes.Util.UserAttribute.SetUserAttribute(steelObject=byStartPointEndPoint_12, AttIdx=code_block_29.out0, value=code_block_29.out1)
listOfPoints_2 = CodeBlock(x=translate_5) { x; }
count_6 = List.Count(list=listOfPoints_2)
code_block_30 = CodeBlock(x=count_6) { 0..x-2; }
getItemAtIndex_13 = List.GetItemAtIndex(list=listOfPoints_2, index=code_block_30)
code_block_31 = CodeBlock(x=count_6) { 1..x-1; }
getItemAtIndex_14 = List.GetItemAtIndex(list=listOfPoints_2, index=code_block_31)
byStartPointEndPoint_13 = AdvanceSteel.Nodes.Beams.StraightBeam.ByStartPointEndPoint(start=getItemAtIndex_13, end=getItemAtIndex_14, orientation=cross_2)
code_block_32 = CodeBlock { 1; "Z200"; }
setUserAttribute_10 = AdvanceSteel.Nodes.Util.UserAttribute.SetUserAttribute(steelObject=byStartPointEndPoint_13, AttIdx=code_block_32.out0, value=code_block_32.out1)

# group: Bracings
pointsRoofRight_4 = CodeBlock(x=byCoordinates) { x; }
code_block_33 = CodeBlock { 0; }
code_block_34 = CodeBlock(x=number_of_frames) { x-2; }
code_block_35 = CodeBlock(y=number_of_bays_between_bracings) { y+1; }
range = Range(start=code_block_33, end=code_block_34, step=code_block_35, lacing=Longest)
code_block_36 = CodeBlock(x=range) { x+0; x+1; }
getItemAtIndex_15 = List.GetItemAtIndex(list=pointsRoofRight_4, index=code_block_36.out1)
pointsBaseRight_2 = CodeBlock(x=byCoordinates_2) { x; }
getItemAtIndex_16 = List.GetItemAtIndex(list=pointsBaseRight_2, index=code_block_36.out0)
YAxis_3 = Vector.YAxis()
byStartPointEndPoint_14 = AdvanceSteel.Nodes.Beams.StraightBeam.ByStartPointEndPoint(start=getItemAtIndex_15, end=getItemAtIndex_16, orientation=YAxis_3)
code_block_37 = CodeBlock { 1; "RHS100x10"; }
setUserAttribute_11 = AdvanceSteel.Nodes.Util.UserAttribute.SetUserAttribute(steelObject=byStartPointEndPoint_14, AttIdx=code_block_37.out0, value=code_block_37.out1)
getItemAtIndex_17 = List.GetItemAtIndex(list=pointsRoofRight_4, index=code_block_36.out0)
getItemAtIndex_18 = List.GetItemAtIndex(list=pointsBaseRight_2, index=code_block_36.out1)
YAxis_4 = Vector.YAxis()
byStartPointEndPoint_15 = AdvanceSteel.Nodes.Beams.StraightBeam.ByStartPointEndPoint(start=getItemAtIndex_17, end=getItemAtIndex_18, orientation=YAxis_4)
code_block_38 = CodeBlock { 1; "RHS100x10"; }
setUserAttribute_12 = AdvanceSteel.Nodes.Util.UserAttribute.SetUserAttribute(steelObject=byStartPointEndPoint_15, AttIdx=code_block_38.out0, value=code_block_38.out1)
pointsRoofLeft_4 = CodeBlock(x=pointsRoofLeft) { x; }
range_2 = Range(start=code_block_33, end=code_block_34, step=code_block_35, lacing=Longest)
code_block_39 = CodeBlock(x=range_2) { x+0; x+1; }
getItemAtIndex_19 = List.GetItemAtIndex(list=pointsRoofLeft_4, index=code_block_39.out1)
pointsBaseLeft_2 = CodeBlock(x=pointsBaseLeft) { x; }
getItemAtIndex_20 = List.GetItemAtIndex(list=pointsBaseLeft_2, index=code_block_39.out0)
YAxis_5 = Vector.YAxis()
byStartPointEndPoint_16 = AdvanceSteel.Nodes.Beams.StraightBeam.ByStartPointEndPoint(start=getItemAtIndex_19, end=getItemAtIndex_20, orientation=YAxis_5)
code_block_40 = CodeBlock { 1; "RHS100x10"; }
setUserAttribute_13 = AdvanceSteel.Nodes.Util.UserAttribute.SetUserAttribute(steelObject=byStartPointEndPoint_16, AttIdx=code_block_40.out0, value=code_block_40.out1)
getItemAtIndex_21 = List.GetItemAtIndex(list=pointsRoofLeft_4, index=code_block_39.out0)
getItemAtIndex_22 = List.GetItemAtIndex(list=pointsBaseLeft_2, index=code_block_39.out1)
YAxis_6 = Vector.YAxis()
byStartPointEndPoint_17 = AdvanceSteel.Nodes.Beams.StraightBeam.ByStartPointEndPoint(start=getItemAtIndex_21, end=getItemAtIndex_22, orientation=YAxis_6)
code_block_41 = CodeBlock { 1; "RHS100x10"; }
setUserAttribute_14 = AdvanceSteel.Nodes.Util.UserAttribute.SetUserAttribute(steelObject=byStartPointEndPoint_17, AttIdx=code_block_41.out0, value=code_block_41.out1)
