# Dynamo graph Selection.dyn (Dynamo 2.5.2.7915)

# group: GET
# note: Get information / data from Civil 3D

# group: DATA IN
# note: Import information / data from others

# group: PROCESS
# note: Dynamo data manipulation

# group: DATA OUT
# note: Export information / data to others

# group: CREATE
# note: Create object in Civil 3D

# group: SET
# note: Set or Override Parameter in Civil 3D

# group: TEMP
# note: Work in progress / To delete

# group: GEOM
# note: Dynamo geometry creation

# group: GRAPH INFO
# note: ________________________________________________________
# Dynamo Core Ver: 	2.4.1.6394
# Dynamo Civil 3D Ver: 	2.4.1.2161
# Package Used: 		Civil 3D Toolkit
# Custom Nodes Used: 	None
# Graph Function:
# 1. ???
# 2. ???
# 3. ???
# Created By: 		Jowenn S. Lua
# Date Created: 		September 2020
# Updated By:
# Date Modified:

# group: NOTES - D4C3D
# note: DESIGN GRAPH STANDARDS
# Author:		Jowenn S. Lua
# Date Created:	10 August 2019
# Date Updated:	4 September 2020
# Version:		004
# DESIGN GRAPH GUIDELINES
# 1. Color code your blocks according to this guide.
# 2. Add grouping with name and description.
# 3. Add notes to explain each critical node process.
# 4. Rename Input / Output / Code Blocks nodes and add suffix to data they carry.
# 5. Align nodes to make it neat.
# 6. Save the graph as Manual instead of Automatic.

code_block = CodeBlock { "gg"; }
getSteelObjectsByType = ASSelectObjecTypes("Unfolded Straight Beam")
getObjectProperties = AdvanceSteel.Nodes.Property.GetObjectProperties(steelObject=getSteelObjectsByType)
selectSteelObjects = ASObjectSelection()  # 3 picked in the model
getObjectProperties_2 = AdvanceSteel.Nodes.Property.GetObjectProperties(steelObject=selectSteelObjects)
advance_steel_object_types = ASObjecTypes("Advance Steel Plate")
list_create = List.Create(item0=advance_steel_object_types)
filterSelectionByType = AdvanceSteel.Nodes.Selection.SelectionFilter.FilterSelectionByType(objectTypeFilters=list_create)  # unwired: steelObjects
advance_steel_object_types_2 = ASObjecTypes("Straight Beam")
list_create_2 = List.Create(item0=advance_steel_object_types_2)
filterSelectionByType_2 = AdvanceSteel.Nodes.Selection.SelectionFilter.FilterSelectionByType(objectTypeFilters=list_create_2)  # unwired: steelObjects
advance_steel_object_types_3 = ASObjecTypes("Unfolded Straight Beam")
list_create_3 = List.Create(item0=advance_steel_object_types_3)
filterSelectionByType_3 = AdvanceSteel.Nodes.Selection.SelectionFilter.FilterSelectionByType(objectTypeFilters=list_create_3)  # unwired: steelObjects
selectSteelObjects_2 = ASObjectSelection()  # 3 picked in the model
filterSelectionByType_4 = AdvanceSteel.Nodes.Selection.SelectionFilter.FilterSelectionByType(steelObjects=selectSteelObjects_2, objectTypeFilters=list_create_3)
getObjectProperty = AdvanceSteel.Nodes.Property.GetObjectProperty(steelObject=filterSelectionByType_4)  # unwired: propertyName
