# Dynamo graph Slabs.dyn (Dynamo 2.5.2.7915)

# group: GET
# note: Get information / data from Civil 3D

# group: DATA IN
# note: Import information / data from others

# group: PROCESS
# note: Dynamo data manipulation

# group: DATA OUT
# note: Export information / data to others

# group: CREATE
# note: Create object in Civil 3D

# group: SET
# note: Set or Override Parameter in Civil 3D

# group: TEMP
# note: Work in progress / To delete

# group: GEOM
# note: Dynamo geometry creation

# group: GRAPH INFO
# note: ________________________________________________________
# Dynamo Core Ver: 	2.4.1.6394
# Dynamo Civil 3D Ver: 	2.4.1.2161
# Package Used: 		Civil 3D Toolkit
# Custom Nodes Used: 	None
# Graph Function:
# 1. ???
# 2. ???
# 3. ???
# Created By: 		Jowenn S. Lua
# Date Created: 		September 2020
# Updated By:
# Date Modified:

# group: NOTES - D4C3D
# note: DESIGN GRAPH STANDARDS
# Author:		Jowenn S. Lua
# Date Created:	10 August 2019
# Date Updated:	4 September 2020
# Version:		004
# DESIGN GRAPH GUIDELINES
# 1. Color code your blocks according to this guide.
# 2. Add grouping with name and description.
# 3. Add notes to explain each critical node process.
# 4. Rename Input / Output / Code Blocks nodes and add suffix to data they carry.
# 5. Align nodes to make it neat.
# 6. Save the graph as Manual instead of Automatic.

# group: Slab By Polygon
code_block = CodeBlock()
# ---------- code_block.designscript (4 lines) ----------
Point.ByCoordinates(500, 100, 0);
Point.ByCoordinates(5100, 0, 0);
Point.ByCoordinates(5100, 5000, 0);
Point.ByCoordinates(500, 4901, 0);
# ----------------------------------------
create = List.Create(item0=code_block.out0, item1=code_block.out1, item2=code_block.out2, item3=code_block.out3)
byPoints = Polygon.ByPoints(points=create)
code_block_2 = CodeBlock { 200; }
code_block_3 = CodeBlock { 1; }
byPolygon = AdvanceSteel.Nodes.Concrete.Slabs.ByPolygon(poly=byPoints, thickness=code_block_2, additionalConcParameters=code_block_3)

code_block_4 = CodeBlock()
# ---------- code_block_4.designscript (4 lines) ----------
Point.ByCoordinates(-33.58,8495.24,0.00);
Point.ByCoordinates(4497.61,7356.07,0.00);
Point.ByCoordinates(8993.92,8696.73,0.00);
Point.ByCoordinates(4818.27,13972.81,0.00);
# ----------------------------------------
create_2 = List.Create(item0=code_block_4.out0, item1=code_block_4.out1, item2=code_block_4.out2, item3=code_block_4.out3)
byPoints_2 = Polygon.ByPoints(points=create_2)
code_block_5 = CodeBlock { 200; }
code_block_6 = CodeBlock { 1; }
byPolygon_2 = AdvanceSteel.Nodes.Concrete.Slabs.ByPolygon(poly=byPoints_2, thickness=code_block_5, additionalConcParameters=code_block_6)
