# Dynamo graph SpecialParts.dyn (Dynamo 2.5.2.7915)

# group: GET
# note: Get information / data from Civil 3D

# group: DATA IN
# note: Import information / data from others

# group: PROCESS
# note: Dynamo data manipulation

# group: DATA OUT
# note: Export information / data to others

# group: CREATE
# note: Create object in Civil 3D

# group: SET
# note: Set or Override Parameter in Civil 3D

# group: TEMP
# note: Work in progress / To delete

# group: GEOM
# note: Dynamo geometry creation

# group: GRAPH INFO
# note: ________________________________________________________
# Dynamo Core Ver: 	2.4.1.6394
# Dynamo Civil 3D Ver: 	2.4.1.2161
# Package Used: 		Civil 3D Toolkit
# Custom Nodes Used: 	None
# Graph Function:
# 1. ???
# 2. ???
# 3. ???
# Created By: 		Jowenn S. Lua
# Date Created: 		September 2020
# Updated By:
# Date Modified:

# group: NOTES - D4C3D
# note: DESIGN GRAPH STANDARDS
# Author:		Jowenn S. Lua
# Date Created:	10 August 2019
# Date Updated:	4 September 2020
# Version:		004
# DESIGN GRAPH GUIDELINES
# 1. Color code your blocks according to this guide.
# 2. Add grouping with name and description.
# 3. Add notes to explain each critical node process.
# 4. Rename Input / Output / Code Blocks nodes and add suffix to data they carry.
# 5. Align nodes to make it neat.
# 6. Save the graph as Manual instead of Automatic.

code_block = CodeBlock { CoordinateSystem.ByOrigin(0,0,0); "agnut24"; 1; }
byCSAndBlockName = AdvanceSteel.Nodes.Miscellaneous.SpecialPart.ByCSAndBlockName(coordinateSystem=code_block.out0, blockName=code_block.out1, scale=code_block.out2)
getSteelObjectsByType = ASSelectObjecTypes("Special Part")
code_block_2 = CodeBlock { "NewBlockName"; 1; }
setBlock = AdvanceSteel.Nodes.Miscellaneous.SpecialPart.SetBlock(steelObject=getSteelObjectsByType, blockName=code_block_2.out0, scale=code_block_2.out1)
