# Dynamo graph Structure_Bridge.dyn (Dynamo 0.8.1.1314)

# group: Input
width = CodeBlock { 5000; }
length = CodeBlock { 15000; }
height_difference_at_ends = CodeBlock { 1500; }
height_offset_direction = CodeBlock { Vector.ZAxis(); }
height = CodeBlock { 2500; }
divisions = CodeBlock { 10; }

code_block = CodeBlock(x=width) { x/2; }
byCoordinates = Point.ByCoordinates(y=code_block)
code_block_2 = CodeBlock(x=length) { x; }
code_block_3 = CodeBlock(z=height_difference_at_ends) { z; }
byCoordinates_2 = Point.ByCoordinates(x=code_block_2, y=code_block, z=code_block_3)
byTwoPoints = Vector.ByTwoPoints(start=byCoordinates, end=byCoordinates_2)
YAxis = Vector.YAxis()
cross = Vector.Cross(vector=byTwoPoints, cross=YAxis)
code_block_4 = CodeBlock(x=width) { -x/2; }
byCoordinates_3 = Point.ByCoordinates(y=code_block_4)
code_block_5 = CodeBlock(x=length) { x; }
code_block_6 = CodeBlock(z=height_difference_at_ends) { z; }
byCoordinates_4 = Point.ByCoordinates(x=code_block_5, y=code_block_4, z=code_block_6)
byStartPointEndPoint = Line.ByStartPointEndPoint(startPoint=byCoordinates_3, endPoint=byCoordinates_4)
code_block_7 = CodeBlock(vector=height_offset_direction) { vector; }
code_block_8 = CodeBlock(x=height) { x; }
translate = Geometry.Translate(geometry=byStartPointEndPoint, direction=code_block_7, distance=code_block_8)
code_block_9 = CodeBlock(divisions=divisions) { divisions; }

# group: Right side bracings
code_block_10 = CodeBlock(topCurve=translate) { topCurve; }
startPoint = Curve.StartPoint(code_block_10)
endPoint = Curve.EndPoint(code_block_10)
XAxis = Vector.XAxis()
code_block_11 = CodeBlock(orientation=XAxis) { orientation; }
byStartPointEndPoint_2 = AdvanceSteel.Nodes.StraightBeam.ByStartPointEndPoint(startPoint, endPoint, code_block_11)
code_block_12 = CodeBlock(bottomCurve=byStartPointEndPoint) { bottomCurve; }
code_block_13 = CodeBlock(x=code_block_9) { 0..1..#x; }
pointAtParameter = Curve.PointAtParameter(curve=code_block_12, param=code_block_13)
code_block_14 = CodeBlock(bottomPoints=pointAtParameter) { bottomPoints; }
code_block_15 = CodeBlock(bottomPoints=code_block_14) { bottomPoints; }
keep_connection_between_first = BoolSelector(false)  # "Keep connection between first and last points?"
formula = Formula("if(keep, 0, -1)", keep=keep_connection_between_first)
dropItems = List.DropItems(list=code_block_15, amount=formula)
code_block_16 = CodeBlock(x=code_block_9) { 0..1..#x; }
pointAtParameter_2 = Curve.PointAtParameter(curve=code_block_10, param=code_block_16)
code_block_17 = CodeBlock(topPoints=pointAtParameter_2) { topPoints; }
code_block_18 = CodeBlock(topPoints=code_block_17) { topPoints; }
shift_indexes = CodeBlock { 1; }
code_block_19 = CodeBlock(x=shift_indexes) { -x; }
shiftIndices = List.ShiftIndices(list=code_block_18, amount=code_block_19)
dropItems_2 = List.DropItems(list=shiftIndices, amount=formula)
byStartPointEndPoint_3 = AdvanceSteel.Nodes.StraightBeam.ByStartPointEndPoint(dropItems, dropItems_2, code_block_11)
code_block_20 = CodeBlock(topPoints=code_block_17) { topPoints; }
code_block_21 = CodeBlock(x=shift_indexes) { x; }
shiftIndices_2 = List.ShiftIndices(list=code_block_20, amount=code_block_21)
formula_2 = Formula("if(keep, 0, 1)", keep=keep_connection_between_first)
dropItems_3 = List.DropItems(list=shiftIndices_2, amount=formula_2)
code_block_22 = CodeBlock(bottomPoints=code_block_14) { bottomPoints; }
dropItems_4 = List.DropItems(list=code_block_22, amount=formula_2)
byStartPointEndPoint_4 = AdvanceSteel.Nodes.StraightBeam.ByStartPointEndPoint(dropItems_3, dropItems_4, code_block_11)
startPoint_2 = Curve.StartPoint(code_block_12)
endPoint_2 = Curve.EndPoint(code_block_12)
byStartPointEndPoint_5 = AdvanceSteel.Nodes.StraightBeam.ByStartPointEndPoint(startPoint_2, endPoint_2, code_block_11)
byStartPointEndPoint_6 = AdvanceSteel.Nodes.StraightBeam.ByStartPointEndPoint(code_block_14, code_block_17, code_block_11)

byStartPointEndPoint_7 = Line.ByStartPointEndPoint(startPoint=byCoordinates, endPoint=byCoordinates_2)
translate_2 = Geometry.Translate(geometry=byStartPointEndPoint_7, direction=code_block_7, distance=code_block_8)

# group: Left side bracings
code_block_23 = CodeBlock(topCurve=translate_2) { topCurve; }
startPoint_3 = Curve.StartPoint(code_block_23)
endPoint_3 = Curve.EndPoint(code_block_23)
XAxis_2 = Vector.XAxis()
code_block_24 = CodeBlock(orientation=XAxis_2) { orientation; }
byStartPointEndPoint_8 = AdvanceSteel.Nodes.StraightBeam.ByStartPointEndPoint(startPoint_3, endPoint_3, code_block_24)
code_block_25 = CodeBlock(bottomCurve=byStartPointEndPoint_7) { bottomCurve; }
code_block_26 = CodeBlock(x=code_block_9) { 0..1..#x; }
pointAtParameter_3 = Curve.PointAtParameter(curve=code_block_25, param=code_block_26)
code_block_27 = CodeBlock(bottomPoints=pointAtParameter_3) { bottomPoints; }
code_block_28 = CodeBlock(bottomPoints=code_block_27) { bottomPoints; }
keep_connection_between_first_2 = BoolSelector(false)  # "Keep connection between first and last points?"
formula_3 = Formula("if(keep, 0, -1)", keep=keep_connection_between_first_2)
dropItems_5 = List.DropItems(list=code_block_28, amount=formula_3)
code_block_29 = CodeBlock(x=code_block_9) { 0..1..#x; }
pointAtParameter_4 = Curve.PointAtParameter(curve=code_block_23, param=code_block_29)
code_block_30 = CodeBlock(topPoints=pointAtParameter_4) { topPoints; }
code_block_31 = CodeBlock(topPoints=code_block_30) { topPoints; }
shift_indexes_2 = CodeBlock { 1; }
code_block_32 = CodeBlock(x=shift_indexes_2) { -x; }
shiftIndices_3 = List.ShiftIndices(list=code_block_31, amount=code_block_32)
dropItems_6 = List.DropItems(list=shiftIndices_3, amount=formula_3)
byStartPointEndPoint_9 = AdvanceSteel.Nodes.StraightBeam.ByStartPointEndPoint(dropItems_5, dropItems_6, code_block_24)
code_block_33 = CodeBlock(topPoints=code_block_30) { topPoints; }
code_block_34 = CodeBlock(x=shift_indexes_2) { x; }
shiftIndices_4 = List.ShiftIndices(list=code_block_33, amount=code_block_34)
formula_4 = Formula("if(keep, 0, 1)", keep=keep_connection_between_first_2)
dropItems_7 = List.DropItems(list=shiftIndices_4, amount=formula_4)
code_block_35 = CodeBlock(bottomPoints=code_block_27) { bottomPoints; }
dropItems_8 = List.DropItems(list=code_block_35, amount=formula_4)
byStartPointEndPoint_10 = AdvanceSteel.Nodes.StraightBeam.ByStartPointEndPoint(dropItems_7, dropItems_8, code_block_24)
startPoint_4 = Curve.StartPoint(code_block_25)
endPoint_4 = Curve.EndPoint(code_block_25)
byStartPointEndPoint_11 = AdvanceSteel.Nodes.StraightBeam.ByStartPointEndPoint(startPoint_4, endPoint_4, code_block_24)
byStartPointEndPoint_12 = AdvanceSteel.Nodes.StraightBeam.ByStartPointEndPoint(code_block_27, code_block_30, code_block_24)

byTwoPoints_2 = Vector.ByTwoPoints(start=byCoordinates_3, end=byCoordinates_4)
cross_2 = Vector.Cross(vector=byTwoPoints_2, cross=YAxis)

# group: Bottom bracings
code_block_36 = CodeBlock(topCurve=byStartPointEndPoint) { topCurve; }
code_block_37 = CodeBlock(x=code_block_9) { 0..1..#x; }
pointAtParameter_5 = Curve.PointAtParameter(curve=code_block_36, param=code_block_37)
code_block_38 = CodeBlock(bottomCurve=byStartPointEndPoint_7) { bottomCurve; }
code_block_39 = CodeBlock(x=code_block_9) { 0..1..#x; }
pointAtParameter_6 = Curve.PointAtParameter(curve=code_block_38, param=code_block_39)
code_block_40 = CodeBlock(orientation=cross_2) { orientation; }
byStartPointEndPoint_13 = AdvanceSteel.Nodes.StraightBeam.ByStartPointEndPoint(pointAtParameter_5, pointAtParameter_6, code_block_40)
byStartPointEndPoint_14 = Line.ByStartPointEndPoint(startPoint=pointAtParameter_5, endPoint=pointAtParameter_6)
code_block_41 = CodeBlock { 0.5; }
pointAtParameter_7 = Curve.PointAtParameter(curve=byStartPointEndPoint_14, param=code_block_41)
code_block_42 = CodeBlock { -1; }
shiftIndices_5 = List.ShiftIndices(list=pointAtParameter_7, amount=code_block_42)
dropItems_9 = List.DropItems(list=shiftIndices_5, amount=code_block_42)
byStartPointEndPoint_15 = AdvanceSteel.Nodes.StraightBeam.ByStartPointEndPoint(pointAtParameter_5, dropItems_9, code_block_40)
byStartPointEndPoint_16 = AdvanceSteel.Nodes.StraightBeam.ByStartPointEndPoint(pointAtParameter_6, dropItems_9, code_block_40)

# group: Top bracings
code_block_43 = CodeBlock(topCurve=translate) { topCurve; }
code_block_44 = CodeBlock(x=code_block_9) { 0..1..#x; }
pointAtParameter_8 = Curve.PointAtParameter(curve=code_block_43, param=code_block_44)
code_block_45 = CodeBlock(bottomCurve=translate_2) { bottomCurve; }
code_block_46 = CodeBlock(x=code_block_9) { 0..1..#x; }
pointAtParameter_9 = Curve.PointAtParameter(curve=code_block_45, param=code_block_46)
code_block_47 = CodeBlock(orientation=cross_2) { orientation; }
byStartPointEndPoint_17 = AdvanceSteel.Nodes.StraightBeam.ByStartPointEndPoint(pointAtParameter_8, pointAtParameter_9, code_block_47)
byStartPointEndPoint_18 = Line.ByStartPointEndPoint(startPoint=pointAtParameter_8, endPoint=pointAtParameter_9)
code_block_48 = CodeBlock { 0.5; }
pointAtParameter_10 = Curve.PointAtParameter(curve=byStartPointEndPoint_18, param=code_block_48)
code_block_49 = CodeBlock { -1; }
shiftIndices_6 = List.ShiftIndices(list=pointAtParameter_10, amount=code_block_49)
dropItems_10 = List.DropItems(list=shiftIndices_6, amount=code_block_49)
byStartPointEndPoint_19 = AdvanceSteel.Nodes.StraightBeam.ByStartPointEndPoint(pointAtParameter_8, dropItems_10, code_block_47)
byStartPointEndPoint_20 = AdvanceSteel.Nodes.StraightBeam.ByStartPointEndPoint(pointAtParameter_9, dropItems_10, code_block_47)
