# Dynamo graph Structure_CircularTower.dyn (Dynamo 0.8.1.1314)

# group: Input
height = CodeBlock { 50000; }
divisions = DoubleInput(10)
bottom_radius = CodeBlock { 6000; }
top_radius = CodeBlock { 2000; }

z_coordinates = CodeBlock(heigth=height, x=divisions) { 0..heigth..#x; }
byCoordinates = Point.ByCoordinates(z=z_coordinates)
radius = DoubleInput(a..b..#x, bottom_radius, top_radius, divisions, lacing=Longest)
byCenterPointRadius = Circle.ByCenterPointRadius(centerPoint=byCoordinates, radius=radius)
divisions_2 = DoubleInput(x, divisions, lacing=Longest)
divideEqually = Curve.DivideEqually(byCenterPointRadius, divisions_2)

# group: Bracings
startPoint = Curve.StartPoint(divideEqually)
flatten = Flatten(startPoint)
chop = List.Chop(flatten, divisions_2)
python_script = Python(IN[0]=chop)
# ---------- python_script.python (17 lines) ----------
import clr
clr.AddReference('ProtoGeometry')
from Autodesk.DesignScript.Geometry import *
#The inputs to this node will be stored as a list in the IN variable.
inp = IN[0]

#Assign your output to the OUT variable

start = []
end = []
for i in range(len(inp)-1):
 for j in range(len(inp)):
  start.append(inp[i][(j+i) %(len(inp[i]))])
  end.append(inp[i+1][(j+i+1) %(len(inp[i]))])
  start.append(inp[i][(j+i) %(len(inp[i]))])
  end.append(inp[i+1][(j+i+len(inp[i])-1) %(len(inp[i]))])
OUT = [start,end]
# ----------------------------------------
code_block = CodeBlock(x=python_script) { x[0]; x[1]; }
byStartPointEndPoint = Line.ByStartPointEndPoint(startPoint=code_block.out0, endPoint=code_block.out1)
code_block_2 = CodeBlock { 0.5; }
pointAtParameter = Curve.PointAtParameter(curve=byStartPointEndPoint, param=code_block_2)
Z = Point.Z(pointAtParameter)
byCoordinates_2 = Point.ByCoordinates(z=Z)
byTwoPoints = Vector.ByTwoPoints(start=byCoordinates_2, end=pointAtParameter)
byStartPointEndPoint_2 = AdvanceSteel.Nodes.StraightBeam.ByStartPointEndPoint(code_block.out0, code_block.out1, byTwoPoints)

# group: Horizontal bent beams
startPoint_2 = Curve.StartPoint(divideEqually)
endPoint = Curve.EndPoint(divideEqually)
code_block_3 = CodeBlock { 0.5; }
pointAtParameter_2 = Curve.PointAtParameter(curve=divideEqually, param=code_block_3)
ZAxis = Vector.ZAxis()
byStartPointEndPoint_3 = AdvanceSteel.Nodes.BentBeam.ByStartPointEndPoint(startPoint_2, endPoint, pointAtParameter_2, ZAxis)
