# Dynamo graph Structure_Circus.dyn (Dynamo 0.8.1.1314)

# group: Input values
x_coordinate = CodeBlock { 0; }
y_coordinate = CodeBlock { 0; }
z_coordinate = CodeBlock { 0; }
top_radius = DoubleInput(12000)
column_height = DoubleInput(3500)
divisions = DoubleInput(20)
base_radius = DoubleInput(13000)

byCoordinates = Point.ByCoordinates(x=x_coordinate, y=y_coordinate, z=z_coordinate)
byCenterPointRadius = Circle.ByCenterPointRadius(centerPoint=byCoordinates, radius=top_radius)
byCoordinates_2 = Vector.ByCoordinates(z=column_height)
translate = Geometry.Translate(geometry=byCenterPointRadius, direction=byCoordinates_2)
divisions_2 = CodeBlock(x=divisions) { x; }
divideEqually = Curve.DivideEqually(translate, divisions_2)

# group: Roof Beams
startPoint = Curve.StartPoint(divideEqually)
centerPoint = Circle.CenterPoint(translate)
roof_height = DoubleInput(4000)
byCoordinates_3 = Vector.ByCoordinates(z=roof_height)
translate_2 = Geometry.Translate(geometry=centerPoint, direction=byCoordinates_3)
ZAxis = Vector.ZAxis()
byStartPointEndPoint = AdvanceSteel.Nodes.StraightBeam.ByStartPointEndPoint(startPoint, translate_2, ZAxis)

# group: Bent Beams
bent_beams = CodeBlock(curve=divideEqually) { curve; }
startPoint_2 = Curve.StartPoint(bent_beams)
endPoint = Curve.EndPoint(bent_beams)
middle_of_curve = CodeBlock { 0.5; }
pointAtParameter = Curve.PointAtParameter(curve=bent_beams, param=middle_of_curve)
ZAxis_2 = Vector.ZAxis()
byStartPointEndPoint_2 = AdvanceSteel.Nodes.BentBeam.ByStartPointEndPoint(startPoint_2, endPoint, pointAtParameter, ZAxis_2)

byCenterPointRadius_2 = Circle.ByCenterPointRadius(centerPoint=byCoordinates, radius=base_radius)

# group: Columns
divideEqually_2 = Curve.DivideEqually(byCenterPointRadius_2, divisions_2)
startPoint_3 = Curve.StartPoint(divideEqually_2)
startPoint_4 = Curve.StartPoint(divideEqually)
code_block = CodeBlock { 0; }
normalAtParameter = Curve.NormalAtParameter(curve=divideEqually_2, param=code_block)
byStartPointEndPoint_3 = AdvanceSteel.Nodes.StraightBeam.ByStartPointEndPoint(startPoint_3, startPoint_4, normalAtParameter)
