# Dynamo graph Structure_PortalFrame.dyn (Dynamo 0.8.1.1314)

number = DoubleInput(0)

# group: Input values
number_of_frames = IntegerSlider(8, range=0..12 step 1)
distance_between_frames = DoubleInput(6000)
column_height = DoubleInput(4500)
span = DoubleInput(18000)
roof_height = DoubleInput(1500)
number_of_purlins = DoubleInput(8)
number_of_bays_between_bracings = DoubleInput(2)

number_sequence = NumberSeq(number, number_of_frames, distance_between_frames, lacing=Longest)
byCoordinates = Point.ByCoordinates(x=number_sequence)
pointsBaseRight = CodeBlock(x=byCoordinates) { x; }
byCoordinates_2 = Point.ByCoordinates(x=number_sequence, z=column_height)
pointsRoofRight = CodeBlock(x=byCoordinates_2) { x; }
byStartPointEndPoint = Line.ByStartPointEndPoint(startPoint=byCoordinates_2, endPoint=byCoordinates)
YAxis = Vector.YAxis()
span_2 = DoubleInput(x, span, lacing=Longest)
scale = Vector.Scale(vector=YAxis, scale_factor=span_2)
translate = Geometry.Translate(geometry=byStartPointEndPoint, direction=scale)
startPoint = Curve.StartPoint(translate)
pointsRoofLeft = CodeBlock(x=startPoint) { x; }
formula = Formula("x/2", x=span_2)
roof_height_2 = DoubleInput(x, roof_height, lacing=Longest)
byCoordinates_3 = Vector.ByCoordinates(y=formula, z=roof_height_2)
translate_2 = Geometry.Translate(geometry=byCoordinates_2, direction=byCoordinates_3)
pointsRoofCenter = CodeBlock(x=translate_2) { x; }

# group: Rafter Beams
ZAxis = Vector.ZAxis()
byStartPointEndPoint_2 = AdvanceSteel.Nodes.StraightBeam.ByStartPointEndPoint(pointsRoofLeft, pointsRoofCenter, ZAxis)
byStartPointEndPoint_3 = AdvanceSteel.Nodes.StraightBeam.ByStartPointEndPoint(pointsRoofRight, pointsRoofCenter, ZAxis)

endPoint = Curve.EndPoint(translate)
pointsBaseLeft = CodeBlock(x=endPoint) { x; }

# group: Columns
YAxis_2 = Vector.YAxis()
byStartPointEndPoint_4 = AdvanceSteel.Nodes.StraightBeam.ByStartPointEndPoint(pointsBaseRight, pointsRoofRight, YAxis_2)
byStartPointEndPoint_5 = AdvanceSteel.Nodes.StraightBeam.ByStartPointEndPoint(pointsBaseLeft, pointsRoofLeft, YAxis_2)

# group: Beams at top of columns
pointsRoofLeft_2 = CodeBlock(x=pointsRoofLeft) { x; }
count = List.Count(pointsRoofLeft_2)
code_block = CodeBlock(x=count) { 0..x-2; }
getItemAtIndex = List.GetItemAtIndex(list=pointsRoofLeft_2, index=code_block)
code_block_2 = CodeBlock(x=count) { 1..x-1; }
getItemAtIndex_2 = List.GetItemAtIndex(list=pointsRoofLeft_2, index=code_block_2)
ZAxis_2 = Vector.ZAxis()
byStartPointEndPoint_6 = AdvanceSteel.Nodes.StraightBeam.ByStartPointEndPoint(getItemAtIndex, getItemAtIndex_2, ZAxis_2)
pointsRoofRight_2 = CodeBlock(x=pointsRoofRight) { x; }
count_2 = List.Count(pointsRoofRight_2)
code_block_3 = CodeBlock(x=count_2) { 0..x-2; }
getItemAtIndex_3 = List.GetItemAtIndex(list=pointsRoofRight_2, index=code_block_3)
code_block_4 = CodeBlock(x=count_2) { 1..x-1; }
getItemAtIndex_4 = List.GetItemAtIndex(list=pointsRoofRight_2, index=code_block_4)
ZAxis_3 = Vector.ZAxis()
byStartPointEndPoint_7 = AdvanceSteel.Nodes.StraightBeam.ByStartPointEndPoint(getItemAtIndex_3, getItemAtIndex_4, ZAxis_3)

# group: Purlins
pointsRoofLeft_3 = CodeBlock(x=pointsRoofLeft) { x; }
code_block_5 = CodeBlock(x=pointsRoofLeft_3) { x[0]; }
pointsRoofCenter_2 = CodeBlock(x=pointsRoofCenter) { x; }
code_block_6 = CodeBlock(x=pointsRoofCenter_2) { x[0]; }
byTwoPoints = Vector.ByTwoPoints(start=code_block_5, end=code_block_6)
normalized = Vector.Normalized(byTwoPoints)
eaves_offset = CodeBlock { 350; }
translate_3 = Geometry.Translate(geometry=pointsRoofLeft_3, direction=normalized, distance=eaves_offset)
listOfPoints = CodeBlock(x=translate_3) { x; }
count_3 = List.Count(listOfPoints)
code_block_7 = CodeBlock(x=count_3) { 0..x-2; }
getItemAtIndex_5 = List.GetItemAtIndex(list=listOfPoints, index=code_block_7)
code_block_8 = CodeBlock(x=count_3) { 1..x-1; }
getItemAtIndex_6 = List.GetItemAtIndex(list=listOfPoints, index=code_block_8)
reverse = Vector.Reverse(normalized)
apex_offset = CodeBlock { 250; }
translate_4 = Geometry.Translate(geometry=pointsRoofCenter_2, direction=reverse, distance=apex_offset)
byStartPointEndPoint_8 = Line.ByStartPointEndPoint(startPoint=translate_3, endPoint=translate_4)
code_block_9 = CodeBlock { 0; }
getItemAtIndex_7 = List.GetItemAtIndex(list=byStartPointEndPoint_8, index=code_block_9)
endPoint_2 = Curve.EndPoint(getItemAtIndex_7)
startPoint_2 = Curve.StartPoint(getItemAtIndex_7)
byTwoPoints_2 = Vector.ByTwoPoints(start=endPoint_2, end=startPoint_2)
XAxis = Vector.XAxis()
cross = Vector.Cross(vector=byTwoPoints_2, cross=XAxis)
byStartPointEndPoint_9 = AdvanceSteel.Nodes.StraightBeam.ByStartPointEndPoint(getItemAtIndex_5, getItemAtIndex_6, cross)
purlins = CodeBlock(x=number_of_purlins) { x; }
code_block_10 = CodeBlock(x=purlins) { x; }
divideEqually = Curve.DivideEqually(byStartPointEndPoint_8, code_block_10)
endPoint_3 = Curve.EndPoint(divideEqually)
flatten = Flatten(endPoint_3)
chop = List.Chop(flatten, code_block_10)
count_4 = List.Count(chop)
code_block_11 = CodeBlock(x=count_4) { 0..x-2..1; }
getItemAtIndex_8 = List.GetItemAtIndex(list=chop, index=code_block_11)
code_block_12 = CodeBlock(x=count_4) { 1..x-1..1; }
getItemAtIndex_9 = List.GetItemAtIndex(list=chop, index=code_block_12)
byStartPointEndPoint_10 = AdvanceSteel.Nodes.StraightBeam.ByStartPointEndPoint(getItemAtIndex_8, getItemAtIndex_9, cross)
pointsRoofRight_3 = CodeBlock(x=pointsRoofRight) { x; }
code_block_13 = CodeBlock(x=pointsRoofRight_3) { x[0]; }
pointsRoofCenter_3 = CodeBlock(x=pointsRoofCenter) { x; }
code_block_14 = CodeBlock(x=pointsRoofCenter_3) { x[0]; }
byTwoPoints_3 = Vector.ByTwoPoints(start=code_block_13, end=code_block_14)
normalized_2 = Vector.Normalized(byTwoPoints_3)
eaves_offset_2 = CodeBlock { 350; }
translate_5 = Geometry.Translate(geometry=pointsRoofRight_3, direction=normalized_2, distance=eaves_offset_2)
reverse_2 = Vector.Reverse(normalized_2)
apex_offset_2 = CodeBlock { 250; }
translate_6 = Geometry.Translate(geometry=pointsRoofCenter_3, direction=reverse_2, distance=apex_offset_2)
byStartPointEndPoint_11 = Line.ByStartPointEndPoint(startPoint=translate_5, endPoint=translate_6)
code_block_15 = CodeBlock(x=purlins) { x; }
divideEqually_2 = Curve.DivideEqually(byStartPointEndPoint_11, code_block_15)
endPoint_4 = Curve.EndPoint(divideEqually_2)
flatten_2 = Flatten(endPoint_4)
chop_2 = List.Chop(flatten_2, code_block_15)
count_5 = List.Count(chop_2)
code_block_16 = CodeBlock(x=count_5) { 0..x-2..1; }
getItemAtIndex_10 = List.GetItemAtIndex(list=chop_2, index=code_block_16)
code_block_17 = CodeBlock(x=count_5) { 1..x-1..1; }
getItemAtIndex_11 = List.GetItemAtIndex(list=chop_2, index=code_block_17)
code_block_18 = CodeBlock { 0; }
getItemAtIndex_12 = List.GetItemAtIndex(list=byStartPointEndPoint_11, index=code_block_18)
endPoint_5 = Curve.EndPoint(getItemAtIndex_12)
startPoint_3 = Curve.StartPoint(getItemAtIndex_12)
byTwoPoints_4 = Vector.ByTwoPoints(start=endPoint_5, end=startPoint_3)
XAxis_2 = Vector.XAxis()
cross_2 = Vector.Cross(vector=byTwoPoints_4, cross=XAxis_2)
byStartPointEndPoint_12 = AdvanceSteel.Nodes.StraightBeam.ByStartPointEndPoint(getItemAtIndex_10, getItemAtIndex_11, cross_2)
listOfPoints_2 = CodeBlock(x=translate_5) { x; }
count_6 = List.Count(listOfPoints_2)
code_block_19 = CodeBlock(x=count_6) { 0..x-2; }
getItemAtIndex_13 = List.GetItemAtIndex(list=listOfPoints_2, index=code_block_19)
code_block_20 = CodeBlock(x=count_6) { 1..x-1; }
getItemAtIndex_14 = List.GetItemAtIndex(list=listOfPoints_2, index=code_block_20)
byStartPointEndPoint_13 = AdvanceSteel.Nodes.StraightBeam.ByStartPointEndPoint(getItemAtIndex_13, getItemAtIndex_14, cross_2)

# group: Bracing
pointsRoofRight_4 = CodeBlock(x=byCoordinates_2) { x; }
code_block_21 = CodeBlock { 0; }
code_block_22 = CodeBlock(x=number_of_frames) { x-2; }
code_block_23 = CodeBlock(y=number_of_bays_between_bracings) { y+1; }
number_range = NumberRange(code_block_21, code_block_22, code_block_23, lacing=Longest)
code_block_24 = CodeBlock(x=number_range) { x+0; x+1; }
getItemAtIndex_15 = List.GetItemAtIndex(list=pointsRoofRight_4, index=code_block_24.out1)
pointsBaseRight_2 = CodeBlock(x=byCoordinates) { x; }
getItemAtIndex_16 = List.GetItemAtIndex(list=pointsBaseRight_2, index=code_block_24.out0)
YAxis_3 = Vector.YAxis()
byStartPointEndPoint_14 = AdvanceSteel.Nodes.StraightBeam.ByStartPointEndPoint(getItemAtIndex_15, getItemAtIndex_16, YAxis_3)
getItemAtIndex_17 = List.GetItemAtIndex(list=pointsRoofRight_4, index=code_block_24.out0)
getItemAtIndex_18 = List.GetItemAtIndex(list=pointsBaseRight_2, index=code_block_24.out1)
YAxis_4 = Vector.YAxis()
byStartPointEndPoint_15 = AdvanceSteel.Nodes.StraightBeam.ByStartPointEndPoint(getItemAtIndex_17, getItemAtIndex_18, YAxis_4)
pointsRoofLeft_4 = CodeBlock(x=pointsRoofLeft) { x; }
number_range_2 = NumberRange(code_block_21, code_block_22, code_block_23, lacing=Longest)
code_block_25 = CodeBlock(x=number_range_2) { x+0; x+1; }
getItemAtIndex_19 = List.GetItemAtIndex(list=pointsRoofLeft_4, index=code_block_25.out1)
pointsBaseLeft_2 = CodeBlock(x=pointsBaseLeft) { x; }
getItemAtIndex_20 = List.GetItemAtIndex(list=pointsBaseLeft_2, index=code_block_25.out0)
YAxis_5 = Vector.YAxis()
byStartPointEndPoint_16 = AdvanceSteel.Nodes.StraightBeam.ByStartPointEndPoint(getItemAtIndex_19, getItemAtIndex_20, YAxis_5)
getItemAtIndex_21 = List.GetItemAtIndex(list=pointsRoofLeft_4, index=code_block_25.out0)
getItemAtIndex_22 = List.GetItemAtIndex(list=pointsBaseLeft_2, index=code_block_25.out1)
YAxis_6 = Vector.YAxis()
byStartPointEndPoint_17 = AdvanceSteel.Nodes.StraightBeam.ByStartPointEndPoint(getItemAtIndex_21, getItemAtIndex_22, YAxis_6)
