# Dynamo graph Walls.dyn (Dynamo 2.5.2.7915)

# group: GET
# note: Get information / data from Civil 3D

# group: DATA IN
# note: Import information / data from others

# group: PROCESS
# note: Dynamo data manipulation

# group: DATA OUT
# note: Export information / data to others

# group: CREATE
# note: Create object in Civil 3D

# group: SET
# note: Set or Override Parameter in Civil 3D

# group: TEMP
# note: Work in progress / To delete

# group: GEOM
# note: Dynamo geometry creation

# group: GRAPH INFO
# note: ________________________________________________________
# Dynamo Core Ver: 	2.4.1.6394
# Dynamo Civil 3D Ver: 	2.4.1.2161
# Package Used: 		Civil 3D Toolkit
# Custom Nodes Used: 	None
# Graph Function:
# 1. ???
# 2. ???
# 3. ???
# Created By: 		Jowenn S. Lua
# Date Created: 		September 2020
# Updated By:
# Date Modified:

# group: NOTES - D4C3D
# note: DESIGN GRAPH STANDARDS
# Author:		Jowenn S. Lua
# Date Created:	10 August 2019
# Date Updated:	4 September 2020
# Version:		004
# DESIGN GRAPH GUIDELINES
# 1. Color code your blocks according to this guide.
# 2. Add grouping with name and description.
# 3. Add notes to explain each critical node process.
# 4. Rename Input / Output / Code Blocks nodes and add suffix to data they carry.
# 5. Align nodes to make it neat.
# 6. Save the graph as Manual instead of Automatic.

# group: Face Length Height by Plane
code_block = CodeBlock { Point.ByCoordinates(0,7500,0); Point.ByCoordinates(0,5000,3000); Vector.ZAxis(); }
byOriginNormal = Plane.ByOriginNormal(origin=code_block.out1, normal=code_block.out2)
code_block_2 = CodeBlock { 8500; }
code_block_3 = CodeBlock { 2500; }
code_block_4 = CodeBlock { 250; }
code_block_5 = CodeBlock { 1; }
faceByLengthHeightByPlane = AdvanceSteel.Nodes.Concrete.Walls.FaceByLengthHeightByPlane(plane=byOriginNormal, length=code_block_2, height=code_block_3, thickness=code_block_4, additionalConcParameters=code_block_5)

# group: Face Length Height by CS
code_block_6 = CodeBlock { 1; }
code_block_7 = CodeBlock { 0; }
byCoordinates = Vector.ByCoordinates(x=code_block_6, y=code_block_7, z=code_block_7)
byCoordinates_2 = Vector.ByCoordinates(x=code_block_7, y=code_block_6, z=code_block_7)
byOriginVectors = CoordinateSystem.ByOriginVectors(origin=code_block.out0, xAxis=byCoordinates, yAxis=byCoordinates_2)
code_block_8 = CodeBlock { 3000; }
code_block_9 = CodeBlock { 3000; }
code_block_10 = CodeBlock { 300; }
faceByLengthHeightByCS = AdvanceSteel.Nodes.Concrete.Walls.FaceByLengthHeightByCS(coordinateSystem=byOriginVectors, length=code_block_8, height=code_block_9, thickness=code_block_10, additionalConcParameters=code_block_5)

# group: Wall At Base Length Height CS
byOriginVectors_2 = CoordinateSystem.ByOriginVectors(origin=code_block.out0, xAxis=byCoordinates, yAxis=byCoordinates_2)
code_block_11 = CodeBlock { 6500; }
atBaseByLengthHeightByCS = AdvanceSteel.Nodes.Concrete.Walls.AtBaseByLengthHeightByCS(coordinateSystem=byOriginVectors_2, length=code_block_11, height=code_block_3, thickness=code_block_4, additionalConcParameters=code_block_5)

# group: Wall By Polygon
code_block_12 = CodeBlock()
# ---------- code_block_12.designscript (6 lines) ----------
Point.ByCoordinates(0,7500,0);
Point.ByCoordinates(0,7500,3000);
Point.ByCoordinates(0,10000,3000);
Point.ByCoordinates(0,10000,1000);
Point.ByCoordinates(0,12000,1000);
Point.ByCoordinates(0,12001,0);
# ----------------------------------------
list_create = List.Create(item0=code_block_12.out0, item1=code_block_12.out1, item2=code_block_12.out2, item3=code_block_12.out3, item4=code_block_12.out4, item5=code_block_12.out5)
byPoints = Polygon.ByPoints(points=list_create)
code_block_13 = CodeBlock { 300; }
faceByPolygon = AdvanceSteel.Nodes.Concrete.Walls.FaceByPolygon(poly=byPoints, thickness=code_block_13, additionalConcParameters=code_block_5)
