# Dynamo graph Welds.dyn (Dynamo 2.5.2.7915)

# group: GRAPH INFO
# note: ________________________________________________________
# Dynamo Core Ver: 	2.4.1.6394
# Dynamo Civil 3D Ver: 	2.4.1.2161
# Package Used: 		Civil 3D Toolkit
# Custom Nodes Used: 	None
# Graph Function:
# 1. ???
# 2. ???
# 3. ???
# Created By: 		Jowenn S. Lua
# Date Created: 		September 2020
# Updated By:
# Date Modified:

# group: TEMP
# note: Work in progress / To delete

# group: SET
# note: Set or Override Parameter in Civil 3D

# group: PROCESS
# note: Dynamo data manipulation

# group: GEOM
# note: Dynamo geometry creation

# group: DATA IN
# note: Import information / data from others

# group: DATA OUT
# note: Export information / data to others

# group: NOTES - D4C3D
# note: DESIGN GRAPH STANDARDS
# Author:		Jowenn S. Lua
# Date Created:	10 August 2019
# Date Updated:	4 September 2020
# Version:		004
# DESIGN GRAPH GUIDELINES
# 1. Color code your blocks according to this guide.
# 2. Add grouping with name and description.
# 3. Add notes to explain each critical node process.
# 4. Rename Input / Output / Code Blocks nodes and add suffix to data they carry.
# 5. Align nodes to make it neat.
# 6. Save the graph as Manual instead of Automatic.

# group: GET
# note: Get information / data from Civil 3D

# group: CREATE
# note: Create object in Civil 3D

code_block = CodeBlock { Point.ByCoordinates(0,0,5000); Point.ByCoordinates(2000,0,5000); Vector.ZAxis(); "Bar"; Vector.XAxis(); }
code_block_2 = CodeBlock { Point.ByCoordinates(0,0,0); Point.ByCoordinates(2001,0,0); Vector.ZAxis(); "Horizontal_Beam"; }
code_block_3 = CodeBlock { "AISC 14.1 Angle equal"; "L4X4X7/16"; }
createSectionString = AdvanceSteel.Nodes.Util.BeamSection.CreateSectionString(sectionType=code_block_3.out0, sectionSize=code_block_3.out1)
byStartPointEndPoint = AdvanceSteel.Nodes.Beams.StraightBeam.ByStartPointEndPoint(start=code_block.out0, end=code_block.out1, orientation=code_block_2.out2, refAxis=code_block_2.out3, crossSectionMirror=createSectionString)
code_block_4 = CodeBlock { 5000; }
code_block_5 = CodeBlock { "AISC 14.1 Angle equal"; "L4X4X7/16"; }
createSectionString_2 = AdvanceSteel.Nodes.Util.BeamSection.CreateSectionString(sectionType=code_block_5.out0, sectionSize=code_block_5.out1)
byStartPointDirectionLength = AdvanceSteel.Nodes.Beams.StraightBeam.ByStartPointDirectionLength(start=code_block_2.out0, direction=code_block.out2, orientation=code_block.out4, length=code_block_4, refAxis=code_block.out3, crossSectionMirror=createSectionString_2)
list_create = List.Create(item0=byStartPointEndPoint, item1=byStartPointDirectionLength)
weld_connection = WeldConnectionType("InShop")
byPoint = AdvanceSteel.Nodes.ConnectionObjects.Welds.WeldPoint.ByPoint(point=code_block.out0, objectsToConnect=list_create, connectionType=weld_connection)
code_block_6 = CodeBlock { Point.ByCoordinates(0,-950,0); Vector.XAxis(); Vector.YAxis(); Vector.ZAxis(); }
byOriginVectors = CoordinateSystem.ByOriginVectors(origin=code_block_6.out0, xAxis=code_block_6.out1, yAxis=code_block_6.out2, zAxis=code_block_6.out3)
code_block_7 = CodeBlock { 400; 900; }
byWidthLength = Rectangle.ByWidthLength(cs=byOriginVectors, width=code_block_7.out0, length=code_block_7.out1)
code_block_8 = CodeBlock { Point.ByCoordinates(0,-1200,0); Point.ByCoordinates(1000,-1200,0); 500; 20; 0; Vector.ZAxis(); }
byStartPointEndPoint_2 = Line.ByStartPointEndPoint(startPoint=code_block_8.out0, endPoint=code_block_8.out1)
byLengthEdge = AdvanceSteel.Nodes.Plates.Plate.ByLengthEdge(line=byStartPointEndPoint_2, normal=code_block_8.out5, width=code_block_8.out2, additionalPlateParameters=code_block_8.out3)
byPolyCurve = AdvanceSteel.Nodes.ConnectionObjects.Welds.WeldLine.ByPolyCurve(polyCurve=byWidthLength, objectsToConnect=byLengthEdge, connectionType=weld_connection)
