# Dynamo graph circlular2.dyn (Dynamo 0.7.3.3034)

density = DoubleInput(20)
code_block = CodeBlock(x=density) { 0..30000..#x; }
byCoordinates = Point.ByCoordinates(arg2=code_block)
radius2 = DoubleInput(6000..2000..#x, density, lacing=Longest)
byCenterPointRadius = Circle.ByCenterPointRadius(byCoordinates, radius2)
centerPoint = Circle.CenterPoint(byCenterPointRadius)
divideEqually = Curve.DivideEqually(byCenterPointRadius, density)
code_block_2 = CodeBlock(y=divideEqually) { y; }
startPoint = Curve.StartPoint(code_block_2)
flatten = Flatten(startPoint)
chop = List.Chop(flatten, density)
python_script = Python(IN[0]=chop)
# ---------- python_script.python (17 lines) ----------
import clr
clr.AddReference('ProtoGeometry')
from Autodesk.DesignScript.Geometry import *
#The inputs to this node will be stored as a list in the IN variable.
inp = IN[0]

#Assign your output to the OUT variable

start = []
end = []
for i in range(len(inp)-1):
 for j in range(len(inp)):
  start.append(inp[i][(j+i) %(len(inp[i]))])
  end.append(inp[i+1][(j+i+1) %(len(inp[i]))])
  start.append(inp[i][(j+i) %(len(inp[i]))])
  end.append(inp[i+1][(j+i+len(inp[i])-1) %(len(inp[i]))])
OUT = [start,end]
# ----------------------------------------
code_block_3 = CodeBlock(x=python_script) { x[0]; x[1]; }
byStartPointEndPoint = AdvanceSteel.Nodes.StraightBeam.ByStartPointEndPoint(code_block_3.out0, code_block_3.out1)
code_block_4 = CodeBlock(y=divideEqually) { y; }
startPoint_2 = Curve.StartPoint(code_block_4)
endPoint = Curve.EndPoint(code_block_4)
byStartPointEndPoint_2 = AdvanceSteel.Nodes.StraightBeam.ByStartPointEndPoint(startPoint_2, endPoint)
