# Dynamo graph new curve.dyn (Dynamo 0.7.3.3034)

code_block = CodeBlock { 0..30000..#5; }
code_block_2 = CodeBlock(x=code_block) { x[0]; }
number = DoubleInput(0)
byCoordinates = Point.ByCoordinates(code_block_2, arg2=number)
code_block_3 = CodeBlock(x=code_block) { x[1]; }
number_2 = DoubleInput(10000)
byCoordinates_2 = Point.ByCoordinates(code_block_3, arg2=number_2)
code_block_4 = CodeBlock(x=code_block) { x[2]; }
byCoordinates_3 = Point.ByCoordinates(code_block_4)
code_block_5 = CodeBlock(x=code_block) { x[3]; }
# note: pt 1 len
number_3 = DoubleInput(19000)
byCoordinates_4 = Point.ByCoordinates(code_block_5, arg2=number_3)
code_block_6 = CodeBlock(x=code_block) { x[4]; }
byCoordinates_5 = Point.ByCoordinates(code_block_6)
create = List.Create(byCoordinates, byCoordinates_2, byCoordinates_3, byCoordinates_4, byCoordinates_5)
byControlPoints = NurbsCurve.ByControlPoints(create)
number_4 = DoubleInput(20000)
byCoordinates_6 = Vector.ByCoordinates(arg1=number_4)
extrude = Curve.Extrude(byControlPoints, byCoordinates_6)
number_5 = DoubleInput(0..1..1)
number_6 = DoubleInput(0..1..#20)
byIsoCurveOnSurface = Curve.ByIsoCurveOnSurface(extrude, number_5, number_6, lacing=CrossProduct)
code_block_7 = CodeBlock(x=byIsoCurveOnSurface) { x[0][0]; }
code_block_8 = CodeBlock(x=byIsoCurveOnSurface) { x[0][1]; }
intersect = Geometry.Intersect(code_block_7, code_block_8, lacing=CrossProduct)
beamsByGrid = Custom[BeamsByGrid](Grid_Points=intersect)  # create beams by grid
