# Dynamo graph aspy.dyn (Dynamo 0.7.2.2921)

number = DoubleInput(100)
byCoordinates = Point.ByCoordinates(number, number)
python_script = Python(IN[0]=byCoordinates)
# ---------- python_script.python (11 lines) ----------
import clr
clr.AddReference('ProtoGeometry')
clr.AddReference('AsNodes')
from Autodesk.DesignScript.Geometry import *
from AsNodes import *
#The inputs to this node will be stored as a list in the IN variable.
dataEnteringNode = IN[0]
pt = Point.ByCoordinates(dataEnteringNode.X,dataEnteringNode.Y,dataEnteringNode.Z+1000)
beam = AsStraightBeam.ByStartPointEndPoint(dataEnteringNode,pt)
#Assign your output to the OUT variable
OUT = [beam]
# ----------------------------------------
