# Dynamo graph beam.dyn (Dynamo 0.7.2.2921)

byCoordinates = Point.ByCoordinates()
number = DoubleInput(300)
byCoordinates_2 = Point.ByCoordinates(arg2=number)
byStartPointEndPoint = AdvanceSteel.Nodes.AsStraightBeam.ByStartPointEndPoint(byCoordinates, byCoordinates_2)
