# Dynamo graph bridge03.dyn (Dynamo 0.7.2.2921)

byCoordinates = Point.ByCoordinates()
walkwaySchwing = DoubleSlider(147.079, range=-20..1000)
code_block = CodeBlock { 10000; }
code_block_2 = CodeBlock(x=code_block) { x/2; }
walkwayPeak = DoubleSlider(0, range=1..20)
byCoordinates_2 = Point.ByCoordinates(walkwaySchwing, code_block_2, walkwayPeak)
byCoordinates_3 = Point.ByCoordinates(arg1=code_block)
create = List.Create(byCoordinates, byCoordinates_2, byCoordinates_3)
byPoints = NurbsCurve.ByPoints(create)
support_strut_width = DoubleSlider(1036.842, range=1..3000)
code_block_3 = CodeBlock(a=support_strut_width) { Vector.ByCoordinates(-a..a..#2,0,0); }
translate = Geometry.Translate(byPoints, code_block_3)
code_block_4 = CodeBlock { 0.1..0.9..#31; }
pointAtParameter = Curve.PointAtParameter(translate, code_block_4, lacing=CrossProduct)
footing_offset = DoubleSlider(0, range=-10..40)
code_block_5 = CodeBlock(x=footing_offset) { x; }
byCoordinates_4 = Point.ByCoordinates(code_block_5)
supportSchwing = DoubleSlider(0, range=-10..20)
bridge_length = CodeBlock { 10000; }
code_block_6 = CodeBlock(x=bridge_length) { x/1.5; }
supportPeak = DoubleSlider(1000, range=10..1000)
byCoordinates_5 = Point.ByCoordinates(supportSchwing, code_block_6, supportPeak)
byCoordinates_6 = Point.ByCoordinates(code_block_5, bridge_length)
create_2 = List.Create(byCoordinates_4, byCoordinates_5, byCoordinates_6)
byPoints_2 = NurbsCurve.ByPoints(create_2)
pointAtParameter_2 = Curve.PointAtParameter(byPoints_2, code_block_4)
byStartPointEndPoint = Line.ByStartPointEndPoint(pointAtParameter_2)
map = List.Map(pointAtParameter, byStartPointEndPoint)
deconstruct = List.Deconstruct(pointAtParameter)
watch = Watch(deconstruct.out0)
flatten = Flatten(deconstruct.out1)
watch_2 = Watch(flatten)
byStartPointEndPoint_2 = Line.ByStartPointEndPoint(deconstruct.out0, flatten)
walkway_width = CodeBlock { Vector.ByCoordinates(-800..800..#2,0,0); }
translate_2 = Geometry.Translate(byPoints, walkway_width)
byLoft = Surface.ByLoft(translate_2)
code_block_7 = CodeBlock { -8; }
thicken = Surface.Thicken(byLoft, code_block_7)
