# Dynamo graph circular portal.dyn (Dynamo 0.7.2.2921)

byCoordinates = Point.ByCoordinates()
radius2 = DoubleInput(12000)
byCenterPointRadius = Circle.ByCenterPointRadius(byCoordinates, radius2)
height = DoubleInput(3000)
byCoordinates_2 = Vector.ByCoordinates(arg2=height)
translate = Geometry.Translate(byCenterPointRadius, byCoordinates_2)
density = DoubleInput(20)
divideEqually = Curve.DivideEqually(translate, density)
startPoint = Curve.StartPoint(divideEqually)
byCoordinates_3 = Point.ByCoordinates()
radius = DoubleInput(10000)
byCenterPointRadius_2 = Circle.ByCenterPointRadius(byCoordinates_3, radius)
divideEqually_2 = Curve.DivideEqually(byCenterPointRadius_2, density)
startPoint_2 = Curve.StartPoint(divideEqually_2)
byStartPointEndPoint = Line.ByStartPointEndPoint(startPoint, startPoint_2)
centerPoint = Circle.CenterPoint(translate)
roof_height = DoubleInput(4000)
byCoordinates_4 = Vector.ByCoordinates(arg2=roof_height)
translate_2 = Geometry.Translate(centerPoint, byCoordinates_4)
byStartPointEndPoint_2 = Line.ByStartPointEndPoint(translate_2, startPoint)
byStartPointEndPoint_3 = AdvanceSteel.Nodes.AsStraightBeam.ByStartPointEndPoint(translate_2, startPoint)
endPoint = Curve.EndPoint(divideEqually)
byStartPointEndPoint_4 = AdvanceSteel.Nodes.AsStraightBeam.ByStartPointEndPoint(startPoint, endPoint)
byStartPointEndPoint_5 = AdvanceSteel.Nodes.AsStraightBeam.ByStartPointEndPoint(startPoint, startPoint_2)
