# Dynamo graph cub.dyn (Dynamo 0.7.2.2921)

number = DoubleInput(0..300..100)
number_2 = DoubleInput(0..300..100)
number_3 = DoubleInput(0..300..100)
byCoordinates = Point.ByCoordinates(number, number_2, number_3, lacing=CrossProduct)
code_block = CodeBlock(x=byCoordinates) { x[3]; }
code_block_2 = CodeBlock(x=code_block) { x[0]; }
inaltime = DoubleInput(100)
latime = DoubleInput(100)
lungime = DoubleInput(100)
number_4 = DoubleInput(4)
