# Dynamo graph if.dyn (Dynamo 0.7.2.2921)

number = DoubleInput(12)
code_block = CodeBlock(x=number) { x % 2; }
byCoordinates = Point.ByCoordinates(number, number)
byCoordinates_2 = Point.ByCoordinates(number)
if_ = If(code_block, byCoordinates, byCoordinates_2)
byCoordinates_3 = Point.ByCoordinates()
byStartPointEndPoint = Line.ByStartPointEndPoint(if_, byCoordinates_3)
