# Dynamo graph portal.dyn (Dynamo 0.7.2.2921)

number = DoubleInput(0)
numar_portal_frame = DoubleInput(10)
distanta_intre_portali = DoubleInput(4000)
number_sequence = NumberSeq(number, numar_portal_frame, distanta_intre_portali, lacing=Longest)
inaltime_coloana = DoubleInput(4000)
byCoordinates = Point.ByCoordinates(number_sequence, arg2=inaltime_coloana)
latime = DoubleInput(4000)
code_block = CodeBlock(x=latime) { x/2; }
inaltime_acoperis = DoubleInput(3000)
byCoordinates_2 = Vector.ByCoordinates(arg1=code_block, arg2=inaltime_acoperis)
translate = Geometry.Translate(byCoordinates, byCoordinates_2)
byStartPointEndPoint = AsNodes.AsStraightBeam.ByStartPointEndPoint(byCoordinates, translate)
byCoordinates_3 = Point.ByCoordinates(number_sequence)
byStartPointEndPoint_2 = Line.ByStartPointEndPoint(byCoordinates, byCoordinates_3)
YAxis = Vector.YAxis()
scale = Vector.Scale(YAxis, latime)
translate_2 = Geometry.Translate(byStartPointEndPoint_2, scale)
startPoint = Curve.StartPoint(translate_2)
byStartPointEndPoint_3 = AsNodes.AsStraightBeam.ByStartPointEndPoint(startPoint, translate)
code_block_2 = CodeBlock(l=startPoint) { l; }
count = List.Count(code_block_2)
code_block_3 = CodeBlock(x=count) { 0..x-2; }
getItemAtIndex = List.GetItemAtIndex(code_block_2, code_block_3)
code_block_4 = CodeBlock(x=count) { 1..x-1; }
getItemAtIndex_2 = List.GetItemAtIndex(code_block_2, code_block_4)
byStartPointEndPoint_4 = AsNodes.AsStraightBeam.ByStartPointEndPoint(getItemAtIndex, getItemAtIndex_2)
code_block_5 = CodeBlock(l=translate) { l; }
count_2 = List.Count(code_block_5)
code_block_6 = CodeBlock(x=count_2) { 0..x-2; }
getItemAtIndex_3 = List.GetItemAtIndex(code_block_5, code_block_6)
code_block_7 = CodeBlock(x=count_2) { 1..x-1; }
getItemAtIndex_4 = List.GetItemAtIndex(code_block_5, code_block_7)
byStartPointEndPoint_5 = AsNodes.AsStraightBeam.ByStartPointEndPoint(getItemAtIndex_3, getItemAtIndex_4)
code_block_8 = CodeBlock(l=byCoordinates) { l; }
count_3 = List.Count(code_block_8)
code_block_9 = CodeBlock(x=count_3) { 0..x-2; }
getItemAtIndex_5 = List.GetItemAtIndex(code_block_8, code_block_9)
code_block_10 = CodeBlock(x=count_3) { 1..x-1; }
getItemAtIndex_6 = List.GetItemAtIndex(code_block_8, code_block_10)
byStartPointEndPoint_6 = AsNodes.AsStraightBeam.ByStartPointEndPoint(getItemAtIndex_5, getItemAtIndex_6)
endPoint = Curve.EndPoint(translate_2)
byStartPointEndPoint_7 = AsNodes.AsStraightBeam.ByStartPointEndPoint(endPoint, startPoint)
byStartPointEndPoint_8 = AsNodes.AsStraightBeam.ByStartPointEndPoint(byCoordinates, byCoordinates_3)
