# Dynamo graph t2.dyn (Dynamo 0.7.2.2921)

number = DoubleInput(100)
byCoordinates = Point.ByCoordinates(number)
number_2 = DoubleInput(100)
byCenterPointRadius = Sphere.ByCenterPointRadius(byCoordinates, number_2)
number_3 = DoubleInput(0.4)
scale = Geometry.Scale(byCenterPointRadius, arg3=number_3)
explode = Geometry.Explode(scale)
code_block = CodeBlock(x=explode) { x[0]; }
number_4 = DoubleInput(1)
number_5 = DoubleInput(0)
byIsoCurveOnSurface = Curve.ByIsoCurveOnSurface(code_block, number_4, number_5)
number_6 = DoubleInput(100)
byCoordinates_2 = Point.ByCoordinates(number_6)
byCoordinates_3 = Point.ByCoordinates(number_6)
