# Dynamo graph testgrid.dyn (Dynamo 0.7.2.2921)

number = DoubleInput(0..-10..-5)
number_2 = DoubleInput(0..10..5)
byCoordinates = Point.ByCoordinates(number, number_2, lacing=CrossProduct)
beamsByGrid = Custom[BeamsByGrid](Grid_Points=byCoordinates)  # create beams by grid
code_block = CodeBlock(x=beamsByGrid.Y_Beams) { x; }
